# Grasshopper definition ACORN-shell.gh (Grasshopper 1.0.7)
# plug-ins: HAL for Grasshopper, karambaGH

sessionsettings = SessionSettings()
rectangle = Rectangle(Plane=PlaneXY(0, 0, 0), XSize="-3.9 to 3.9", YSize="-3.6 to 3.6", Radius=0)  # -> Rectangle, Length
make_plan = GhPythonScript(outline=rectangle.Rectangle, corner_radius=Slider(0.2, range=0..1))  # -> plan, corners, edges; inputs outline: Curve
# ---------- make_plan: Python ----------
import sys

sys.path.insert(1, 'Z:/Documents/ACORN-shells/src')

from acorn_shell.generate import make_2d_plan
plan, corners, edges = make_2d_plan(outline, corner_radius)
# ---------- end make_plan ----------
brep = Brep(make_plan.plan)
form_find = GhPythonScript(plan_surface=brep, corners=make_plan.corners, height=Slider(0.8, range=0..1), run=Toggle(True))  # -> form_found_surface, kiwi_errors; inputs plan_surface: Brep, corners: list of Curve, run: Boolean
#   port plan_surface: Surface to be form found
# ---------- form_find: Python ----------
import sys

sys.path.insert(1, 'Z:/Documents/ACORN-shells/src')

import acorn_shell
acorn_shell = reload(acorn_shell)
import acorn_shell.generate
acorn_shell.generate = reload(acorn_shell.generate)
from acorn_shell.generate import form_find
form_found_surface, kiwi_errors = form_find(plan_surface, corners, height, run)
# ---------- end form_find ----------
number_slider = Slider(0.06, range=0..0.1)
srf = Surface(form_find.form_found_surface)
mesh_breps = MeshBrepsKaramba3D(
    Brep=srf,
    MeshResolution=Slider(0.095, range=0..1),
    EdgeRefinementFactor=0.67,
    PointReduction=Toggle(False),
    SmoothingStepSize=Slider(1, range=0..1),
    SmoothingIterations=Slider(1, range=0..10))  # -> Mesh, Info
python = GhPythonScript(mesh=mesh_breps.Mesh, corners=make_plan.corners, thickness=Slider(6, range=0..10))  # -> out, a; inputs mesh: Mesh, corners: list of Curve
# ---------- python: Python ----------
import clr
import System
from System.Collections.Generic import List

clr.AddReferenceToFileAndPath("C:\Program Files\Rhino 6\Plug-ins\Karamba\Karamba.gha")
clr.AddReferenceToFileAndPath("C:\Program Files\Rhino 6\Plug-ins\Karamba\KarambaCommon.dll")

import Karamba
import Karamba.Utilities as k3d_util
import KarambaCommon

import Rhino.Geometry as rg
import Rhino.RhinoDoc as rd

logger = k3d_util.MessageLogger()
k3d_kit = KarambaCommon.Toolkit()

tol = rd.ActiveDoc.ModelAbsoluteTolerance

# Material
# Defaults for concrete
E = 35000000
G_ip = 12920000
G_op = 12920000
gamma = 25
alpha_t = 0.00001
f_y = 25000

k3d_mat = k3d_kit.Material.IsotropicMaterial('CONC',
    'CONC', E, G_ip, G_op, gamma, f_y, alpha_t)

# Cross section
k3d_sec = k3d_kit.CroSec.ShellConst(thickness, 0.0, k3d_mat,
    'shellSect', 'shellSect', 'UK')

# Create shell elements
k3d_mesh = Karamba.GHopper.Geometry.MeshExtensions.Convert(mesh)
k3d_nodes = clr.StrongBox[List[Karamba.Geometry.Point3]]()
k3d_shell = k3d_kit.Part.MeshToShell(
    List[Karamba.Geometry.Mesh3]([k3d_mesh]),
    List[str](['shell']),
    List[Karamba.CrossSections.CroSec]([k3d_sec]),
    logger,
    k3d_nodes)
k3d_nodes = k3d_nodes.Value

# Supports
support_points = []
for i in range(len(mesh.Vertices)):
    p = mesh.Vertices[i]
    for c in corners:
        test = c.ClosestPoint(p, tol)[0]
        if (test):
            support_points.append(p)
            break
k3d_supports = [k3d_kit.Support.Support(
    Karamba.GHopper.Geometry.GeometryExtensions.Convert(p),
    List[bool]([True, True, True, True, True, True])) for p in support_points]

# Load
k3d_load = Karamba.Loads.GravityLoad(Karamba.Geometry.Vector3(0, 0, -1))

# Assemble
out_info = clr.StrongBox[str]()
out_mass = clr.StrongBox[float]()
out_cog = clr.StrongBox[Karamba.Geometry.Point3]()
out_msg = clr.StrongBox[str]()
out_run_warn = clr.StrongBox[bool]()
k3d_model = k3d_kit.Model.AssembleModel(
    List[Karamba.Elements.BuilderElement](k3d_shell),
    List[Karamba.Supports.Support](k3d_supports),
    List[Karamba.Loads.Load]([k3d_load]),
    out_info, out_mass, out_cog, out_msg, out_run_warn)

## Analyse
#out_max_disp = clr.StrongBox[List[float]]()
#out_grav_force = clr.StrongBox[List[float]]()
#out_elastic_e = clr.StrongBox[List[float]]()
#out_warning = clr.StrongBox[str]()
#k3d_model = k3d_kit.Algorithms.AnalyzeThI(
#    k3d_model,
#    out_max_disp,
#    out_grav_force,
#    out_elastic_e,
#    out_warning)

a = Karamba.GHopper.Models.GH_Model(k3d_model)
# ---------- end python ----------
analyze = AnalyzeKaramba3D(Model=python.a)  # -> CalculatedModel, MaximumDisplacement_cm, ResultingForceOfGravity_kN, ElasticEnergy_kNm
shellview = ShellViewKaramba3D(Model=analyze.CalculatedModel, IndexOfLayer=0)  # -> Model, MeshesOfRenderedShells, LegendColors, LegendTags
