# Grasshopper definition analyseShell.gh (Grasshopper 1.0.7)
# plug-ins: MeshEdit Components, karambaGH

span = Slider(4, range=4..8)
image = ImageSampler(Filter="Colour", Interpolate=False, Umax=1, Umin=0, Vmax=1, Vmin=0, Wrap=1)
thickness_m = Slider(0.07, range=0.04..0.1)
load_pattern = Slider(2, range=1..7)
shell = Slider(2, range=1..2)

# ---- group: ACORN sampler
c_script = CSharpScript(slider=thickness_m)  # -> out, name, min, max
# ---------- c_script: C# ----------
    decimal _max, _min;
    System.Guid _name;


    IGH_Param tempPara = this.Component.Params.Input[0].Sources[0];
    //if (tempPara.GetType() == typeof(Grasshopper.Kernel.Special.GH_NumberSlider))
    //{
    Grasshopper.Kernel.Special.GH_NumberSlider NumSlider = tempPara as Grasshopper.Kernel.Special.GH_NumberSlider;
    _max = NumSlider.Slider.Maximum;
    _min = NumSlider.Slider.Minimum;
    _name = NumSlider.InstanceGuid;
    //}
    
    name = _name;
    min = _min;
    max = _max;
# ---------- end c_script ----------
c_script_2 = CSharpScript(slider=load_pattern)  # -> out, name, min, max
# ---------- c_script_2: C# ----------
    decimal _max, _min;
    System.Guid _name;


    IGH_Param tempPara = this.Component.Params.Input[0].Sources[0];
    //if (tempPara.GetType() == typeof(Grasshopper.Kernel.Special.GH_NumberSlider))
    //{
    Grasshopper.Kernel.Special.GH_NumberSlider NumSlider = tempPara as Grasshopper.Kernel.Special.GH_NumberSlider;
    _max = NumSlider.Slider.Maximum;
    _min = NumSlider.Slider.Minimum;
    _name = NumSlider.InstanceGuid;
    //}

    name = _name;
    min = _min;
    max = _max;
# ---------- end c_script_2 ----------
c_script_3 = CSharpScript(slider=shell)  # -> out, name, min, max; same code as c_script_2
dom = ConstructDomain(DomainStart=c_script.min, DomainEnd=c_script.max)
dom_2 = ConstructDomain(DomainStart=c_script_2.min, DomainEnd=c_script_2.max)
dom_3 = ConstructDomain(DomainStart=c_script_3.min, DomainEnd=c_script_3.max)
range = Range(Domain=dom, Steps=Slider(6, range=1..12))  # -> simplify(Range)
range_2 = Range(Domain=dom_2, Steps=Slider(6, range=1..10))  # -> simplify(Range)
range_3 = Range(Domain=dom_3, Steps=Slider(1, range=1..10))  # -> simplify(Range)
crossref = CrossReference(ListC=range_3, ListA=range_2, ListB=range, CrossMode=1)  # -> ListC, ListA, ListB
entwine = Entwine(Branch0X=crossref.ListC, Branch1X=crossref.ListA, Branch2X=crossref.ListB, FlattenInputs=False)  # -> simplify(Result)
flip = FlipMatrix(Data=entwine)
# difference from DSE:
# DSE subdivides slider domain into N subdomain and samples mid point;
# ACORN includes end points of sliders, subdivides into N-1 subdomains and samples all start points plus last endpoint
panel = Panel(flip)
design_map = Number(flip)

# ----
merge = Merge(Data1=shell, Data2=load_pattern, Data3=thickness_m)
shell_5x5 = Surface(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)
shell_4x4 = Surface(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)
shell_6x6 = Surface(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)
shell_7x7 = Surface(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)
shell_8x8 = Surface(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)
merge_2 = Merge(Data1=shell_4x4, Data2=shell_5x5, Data3=shell_6x6, Data4=shell_7x7, Data5=shell_8x8)
subtraction = Subtraction(B=4)
item = ListItem(List=merge_2, Index=subtraction, Wrap=True)
lor_7_8x7_2 = Surface(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)
_6x6 = Surface(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)

# ---- group: for generating catalog
number_slider = Slider(97, range=0..97)
branch = TreeBranch(Tree=design_map, Path=number_slider, MaintainPaths=True)

# ----
merge_3 = Merge(Data1=_6x6, Data2=lor_7_8x7_2)
current_solution = Integer(number_slider)
item_2 = ListItem(List=merge, Index=0, Wrap=True)  # -> Item, Item1, Item2
thickness_m_2 = Number(item_2.Item2)
load_pattern_2 = Integer(item_2.Item1)
shell_2 = Integer(item_2.Item)
subtraction_2 = Subtraction(A=shell_2, B=1)
item_3 = ListItem(List=merge_3, Index=subtraction_2, Wrap=True)
srf = Surface(item_3)
panel_2 = Panel(shell_2)
mesh_breps = MeshBrepsKaramba3D(
    Brep=srf,
    MeshResolution=Slider(0.1, range=0..1),
    EdgeRefinementFactor=Slider(0.2, range=0..1),
    PointReduction=False,
    SmoothingStepSize=Slider(1, range=0..1),
    SmoothingIterations=Slider(3, range=0..10))  # -> Mesh, Info
mesh = Mesh(mesh_breps.Mesh)

# ---- group: non horizontally planar support points
lot = Integer(Slider(2, range=0..10))
mesh_2 = Mesh(mesh)
srf_2 = Surface(srf)
edges = BrepEdges(Brep=srf_2)  # -> Naked, Interior, NonManifold
culln = CullNth(List=edges.Naked, CullFrequency=2)
neg = Negative(Value=lot)
demesh = DeconstructMesh(Mesh=mesh_2)  # -> Vertices, Faces, Colours, Normals
corners = Curve(culln)
pull = PullPoint(Point=demesh.Vertices, Geometry=corners, ClosestOnly=True)  # -> ClosestPoint, Distance
_10º = PowerOf10(Value=neg)
smaller = SmallerThan(FirstNumber=pull.Distance, SecondNumber=_10º)  # -> SmallerThan, OrEqualTo
dispatch = Dispatch(List=pull.ClosestPoint, DispatchPattern=smaller.SmallerThan)  # -> ListA, ListB
pt = Point(dispatch.ListA)

# ----
dead_load_kn_m2 = Slider(1, range=0..10)
safety_factor = Slider(1.35, range=0..10)
live_load_kn_m2 = Slider(1.5, range=0..10)
safety_factor_2 = Slider(1.5, range=0..10)
mesh_3 = Mesh(mesh)
bbox = BoundingBox(Content=mesh_3, Plane=PlaneXY(0, 0, 0), UnionBox=True)  # -> Box, Box_2
multiplication = Multiplication(A=safety_factor, B=dead_load_kn_m2)
multiplication_2 = Multiplication(A=safety_factor_2, B=live_load_kn_m2)
bottompoints = BottomPoints(mesh=mesh, ltol=Slider(1, range=0..10))
box = EvaluateBox(Box=bbox.Box, UParameter=0.5, VParameter=0.5, WParameter="1")  # -> Plane, Point, Include
demesh_2 = DeconstructMesh(Mesh=mesh_3)  # -> Vertices, Faces, Colours, Normals
Z = UnitZ(Factor=safety_factor)
thickness_m_3 = Number(thickness_m_2)
Z_2 = UnitZ(Factor=multiplication)
rev = Reverse(Vector=Z)
cp = ClosestPoint(Point=box.Point, Cloud=demesh_2.Vertices)  # -> ClosestPoint, CPIndex, Distance
load_pattern_3 = Integer(load_pattern_2)
rev_2 = Reverse(Vector=Z_2)
mesh_4 = Mesh(mesh)
multiplication_3 = Multiplication(A=thickness_m_3, B=100)
supp = SupportKaramba3D(PosInd=cp.ClosestPoint, menu=[buttons(off, off, off, off, off, on)])
asymmetrical_load_patterns = AsymmetricalLoadPatterns(mesh=mesh_4, int=load_pattern_3, load_kn_m2=multiplication_2)
supp_2 = SupportKaramba3D(PosInd=flatten(pt), menu=[buttons(on, on, on, off, off, off)])
cross_section = CrossSectionKaramba3D(
    FamilyNameOfCrossSection="DefaultCroSec",
    Material=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,
    Height_cm=multiplication_3,
    mode="Shell - Const")
loads = LoadsKaramba3D(Vector=rev_2, Mesh=mesh, mode="MeshLoad -Const.", menu=[buttons(off, off, on), buttons(on, on)])
loads_2 = LoadsKaramba3D(Vector=rev, mode="Gravity")
matselect = MaterialSelectionKaramba3D(menu=[dropdown(3), dropdown(9)])
merge_4 = Merge(Data1=loads_2, Data2=loads, Data3=asymmetrical_load_patterns)  # -> flatten(Result)
meshtoshell = MeshToShellKaramba3D(Mesh=mesh, CrossSection=cross_section, LimitDistance_m=0.005)  # -> Element, Points, Info
merge_5 = Merge(Data1=supp_2, Data2=supp)  # -> flatten(Result)
assemble = AssembleModelKaramba3D(Elem=meshtoshell.Element, Support=merge_5, Load=merge_4, Material=matselect, LimitDistance_m=0.005)  # -> Model, Info, Mass_kg, CenterOfGravity
number_slider_2 = Slider(6, range=0..10)
analyzethii = AnalyzeThIIKaramba3D(Model=assemble.Model, LoadCase="-1", RTolerance=1e-07, MaxIterations=50, NoTensionalNII=False)  # -> CalculatedModel, MaximumDisplacement_cm, ResultingForceOfGravity_kN, ElasticEnergy_kNm
multiplication_4 = Multiplication(A=Slider(7.2, range=0..10), B=Slider(7.8, range=0..10))
division = Division(A=assemble.Mass_kg, B=multiplication_4)
panel_3 = Panel(division)
analyze = AnalyzeKaramba3D(Model=assemble.Model)  # -> CalculatedModel, MaximumDisplacement_cm, ResultingForceOfGravity_kN, ElasticEnergy_kNm
bmodes = BucklingModesKaramba3D(Model=analyzethii.CalculatedModel, FromIndex=1, NumberOfModes=1, MaximumNumberOfIterations=300, Epsilon=1e-07)  # -> ModelWithBucklingModesAsLoadCaseResults, BucklingLoadFactors
modelview = ModelViewKaramba3D(Model=analyze.CalculatedModel, ResultFactors=1, ResultCase=-1)  # -> Model, DeformedMesh, DeformedAxes, DeformedModel
modelview_2 = ModelViewKaramba3D(Model=bmodes.ModelWithBucklingModesAsLoadCaseResults, ResultFactors=1, ResultCase=-1)  # -> Model, DeformedMesh, DeformedAxes, DeformedModel
shellview = ShellViewKaramba3D(Model=modelview.Model, IndexOfLayer=0)  # -> Model, MeshesOfRenderedShells, LegendColors, LegendTags
medges = MeshEdges(Mesh=shellview.MeshesOfRenderedShells)  # -> NakedEdges, InteriorEdges, NonManifoldEdges
model = ModelKaramba3D(modelview.Model)
shellview_2 = ShellViewKaramba3D(Model=modelview_2.Model, IndexOfLayer=0)  # -> Model, MeshesOfRenderedShells, LegendColors, LegendTags
crv = Curve(medges.NakedEdges)
number_slider_3 = Slider(1, range=-1..1)  # disabled
percentile_stress = PercentileStress(model=modelview.Model, percentile=Slider(99, range=90..100))  # -> max_comp_stress_kn_cm2_2, max_tens_stress_kn_cm2_2
legend = Legend(Colour=shellview.LegendColors, Tags=shellview.LegendTags, LegendType=1)
medges_2 = MeshEdges(Mesh=shellview_2.MeshesOfRenderedShells)  # -> NakedEdges, InteriorEdges, NonManifoldEdges
legend_2 = Legend(Colour=shellview_2.LegendColors, Tags=shellview_2.LegendTags, LegendType=1)
model_2 = ModelKaramba3D(model)  # disabled
crv_2 = Curve(medges_2.NakedEdges)
disassemble = DisassembleMaterialKaramba3D(Material=matselect)  # -> Material, TypeOfMaterial, FamilyNameOfMaterial, NameOfMaterial, ElemIdentifiers, Color, YoungsModulusKNCm2Dir12, InPlaneShearModulus_kN_cm2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
item_4 = ListItem(List=reverse(shellview.LegendTags), Index="1", Wrap=True)
item_5 = ListItem(List=shellview.LegendTags, Index="1", Wrap=True)
shellvecresults = ResultVectorsOnShellsKaramba3D(AnalyzedModel=model_2, LayerPosition=number_slider_3, mode="PrincStress")  # -> AnalyzedModel, Points, FirstPrincipalStressVector_kN_cm2, SecondPrincipalStressVector_kN_cm2, FirstPrincipalStressValue_kN_cm2, SecondPrincipalStressValue_kN_cm2; disabled
utilization = UtilizationOfElementsKaramba3D(AnalyzedModel=model_2, LoadCase="-1", mode="Shells")  # -> AnalyzedModel, Utilization; disabled
max_comp_stress_95_kn_cm2 = Number(percentile_stress.max_comp_stress_kn_cm2_2)
compressive_strength_kn_cm2 = Number(disassemble.CompressiveStrengthKNCm2Dir12)
max_tens_stress_95_kn_cm2 = Number(percentile_stress.max_tens_stress_kn_cm2_2)
max_comp_stress_kn_cm2 = Number(item_5)
max_tens_stress_kn_cm2 = Number(item_4)
# Compressive strength : 20 - 40 MPa
# Tensile strength - σ : 2 - 5 MPa
# Modulus of elasticity - E : 14 - 41 GPa
# 
# (https://www.engineeringtoolbox.com/concrete-properties-d_1223.html)
young_s_moduli_elasticity_kn_cm2 = Number(disassemble.YoungsModulusKNCm2Dir12)
bnd = Bounds(Numbers=shellvecresults.FirstPrincipalStressValue_kN_cm2)  # disabled
bnd_2 = Bounds(Numbers=utilization.Utilization)  # disabled
number_slider_4 = Slider(21, range=0..100)  # disabled
number_slider_5 = Slider(21, range=0..100)  # disabled
panel_4 = Panel(max_comp_stress_kn_cm2)
panel_5 = Panel(max_tens_stress_kn_cm2)
panel_6 = Panel(compressive_strength_kn_cm2)
range_4 = Range(Domain=bnd, Steps=number_slider_4)  # disabled
multiplication_5 = Multiplication(A=young_s_moduli_elasticity_kn_cm2, B="0.01")
panel_7 = Panel(young_s_moduli_elasticity_kn_cm2)
range_5 = Range(Domain=bnd_2, Steps=number_slider_5)  # disabled
buckling_safety_factors = Number(bmodes.BucklingLoadFactors)
elasticity_gpa = Number(multiplication_5)
panel_8 = Panel(bnd)  # disabled
panel_9 = Panel(elasticity_gpa)
multiplication_6 = Multiplication(A=compressive_strength_kn_cm2, B="10")
multiplication_7 = Multiplication(A=max_comp_stress_kn_cm2, B="10")
multiplication_8 = Multiplication(A=max_tens_stress_kn_cm2, B="10")
shelllineresults = LineResultsOnShellsKaramba3D(
    AnalyzedModel=model_2,
    LayerPosition=0,
    ListOfIsoValuesValsOrSourcesOfForceFlowLinesLinesPoints=range_5,
    SegmentLength_m=0,
    Smoothing=False,
    mode="IsoLines",
    menu=[buttons(off, off, on, off, off, off, off)])  # -> AnalyzedModel, Lines, Value; disabled
shelllineresults_2 = LineResultsOnShellsKaramba3D(
    AnalyzedModel=model_2,
    LayerPosition=number_slider_3,
    ListOfIsoValuesValsOrSourcesOfForceFlowLinesLinesPoints=range_4,
    SegmentLength_m=0,
    Smoothing=False,
    mode="IsoLines",
    menu=[buttons(on, off, off, off, off, off, off)])  # -> AnalyzedModel, Lines, Value; disabled
compressive_strength_mpa = Number(multiplication_6)
max_comp_stress_mpa = Number(multiplication_7)
max_tens_stress_mpa = Number(multiplication_8)
crv_3 = Curve(simplify(shelllineresults_2.Lines))  # disabled
crv_4 = Curve(simplify(shelllineresults.Lines))  # disabled
panel_10 = Panel(max_comp_stress_mpa)
panel_11 = Panel(compressive_strength_mpa)
panel_12 = Panel(max_tens_stress_mpa)
compressive_strength_kn_cm2_2 = Number(compressive_strength_kn_cm2)  # disabled
model_3 = ModelKaramba3D(model)  # disabled
merge_6 = Merge(
    Data1=flatten(max_comp_stress_kn_cm2),
    Data2=flatten(max_comp_stress_95_kn_cm2),
    Data3=flatten(max_tens_stress_95_kn_cm2),
    Data4=flatten(max_tens_stress_kn_cm2),
    Data5=flatten(buckling_safety_factors),
    Data6=flatten(analyzethii.MaximumDisplacement_cm))  # -> simplify(Result)
current_solution_2 = Integer(current_solution)
results = Number(merge_6)
flatten = FlattenTree(Tree=results, Path=current_solution_2)
rec = DataRecorder(flatten, DataLimit=-10, RecordData=True)
data_1res_dl2_ll1_5 = Data(Tree({0}: [-0.547, 10.44832567, 0.299, 0.09415340161], {1}: [-1.06, 4.089947379, 0.68, 0.2493632788], {2}: [-1.06, 7.939231621, 1.24, 0.3842129882], {3}: [-2.4, 3.159595325, 3.07, 1.337569032], {4}: [-0.851, 7.896964322, 0.494, 0.1545590825], {5}: [-1.8, 3.095861695, 1.47, 0.5261917897]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))
data_1res_dl2_ll3 = Data(Tree({0}: [-0.547, 10.44832567, 0.299, 0.09415340161], {1}: [-1.06, 4.089947379, 0.68, 0.2493632788], {2}: [-1.71, 6.210868248, 2.52, 0.7557314152], {3}: [-3.95, 2.509602459, 5.95, 2.803424958], {4}: [-1.31, 6.15505123, 0.933, 0.2481742511], {5}: [-2.7, 2.410575653, 2.59, 1.012118675]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))
data_1res_dl1_ll1_5_99 = Data(Tree({0}: [-0.371, -0.03741059832, 0.0250998994, 0.205, 15.62309875, 0.06205409255], {1}: [-0.712, -0.05740965605, 0.04156523063, 0.461, 6.125786307, 0.1634439236], {2}: [-0.912, -0.08464881185, 0.2930554782, 1.26, 10.4634501, 0.3660970918], {3}: [-2.12, -0.1155539763, 0.4853574482, 3.01, 4.223264786, 1.218560048], {4}: [-0.74, -0.07118329186, 0.05559320694, 0.481, 10.38619177, 0.1306089132], {5}: [-1.52, -0.1107373433, 0.1007741425, 1.36, 4.085739827, 0.4609670322]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))
data_1res_dl1_ll1_5_95 = Data(Tree({0}: [-0.371, -0.03208545103, 0.01540599759, 0.205, 15.62309875, 0.06205409255], {1}: [-0.712, -0.04740155788, 0.0262786731, 0.461, 6.125786307, 0.1634439236], {2}: [-0.912, -0.04571376245, 0.1405338463, 1.26, 10.4634501, 0.3660970918], {3}: [-2.12, -0.06434684763, 0.2582252028, 3.01, 4.223264786, 1.218560048], {4}: [-0.74, -0.04684391764, 0.03393157289, 0.481, 10.38619177, 0.1306089132], {5}: [-1.52, -0.07218367909, 0.06187667125, 1.36, 4.085739827, 0.4609670322]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))
design_map_2 = Number(design_map)
number_slider_6 = Slider(10, range=0..10)  # disabled
panel_13 = Panel(buckling_safety_factors)
panel_14 = Panel(data_1res_dl1_ll1_5_99)
Y = UnitY(Factor=number_slider_6)  # disabled
model_4 = ModelKaramba3D(modelview.Model)
panel_15 = Panel(data_1res_dl2_ll1_5)
shellview_3 = ShellViewKaramba3D(Model=model_4, IndexOfLayer=0)  # -> Model, MeshesOfRenderedShells, LegendColors, LegendTags
shellview_4 = ShellViewKaramba3D(Model=model_4, IndexOfLayer=0)  # -> Model, MeshesOfRenderedShells, LegendColors, LegendTags
range_6 = Range(Domain="-1 To 1", Steps=Slider(3, range=1..11))  # -> simplify(graft(Range))
layers = Number(range_6)
shellview_5 = ShellViewKaramba3D(Model=model_4, IndexOfLayer=0)  # -> Model, MeshesOfRenderedShells, LegendColors, LegendTags
shellvecresults_2 = ResultVectorsOnShellsKaramba3D(AnalyzedModel=model_4, LayerPosition=layers, mode="PrincStress")  # -> simplify(AnalyzedModel), Points, FirstPrincipalStressVector_kN_cm2, SecondPrincipalStressVector_kN_cm2, FirstPrincipalStressValue_kN_cm2, SecondPrincipalStressValue_kN_cm2
multiplication_9 = Multiplication(A=Slider(5, range=0..10), B=range_6)
merge_7 = Merge(
    Data1=shellview_5.MeshesOfRenderedShells,
    Data2=shellview_4.MeshesOfRenderedShells,
    Data3=shellview_3.MeshesOfRenderedShells)  # -> simplify(graft(Result))
Z_3 = UnitZ(Factor=multiplication_9)
range_7 = Range(Domain=Domain(0, 1), Steps=Slider(6, range=0..10))
bbox_2 = BoundingBox(Content=merge_7, Plane=PlaneXY(0, 0, 0))  # -> Box, Box_2
bnd_3 = Bounds(Numbers=shellvecresults_2.SecondPrincipalStressValue_kN_cm2)
crossref_2 = CrossReference(ListA=range_7, ListB=range_7, CrossMode=1)  # -> ListA, ListB
range_8 = Range(Domain=bnd_3, Steps=Slider(50, range=0..100))
box_2 = EvaluateBox(Box=simplify(bbox_2.Box), UParameter=crossref_2.ListA, VParameter=crossref_2.ListB, WParameter=0.5)  # -> Plane, simplify(Point), Include
shelllineresults_3 = LineResultsOnShellsKaramba3D(
    AnalyzedModel=shellvecresults_2.AnalyzedModel,
    LayerPosition=layers,
    ListOfIsoValuesValsOrSourcesOfForceFlowLinesLinesPoints=range_8,
    SegmentLength_m=0,
    Smoothing=False,
    mode="IsoLines",
    menu=[buttons(off, on, off, off, off, off, off)])  # -> AnalyzedModel, simplify(Lines), Value; disabled
shelllineresults_4 = LineResultsOnShellsKaramba3D(
    AnalyzedModel=model_4,
    LayerPosition=range_6,
    ListOfSourcesOfPrincipalStressLinesLinesPoints=box_2.Point,
    SegmentLength_m=0.5,
    DA_deg=5,
    mode="PrincStress")  # -> AnalyzedModel, Lines1, Lines2
shell_3 = Slider(2, range=1..2)
thickness_m_4 = Slider(0.07, range=0.04..0.1)
load_pattern_4 = Slider(2, range=1..7)
crv_5 = Curve(shelllineresults_4.Lines2)
data = Data(Tree({0;0;0}: [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], {0;0;1}: [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], {0;1;0}: [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], {0;1;1}: [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], {0;1;2}: [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], {0;1;3}: [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]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))
medges_3 = MeshEdges(Mesh=merge_7)  # -> NakedEdges, InteriorEdges, NonManifoldEdges
trim = TrimTree(Tree=crv_5, Depth="2")
trim_2 = TrimTree(Tree=data, Depth="2")
crv_6 = Curve(simplify(medges_3.NakedEdges))
vec = Vector(Z_3)
merge_8 = Merge(Data1=shell_3, Data2=load_pattern_4, Data3=thickness_m_4)
params = Number(simplify(graft(merge_8)))
move = Move(Geometry=trim_2, Motion=vec)  # -> simplify(Geometry), Transform
move_2 = Move(Geometry=trim, Motion=vec)  # -> simplify(Geometry), Transform
move_3 = Move(Geometry=merge_7, Motion=vec)  # -> simplify(Geometry), Transform
move_4 = Move(Geometry=crv_6, Motion=vec)  # -> simplify(Geometry), Transform
panel_16 = Panel(params)
ds_coords = Data(design_map_2)
list = ValueList({"maximum compression stress [kN/cm2]": 0, "top 99% compression stress [kN/cm2]": 1, "top 99% tension stress [kN/cm2]": 2, "maximum tension stress [kN/cm2]": 3, "buckling safety factors": 4, "maximum deflection 2nd order [cm]": 5}, selected="maximum compression stress [kN/cm2]")
preview = CustomPreview(Geometry=move_2.Geometry, Material=ColourSwatch(SwatchColor=RGB(212, 212, 212)))
preview_2 = CustomPreview(Geometry=move_4.Geometry, Material=ColourSwatch(SwatchColor=RGB(0, 0, 0)))
preview_3 = CustomPreview(Geometry=move.Geometry, Material=ColourSwatch(SwatchColor=RGB(135, 135, 135)))
panel_17 = Panel("""maximum compression stress [kN/cm2]
top 99% compression stress [kN/cm2]
top 99% tension stress [kN/cm2]
maximum tension stress [kN/cm2]
buckling safety factors
maximum deflection 2nd order [cm] """)
dimensions = Panel("""shell #
loading pattern
thickness [m]""")
list_2 = ValueList({"shell #": 0, "loading pattern": 1, "thickness [m]": 2}, selected="thickness [m]")
closest_solution = ClosestSolution(params_current_solution=params, ds_coords=ds_coords)  # -> index_curr_vector_2, design_vector_2
item_6 = ListItem(List=dimensions, Index=list_2, Wrap=True)
item_7 = ListItem(List=panel_17, Index=list, Wrap=True)
results_2 = Data(data_1res_dl1_ll1_5_99)
abs = Absolute(Value=results_2)
results_3 = Number(abs)
digit_scroller = DigitScroller(Scroller_Digits=12, Scroller_Prefix="Panel", Scroller_Radix=10, Scroller_Value=2)
# digit scroller
# slider
number_slider_7 = Slider(0.25, range=0..1)
section_ds = SectionDS(design_vector=closest_solution.design_vector_2, design_space=ds_coords, dims=list_2)
panel_18 = Panel(digit_scroller)
tstat = TreeStatistics(Tree=section_ds)  # -> Paths, Length, Count
branch_2 = TreeBranch(Tree=results_3, Path=tstat.Paths, MaintainPaths=True)
panel_19 = Panel(section_ds)
transform_points_to_landscape = TransformPointsToLandscape(
    dim_labels=dimensions,
    dimensons_for_variation=list_2,
    sectioned_data=section_ds,
    results=results_3,
    result_label=item_7,
    result_int=list)  # -> fixed_2, labels_2, transformed_points_2
panel_20 = Panel(branch_2)
int_curr_solution = Integer(closest_solution.index_curr_vector_2)
number_slider_8 = Slider(10, range=0..100)
_2d_graph = _2DGraph(
    labels=transform_points_to_landscape.labels_2,
    fixed=transform_points_to_landscape.fixed_2,
    ref_value=Slider(2, range=0..100),
    original_points=transform_points_to_landscape.transformed_points_2,
    z_steps=Slider(6, range=0..20))  # -> mesh_2, transformed_points_2
pt_2 = Point(transform_points_to_landscape.transformed_points_2)
pt_3 = Point(_2d_graph.transformed_points_2)
min_point = MinPoint(transformed_points=_2d_graph.transformed_points_2)  # -> min_point_2, min_id_2
curr_point = CurrPoint(transformed_points=_2d_graph.transformed_points_2, int_curr_solution=int_curr_solution)
panel_21 = Panel("C:\Users\ec977\Documents\_Rhino Frames\20200602-SIMPLEcull20\Frame_00")
vector_value = VectorValue(curr_point=curr_point, original_points=pt_2, int_curr_solution=int_curr_solution)
curr_thumbnail = CurrThumbnail(folder_file=panel_21, curr_point=curr_point, int_curr_solution=int_curr_solution)
min_value = MinValue(curr_point=min_point.min_point_2, original_points=pt_2, int_curr_solution=min_point.min_id_2)

# ---- group: custom visulizations
number_slider_9 = Slider(1, range=1..10)  # disabled
number_slider_10 = Slider(1, range=-1..1)  # disabled
panel_22 = Panel("-1 to 1")  # disabled
range_9 = Range(Domain=panel_22, Steps=number_slider_9)  # disabled
layerpos = Number(simplify(graft(range_9)))  # disabled
model_5 = ModelKaramba3D(model_3)  # disabled
number_slider_11 = Slider(1, range=0..10)  # disabled
model_6 = ModelKaramba3D(model_5)  # disabled
model_7 = ModelKaramba3D(model_5)  # disabled
split_top_bottom = SplitTopBottom(model=model_6, layerpos=layerpos, thickness_amplifying_factor=number_slider_11)  # -> original_mesh_2, transformed_mesh_2, transform_2, border_mesh_2; disabled
shellvecresults_3 = ResultVectorsOnShellsKaramba3D(AnalyzedModel=model_7, LayerPosition=layerpos, mode="PrincStress")  # -> AnalyzedModel, Points, FirstPrincipalStressVector_kN_cm2, SecondPrincipalStressVector_kN_cm2, FirstPrincipalStressValue_kN_cm2, SecondPrincipalStressValue_kN_cm2; disabled
swatch = ColourSwatch(SwatchColor=RGB(0, 0, 0))  # disabled
mesh_5 = Mesh(split_top_bottom.border_mesh_2)  # disabled
num = Number(simplify(shellvecresults_3.FirstPrincipalStressValue_kN_cm2))  # disabled
mcol = MeshColours(Mesh=mesh_5, Colours=swatch)  # disabled
swatch_2 = ColourSwatch(SwatchColor=RGB(255, 0, 0))  # disabled
swatch_3 = ColourSwatch(SwatchColor=RGB(0, 8, 255))  # disabled

# ----
panel_23 = Panel(shellvecresults_3.FirstPrincipalStressValue_kN_cm2)  # disabled
move_5 = Move(Geometry=split_top_bottom.transformed_mesh_2, Motion=Y)  # -> Geometry, Transform; disabled

# ---- group: custom visulizations (continued)
mesh_6 = Mesh(move_5.Geometry)  # disabled
val_elems2nodes = ValElems2nodes(num=num, mesh=mesh_6)  # disabled
expression = Expression(x=val_elems2nodes, Expression="If(x>0,0,x)")  # disabled
expression_2 = Expression(x=val_elems2nodes, Expression="If(x<0,0,x)")  # disabled
only_compression_per_node = Number(expression)  # disabled
only_tension_per_node = Number(expression_2)  # disabled
gradient = Gradient(col=swatch_2, num=only_compression_per_node)  # disabled
gradient_2 = Gradient(col=swatch_3, num=only_tension_per_node)  # disabled
multiplication_10 = Multiplication(A=gradient_2, B=gradient)  # disabled
mcol_2 = MeshColours(Mesh=mesh_6, Colours=multiplication_10)  # disabled

# ----
explode = MeshExplode(Mesh=mesh_6, Interpolate=False)  # -> simplify(Faces); disabled
smaller_2 = SmallerThan(FirstNumber=num, SecondNumber=compressive_strength_kn_cm2_2)  # -> simplify(SmallerThan), OrEqualTo; disabled
dispatch_2 = Dispatch(List=explode, DispatchPattern=smaller_2.SmallerThan)  # -> ListA, ListB; disabled
mesh_7 = Mesh(dispatch_2.ListA)  # disabled

# ==== cluster BottomPoints
ltol = ClusterInput()
mesh = ClusterInput()
mesh_2 = Mesh(mesh)
ltol_2 = Integer(ltol)
demesh = DeconstructMesh(Mesh=mesh_2)  # -> Vertices, Faces, Colours, Normals
pt = Point(demesh.Vertices)
bbox = BoundingBox(Content=pt, Plane=PlaneXY(0, 0, 0), UnionBox=True)  # -> Box, Box_2
box = EvaluateBox(Box=bbox.Box, UParameter="0", VParameter="0", WParameter="0")  # -> Plane, Point, Include
neg = Negative(Value=ltol_2)
_10º = PowerOf10(Value=neg)
cp = PlaneClosestPoint(Point=pt, Plane=box.Plane)  # -> Point, UVPoint, Distance
panel = Panel("1e-10")
smaller = SmallerThan(FirstNumber=cp.Distance, SecondNumber=_10º)  # -> SmallerThan, OrEqualTo
boxdims = BoxDims(box=bbox.Box)  # -> dx_2, dy_2, dz_2
dispatch = Dispatch(List=pt, DispatchPattern=smaller.SmallerThan)  # -> ListA, ListB
duppt = RemoveDuplicatePts(Points=dispatch.ListA, Tolerance=0.01)  # -> simplify(UniquePoints)
division = Division(A=boxdims.dx_2, B="2")
pgroups = PointGroups(Points=duppt, Distance=division)  # -> simplify(Groups), Indices
pt_2 = Point(pgroups.Groups)
pt_3 = ClusterOutput(pt_2)

# ==== cluster SplitTopBottom
model = ClusterInput()
disassemble = DisassembleModelKaramba3D(Model=model)  # -> Model, Point, Beam, Shell, Support, Load, Line, Mesh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
thickness_amplifying_factor = ClusterInput()
layerpos = ClusterInput()
disassemble_2 = DisassembleElementKaramba3D(Element=disassemble.Shell)  # -> Element, ElementIdentifier, AxisOfElement, CrossSection, Joints, Material, LocalCoordinateSystem, ElementIsActive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
disassemble_3 = DisassembleCrossSectionKaramba3D(CroSec=disassemble_2.CrossSection)  # -> CrossSection, FamilyNameOfCrossSection, TypeNameOfCrossSection, ElemIdentifiers, Color, Material, LocalEccentricity_cm, Heights_cm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
thickness_cm = Number(disassemble_3.Heights_cm)
number_slider = Slider(10, range=0..10)
division = Division(A=thickness_cm, B=200)
thickness_amplifying_factor_2 = Number(thickness_amplifying_factor)
multiplication = Multiplication(A=thickness_amplifying_factor_2, B=division)
layerpos_2 = Number(layerpos)
multiplication_2 = Multiplication(A=multiplication, B=layerpos_2)
Z = UnitZ(Factor=multiplication_2)
original_mesh = Mesh(disassemble.Mesh)
panel = Panel("""0
-1""")
move = Move(Geometry=original_mesh, Motion=Z)  # -> Geometry, Transform
item = ListItem(List=flatten(move.Geometry), Index=panel, Wrap=True)
transformed_mesh = Mesh(simplify(move.Geometry))
transform = Transform(simplify(move.Transform))
medges = MeshEdges(Mesh=item)  # -> simplify(NakedEdges), InteriorEdges, NonManifoldEdges
original_mesh_2 = ClusterOutput(original_mesh)
transformed_mesh_2 = ClusterOutput(transformed_mesh)
transform_2 = ClusterOutput(transform)
crv = Curve(medges.NakedEdges)
join = JoinCurves(Curves=crv, Preserve=False)  # -> flatten(Curves)
loft = Loft(Curves=join, Options={Adjust=False, Closed=False, LoftEnds=0, LoftSimp=0, LoftType=0, Rebuild=10, Refit=0.01})
border_mesh = Mesh(loft)
border_mesh_2 = ClusterOutput(border_mesh)

# ==== cluster Gradient
num = ClusterInput()
num_2 = Number(num)
abs = Absolute(Value=num_2)
# Either 0 (MIN IS BLACK)
# or 0.5 (MIN IS RED)
panel = Panel("0")
bnd = Bounds(Numbers=flatten(abs))
dom = ConstructDomain(DomainStart=panel, DomainEnd=Slider(0.5, range=0..1))
col = ClusterInput()
remap = RemapNumbers(Value=abs, Source=bnd, Target=dom)  # -> Mapped, Clipped

# ---- group: prevents remapping to target mid-domain
ma = MassAddition(Input=abs)  # -> Result, PartialResults
expression = Expression(x=remap.Mapped, m=ma.Result, Expression="If(m=0,0,x)")

# ----
col_2 = Colour(col)
ahsl = SplitAHSL(Colour=col_2)  # -> Alpha, Hue, Saturation, Luminance
subtraction = Subtraction(A="1", B=expression)
hsl = ColourHSL(Alpha=ahsl.Alpha, Hue=ahsl.Hue, Saturation=ahsl.Saturation, Luminance=subtraction)
col_3 = Colour(hsl)
col_4 = ClusterOutput(col_3)

# ==== cluster ValElems2nodes
mesh = ClusterInput()
num = ClusterInput()
mesh_2 = Mesh(mesh)
m_valence = Valence(M=mesh_2, O=Slider(1, range=0..1))  # -> out, G, A, simplify(T), P
# ---------- m_valence: VB ----------
    Component.Params.Input(0).Name = "Mesh"
    Component.Params.Input(0).Description = "Open or closed mesh"
    Component.Params.Input(1).Name = "Mode"
    Component.Params.Input(1).Description = "Designates if vertex or face connectivity is checked (0 = Vertices, 1 = Faces)"
    Component.Params.Input(2).Name = "Connected Domain"
    Component.Params.Input(2).Description = "The domain that describes the range of connected vertices to be tested against"

    Component.Params.Output(1).Name = "Preview Mesh"
    Component.Params.Output(1).Description = "A greyscale preview mesh reflecting the range of values"
    Component.Params.Output(2).Name = "Connections"
    Component.Params.Output(2).Description = "The number of connections as specified by the Mode input"
    Component.Params.Output(3).Name = "Topology"
    Component.Params.Output(3).Description = "The list of index values connected to the sample point"
    Component.Params.Output(4).Name = "Pattern"
    Component.Params.Output(4).Description = "If the R input is used, the status of each sample point relative to the provided range (0 = Below, 1 = Within, 2 = Above)"

    If M IsNot Nothing Then
      Dim i,j,k As Integer

      Dim iP As Grasshopper.Kernel.IGH_Param = Component.Params.Input(0)
      Dim cP As Grasshopper.Kernel.Data.IGH_Structure = iP.VolatileData

      Dim mf As Rhino.Geometry.Collections.MeshFaceList = Nothing
      Dim mv As Rhino.Geometry.Collections.MeshVertexList = Nothing
      Dim mtv As Rhino.Geometry.Collections.MeshTopologyVertexList = Nothing
      Dim mte As Rhino.Geometry.Collections.MeshTopologyEdgeList = Nothing
      Dim mn As Rhino.Geometry.Collections.MeshVertexNormalList = Nothing
      Dim mc As Rhino.Geometry.Collections.MeshVertexColorList = Nothing

      mf = m.Faces
      mv = m.Vertices
      mtv = m.TopologyVertices
      mte = m.TopologyEdges
      mn = m.Normals
      mc = m.VertexColors

      Dim avgV As New list(Of Integer)
      Dim arrTop As New datatree(Of Double)
      Dim oc As New list(Of color)
      Dim tv,tmin,tmax As Integer
      Dim arrPat As New list(Of Integer)

      For i = 0 To mv.count() - 1 Step 1
        Dim tcv() As Integer

        If O = 1 Then
          tcv = mv.GetVertexFaces(i)
          For j = 0 To ubound(tcv) Step 1
            arrTop.add(tcv(j), cp.Path(Component.RunCount - 1).AppendElement(i))
          Next
          k = ubound(tcv) + 1
        Else
          tcv = mv.GetConnectedVertices(i)
          For j = 0 To ubound(tcv) Step 1
            If mv.item(i).distanceto(mv.item(tcv(j))) <> 0 Then
              arrTop.add(tcv(j), cp.Path(Component.RunCount - 1).AppendElement(i))
            End If
          Next
          k = ubound(tcv) + 1
        End If

        If i = 0 Then Tmin = k Else If k < Tmin Then Tmin = k
        If k > Tmax Then Tmax = k
        avgV.add(k)
      Next

      For i = 0 To mv.count() - 1 Step 1
        If C = Nothing Then
          C.t0 = Tmin
          C.t1 = Tmax
        End If

        If avgV.item(i) < C.T0 Then
          oc.add(color.FromArgb(0, 0, 255))
          arrPat.add(0)
        ElseIf ((avgV.item(i) > C.T1) Or ((C.t0 = 0) And (C.t1 = 0))) Then
          oc.add(color.FromArgb(255, 0, 0))
          arrPat.add(2)
        Else
          tv = math.Floor((avgV.item(i) - C.T0) / (C.t1 - C.t0) * 255)
          oc.add(color.FromArgb(tv, tv, tv))
          arrPat.add(1)
        End If
      Next

      Dim mo As New mesh
      mo.vertices.AddVertices(mv)
      mo.Faces.AddFaces(mf)
      mo.VertexColors.AppendColors(oc.toarray())

      G = mo
      A = avgV
      P = arrPat
      T = arrTop
    End If
# ---------- end m_valence ----------
num_2 = Number(num)
lng = ListLength(List=m_valence.T)
trim = TrimTree(Tree=m_valence.T, Depth=1)
trim_2 = TrimTree(Tree=lng, Depth=1)
item = ListItem(List=num_2, Index=trim, Wrap=True)
partition = PartitionList(List=item, Size=trim_2)
panel = Panel(partition)
avr = Average(Input=partition)
trim_3 = TrimTree(Tree=avr, Depth=1)
flatten = FlattenTree(Tree=avr, Path="{0}")
num_3 = Number(trim_3)
num_4 = ClusterOutput(num_3)

# ==== cluster AsymmetricalLoadPatterns
mesh = ClusterInput()
load_kn_m2 = ClusterInput()
int = ClusterInput()
mjoin = MeshJoin(Meshes=mesh)
mesh_2 = Mesh(simplify(graft(mesh)))
load_kn_m2_2 = Number(load_kn_m2)
int_2 = Integer(int)
bbox = BoundingBox(Content=flatten(mesh_2), Plane=PlaneXY(0, 0, 0), UnionBox=True)  # -> Box, Box_2
image = ImageSampler(Filter="Colour", Interpolate=False, Umax=1, Umin=0, Vmax=1, Vmin=0, Wrap=1)
faceb = FaceBoundaries(Mesh=mesh_2)  # -> simplify(Boundaries)
box = EvaluateBox(Box=bbox.Box, UParameter=0.5, VParameter=0.5, WParameter="1")  # -> Plane, simplify(Point), Include
pattern_domains = PatternDomains(G=int_2)
area = Area(Geometry=faceb)  # -> Area, Centroid
sph = Sphere(Base=box.Plane, Radius=Slider(2, range=0..10))
data = Data(flatten(pattern_domains))
dom² = ConstructDomain²(DomainU=data, DomainV="0 To Pi")
pt = Point(simplify(graft(area.Centroid)))
subsrf = Isotrim(Surface=sph, Domain=dom²)
polar = ToPolar(Point=pt, System=box.Plane)  # -> simplify(Phi), Theta, Radius
inc = Includes(Value=polar.Phi, Domain=data)  # -> Includes, Deviation
wh_value_for_live_load = Panel("3.5")
ma = MassAddition(Input=inc.Includes)  # -> Result, PartialResults
bool = Boolean(ma.Result)
multiplication = Multiplication(A=load_kn_m2_2, C=bool)
dispatch = Dispatch(List=pt, DispatchPattern=bool)  # -> ListA, ListB
live_load_kn_m2_per_face = Number(multiplication)
outside = Point(dispatch.ListB)
inside = Point(dispatch.ListA)
Z = UnitZ(Factor=live_load_kn_m2_per_face)
pt_2 = Point(simplify(area.Centroid))
mesh_3 = Mesh(mesh_2)
rev = Reverse(Vector=Z)  # -> flatten(Vector)
vdis = VectorDisplay(Anchor=pt_2, Vector=rev)
loads = LoadsKaramba3D(Vectors=rev, Mesh=mesh_3, LCase="0", mode="MeshLoad -Variable", menu=[buttons(off, off, on), buttons(on, on)])
load = LoadKaramba3D(flatten(loads))
load_2 = ClusterOutput(load)

# ==== cluster CurrPoint
transformed_points = ClusterInput()
int_curr_solution = ClusterInput()
transformed_points_2 = Point(transformed_points)
int_curr_solution_2 = Integer(int_curr_solution)
branch = TreeBranch(Tree=transformed_points_2, Path=int_curr_solution_2, MaintainPaths=True)
curr_point = Point(branch)
curr_point_2 = ClusterOutput(curr_point)

# ==== cluster VectorValue
int_curr_solution = ClusterInput()
original_points = ClusterInput()
curr_point = ClusterInput()
original_points_2 = Point(original_points)
curr_point_2 = Point(curr_point)
int_curr_solution_2 = Integer(int_curr_solution)
branch = TreeBranch(Tree=original_points_2, Path=int_curr_solution_2, MaintainPaths=True)
pdecon = Deconstruct(Point=branch)  # -> XComponent, YComponent, ZComponent
expression = Expression(x=pdecon.ZComponent, Expression="Format(\"{0:0.000000}\", x)")
Z = UnitZ(Factor=Slider(0.222, range=0..1))
concat = Concatenate(FragmentA="curr: ", FragmentB=expression)
move = Move(Geometry=curr_point_2, Motion=Z)  # -> Geometry, Transform
tag = TextTag(Location=move.Geometry, Text=concat)

# ==== cluster ClosestSolution
params_current_solution = ClusterInput()
ds_coords = ClusterInput()
params_current_solution_2 = Number(params_current_solution)
ds_coords_2 = Data(simplify(ds_coords))
flip = FlipMatrix(Data=ds_coords_2)
cset = CreateSet(List=flip)  # -> Set, Map
fsim = FindSimilarMember(Data=params_current_solution_2, Set=cset.Set)  # -> Hit, Index
equals = Equality(FirstNumber=flatten(fsim.Hit), SecondNumber=ds_coords_2)  # -> Equality, Inequality
panel = Panel(equals.Equality)
mass_and = MassAND(bool=equals.Equality)
dispatch = Dispatch(List=ds_coords_2, DispatchPattern=mass_and)  # -> ListA, ListB
clean = CleanTree(RemoveNulls=True, RemoveInvalid=True, RemoveEmpty=Toggle(True), Tree=dispatch.ListA)
item = ListItem(List=clean, Index=0, Wrap=True)  # -> Item, Item1, Item2, Item3
tstat = TreeStatistics(Tree=clean)  # -> Paths, Length, Count
pt = ConstructPoint(XCoordinate=item.Item1, YCoordinate=item.Item2, ZCoordinate=item.Item3)
dpath = DeconstructPath(Branch=tstat.Paths)
sph = Sphere(Base=pt, Radius=Slider(0.018, range=0..0.1))
index_curr_vector = Integer(dpath)
design_vector = Data(clean)
index_curr_vector_2 = ClusterOutput(index_curr_vector)
design_vector_2 = ClusterOutput(design_vector)

# ==== cluster _2DGraph
original_points = ClusterInput()
ref_value = ClusterInput()
number_slider = Slider(5, range=0..10)
z_steps = ClusterInput()
pt = ConstructPoint(XCoordinate="-10", YCoordinate="-40", ZCoordinate=0)
yz = YZPlane(Origin=pt)
pflip = FlipPlane(Plane=yz, ReverseX=Toggle(True), ReverseY=False, SwapAxes=True)
original_points_2 = Point(original_points)
ref_value_2 = Number(ref_value)
neg = Negative(Value=number_slider)
planesrf = PlaneSurface(Plane=pflip, XSize=number_slider, YSize=neg)
planesrf_2 = PlaneSurface(Plane=yz, XSize=number_slider, YSize=number_slider)
bbox = BoundingBox(Content=flatten(original_points_2), Plane=PlaneXY(0, 0, 0), UnionBox=True)  # -> Box, Box_2
merge = Merge(Data1=planesrf_2, Data2=planesrf)
pdecon = Deconstruct(Point=flatten(original_points_2))  # -> XComponent, YComponent, ZComponent
debox = DeconstructBox(Box=bbox.Box)  # -> Plane, X, Y, Z
z_steps_2 = Integer(z_steps)
cset = CreateSet(List=pdecon.XComponent)  # -> Set, Map
cset_2 = CreateSet(List=pdecon.YComponent)  # -> Set, Map
cset_3 = CreateSet(List=pdecon.ZComponent)  # -> Set, Map
bnd = Bounds(Numbers=cset_3.Set)
range = Range(Domain=bnd, Steps=z_steps_2)
entwine = Entwine(Branch00=debox.X, Branch01=debox.Z, FlattenInputs=True)  # -> simplify(Result)
dom = ConstructDomain(DomainStart=0, DomainEnd=1)
sporph = Sporph(G=original_points_2, S0=bbox.Box, P0="0,0", S1=planesrf_2, P1="0,0", R=False)

# ----
# if ref value is out of bounds, don't add (or just add lower bound, which is indiferent)
ref_value_3 = Number(ref_value_2)
inc = Includes(Value=ref_value_3, Domain=bnd)  # -> Includes, Deviation
sort = SortList(Keys=range)  # -> Keys, ValuesA
item = ListItem(List=sort.Keys, Index=0, Wrap=True)
filter = StreamFilter(Gate=inc.Includes, Stream0=item, Stream1=ref_value_3)

transformed_points = Point(sporph)
merge_2 = Merge(Data1=filter, Data2=range)
panel = Panel(entwine)
transformed_points_2 = ClusterOutput(transformed_points)
entwine_2 = Entwine(Branch00=cset.Set, Branch01=merge_2, FlattenInputs=True)  # -> simplify(Result)
labels = ClusterInput()
fixed = ClusterInput()
graph_surface = Surface(simplify(graft(merge)))
labels_2 = Text(labels)
fixed_2 = Text(fixed)
remap = RemapNumbers(Value=entwine_2, Source=entwine, Target=dom)  # -> Mapped, Clipped
concat = Concatenate(FragmentA=graft(""), FragmentB=fixed_2)
pt_2 = ConstructPoint(XCoordinate=remap.Mapped, YCoordinate=0, ZCoordinate=0)
evalsrf = EvaluateSurface(Surface=reparameterize(graph_surface), Point=pt_2)  # -> Point, Normal, UDirection, VDirection, Frame
join = TextJoin(Text=flatten(concat))
pl = ConstructPlane(Origin=evalsrf.Point, XAxis=evalsrf.VDirection, YAxis=evalsrf.Normal)
panel_2 = Panel(join)
sec = BrepPlane(Brep=graph_surface, Plane=pl)  # -> Curves, Points
graph_surface_2 = Surface(merge)
transformed_points_3 = Point(transformed_points)
md_slider = MDSlider(
    SliderMode=0,
    slider_value=Point(0.5045493521, 0, 0.5),
    x_domain=Domain(0, 1),
    y_domain=Domain(0, 1),
    z_domain=Domain(0, 1))
grid_lines = Curve(sec.Curves)
flip = FlipMatrix(Data=transformed_points_3)
shift = ShiftList(List=graph_surface_2, Shift=Slider(0, range=0..10), Wrap=True)  # -> simplify(graft(List))
rdpoints = RemoveDuplicatePointsKaramba3D(Point=flip, LimitDistance=0.005)  # -> OutPoint, Info, Indexes
trim = TrimTree(Tree=grid_lines, Depth=1)
join_2 = JoinCurves(Curves=grid_lines, Preserve=False)
evalsrf_2 = EvaluateSurface(Surface=reparameterize(shift), Point=md_slider)  # -> Point, Normal, UDirection, VDirection, Frame
bang = ExplodeTree(Data=trim)  # -> Branch0, Branch1
trim_2 = TrimTree(Tree=simplify(join_2), Depth=1)
number_slider_2 = Slider(0.178, range=0..1)
number_slider_3 = Slider(0.191, range=0..1)
expression = Expression(x=entwine_2, Expression="Format(\"{0:0.000}\", x)")
horizontal_grid_lines = Curve(bang.Branch1)
vertical_grid_lines = Curve(bang.Branch0)
number_slider_4 = Slider(0.888, range=0..1)
end = EndPoints(Curve=trim_2)  # -> Start, End
adaptable_decimal_places = AdaptableDecimalPlaces(num=entwine_2)
deplane = DeconstructPlane(Plane=evalsrf_2.Frame)  # -> Origin, XAxis, YAxis, ZAxis
ln = Line(StartPoint=end.Start, EndPoint=end.End)
pt_3 = Point(rdpoints.OutPoint)
Z = UnitZ(Factor=number_slider_3)
amp = Amplitude(Vector=deplane.YAxis, Amplitude=number_slider_3)
item_2 = ListItem(List=horizontal_grid_lines, Index="0", Wrap=True)
cull_i = CullIndex(List=horizontal_grid_lines, Indices="0", Wrap=True)
ext = ExtendCurve(Curve=ln, Type=0, Start=number_slider_4, End=number_slider_4)
labels_3 = Text(expression)
rev = Reverse(Vector=amp)
project = Project(Geometry=pt_3, Plane=PlaneXY(0, 0, 0))  # -> Geometry, Transform
swatch = ColourSwatch(SwatchColor=RGB(128, 128, 128))
ref_grid_line = Curve(item_2)
merge_3 = Merge(Data1=vertical_grid_lines, Data2=cull_i)
end_2 = EndPoints(Curve=ext)  # -> Start, End
merge_4 = Merge(Data1=pt_3, Data2=project.Geometry)
lng = ListLength(List=project.Geometry)
move = Move(Geometry=evalsrf_2.Frame, Motion=rev)  # -> flatten(Geometry), Transform
dash = DashPattern(Curve=simplify(ref_grid_line), Pattern=Slider(0.1, range=0..1))  # -> Dashes, Gaps
frompoints = MeshFromPoints(Points=merge_4, UDirection="2", VDirection=lng)
unifynormals = MeshUnifyNormals(Mesh=frompoints)
item_3 = ListItem(List=move.Geometry, Index=0, Wrap=True)
preview = CustomPreview(Geometry=merge_3, Material=swatch)
preview_2 = CustomPreview(Geometry=dash.Dashes, Material=ColourSwatch(SwatchColor=RGB(255, 0, 0)))

tag = TextTag(Location=end_2.Start, Text=labels_3, Colour=swatch)
tag_2 = TextTag(Location=end_2.End, Text=labels_3, Colour=swatch)
mesh = Mesh(unifynormals)
tag_3 = TextTag3D(Location=move.Geometry, Text=labels_2, Size=number_slider_2, Justification=5)

tag_4 = TextTag3D(Location=item_3, Text=join, Size=number_slider_2, Justification=5)
mesh_2 = ClusterOutput(mesh)

# ==== cluster TransformPointsToLandscape
dimensons_for_variation = ClusterInput()
sectioned_data = ClusterInput()
result_label = ClusterInput()
results = ClusterInput()
result_int = ClusterInput()
dimensons_for_variation_2 = Integer(dimensons_for_variation)
sectioned_data_2 = Data(sectioned_data)
panel = Panel(sectioned_data_2)
dim_labels = ClusterInput()
result_label_2 = Text(result_label)
results_2 = Number(results)
result_int_2 = Integer(result_int)
tstat = TreeStatistics(Tree=sectioned_data_2)  # -> Paths, Length, Count
item = ListItem(List=sectioned_data_2, Index=dimensons_for_variation_2, Wrap=True)
lng = ListLength(List=dimensons_for_variation_2)
dim_labels_2 = Text(dim_labels)
gate = StreamGate(Stream=item, Gate=lng)  # -> Target0, Target1, Target2
item_2 = ListItem(List=dim_labels_2, Index=dimensons_for_variation_2, Wrap=True)
num2pt = NumbersToPoints(Numbers=gate.Target1, Mask=1)
num2pt_2 = NumbersToPoints(Numbers=gate.Target2, Mask=2)
branch = TreeBranch(Tree=results_2, Path=tstat.Paths, MaintainPaths=True)
merge = Merge(Data1=num2pt, Data2=num2pt_2)  # -> simplify(Result)
merge_2 = Merge(Data1=item_2, Data2=result_label_2)
panel_2 = Panel(merge_2)
pdecon = Deconstruct(Point=merge)  # -> XComponent, YComponent, ZComponent
item_3 = ListItem(List=branch, Index=result_int_2, Wrap=True)
pt = ConstructPoint(XCoordinate=pdecon.XComponent, YCoordinate=pdecon.YComponent, ZCoordinate=item_3)
transformed_points = Point(pt)
labels = Text(merge_2)
labels_2 = ClusterOutput(labels)
transformed_points_2 = ClusterOutput(transformed_points)

# ---- group: find fixed variable
panel_3 = Panel("""0
1
2""")
fsim = FindSimilarMember(Data=dimensons_for_variation_2, Set=panel_3)  # -> Hit, Index
cull_i = CullIndex(List=panel_3, Indices=fsim.Index, Wrap=True)
item_4 = ListItem(List=sectioned_data_2, Index=cull_i, Wrap=True)
item_5 = ListItem(List=dim_labels_2, Index=cull_i, Wrap=True)

# ----
branch_2 = TreeBranch(Tree=simplify(item_4), Path="0", MaintainPaths=True)

# ---- group: find fixed variable (continued)
item_6 = ListItem(List=branch_2, Index=0, Wrap=True)
expression = Expression(x=branch_2, Expression="Format(\"{0:0.000}\", x)")
concat = Concatenate(FragmentA=item_5, FragmentB=" = ", FragmentC=expression)
panel_4 = Panel(concat)

# ----
fixed = Text(concat)
fixed_2 = ClusterOutput(fixed)

# ==== cluster SectionDS
dims = ClusterInput()
design_space = ClusterInput()
design_vector = ClusterInput()
design_space_2 = Data(simplify(design_space))
dims_2 = Integer(dims)
design_vector_2 = Data(graft(design_vector))
item = ListItem(List=design_space_2, Index=0, Wrap=True)  # -> Item, Item1, Item2, Item3
flip = FlipMatrix(Data=design_space_2)
pt = ConstructPoint(XCoordinate=item.Item1, YCoordinate=item.Item2, ZCoordinate=item.Item3)
cset = CreateSet(List=flip)  # -> Set, Map
fsim = FindSimilarMember(Data=design_vector_2, Set=cset.Set)  # -> Hit, Index
trim = TrimTree(Tree=fsim.Hit, Depth=1)
equals = Equality(FirstNumber=trim, SecondNumber=design_space_2)  # -> Equality, Inequality
bool = Boolean(equals.Equality)
cull_i = CullIndex(List=bool, Indices=simplify(dims_2), Wrap=True)  # -> simplify(List)

# ---- group: check for what?
null = NullItem(Item=dims_2)  # -> NullFlags, InvalidFlags, Description
item_2 = ListItem(List=null.NullFlags, Index=0, Wrap=True)
filter = StreamFilter(Gate=item_2, Stream0=cull_i, Stream1=bool)

# ----
mass_or = MassOR(A=filter)
dispatch = Dispatch(List=design_space_2, DispatchPattern=mass_or)  # -> ListA, ListB
clean = CleanTree(RemoveNulls=True, RemoveInvalid=True, RemoveEmpty=Toggle(True), Tree=dispatch.ListA)
item_3 = ListItem(List=clean, Index=0, Wrap=True)  # -> Item, Item1, Item2, Item3
pt_2 = ConstructPoint(XCoordinate=item_3.Item1, YCoordinate=item_3.Item2, ZCoordinate=item_3.Item3)
T = ClusterOutput(clean)

# ==== cluster MinPoint
transformed_points = ClusterInput()
transformed_points_2 = Point(transformed_points)
pt = Point(transformed_points_2)
pdecon = Deconstruct(Point=pt)  # -> XComponent, YComponent, flatten(ZComponent)
tstat = TreeStatistics(Tree=pt)  # -> Paths, Length, Count
sort = SortList(Keys=pdecon.ZComponent, ValuesA=tstat.Paths)  # -> Keys, ValuesA
item = ListItem(List=sort.ValuesA, Index=0, Wrap=True)
path = DataPath(item)
branch = TreeBranch(Tree=pt, Path=path, MaintainPaths=True)
dpath = DeconstructPath(Branch=path)
min_point = Point(branch)
min_id = Integer(dpath)
min_id_2 = ClusterOutput(min_id)
min_point_2 = ClusterOutput(min_point)

# ==== cluster MinValue
int_curr_solution = ClusterInput()
original_points = ClusterInput()
curr_point = ClusterInput()
original_points_2 = Point(original_points)
curr_point_2 = Point(curr_point)
int_curr_solution_2 = Integer(int_curr_solution)
branch = TreeBranch(Tree=original_points_2, Path=int_curr_solution_2, MaintainPaths=True)
pdecon = Deconstruct(Point=branch)  # -> XComponent, YComponent, ZComponent
expression = Expression(x=pdecon.ZComponent, Expression="Format(\"{0:0.000000}\", x)")
Z = UnitZ(Factor=Slider(0.222, range=0..1))
concat = Concatenate(FragmentA="min: ", FragmentB=expression)
move = Move(Geometry=curr_point_2, Motion=Z)  # -> Geometry, Transform
tag = TextTag(Location=move.Geometry, Text=concat)

# ==== cluster CurrThumbnail
int_curr_solution = ClusterInput()
int_curr_solution_2 = Integer(int_curr_solution)
folder_file = ClusterInput()
expression = Expression(i=int_curr_solution_2, mid=Slider(90, range=0..100), Expression="If (i<mid,i,i+1)")
resolution = ClusterInput()
curr_point = ClusterInput()
folder_file_2 = Text(folder_file)
curr_point_2 = Point(curr_point)
pt = Point(curr_point_2)
yz = YZPlane(Origin=pt)
expression_2 = Expression(x=expression, Expression="Format(\"{0:000}\", x)")
xy = XYPlane(Origin=pt)
md_slider = MDSlider(SliderMode=0, slider_value=Point(0.5, 0, 0.5), x_domain=Domain(0, 1), y_domain=Domain(0, 1), z_domain=Domain(0, 1))
rotate = Rotate(Geometry=xy, Angle=1.570796327, Plane=pt)  # -> Geometry, Transform
panel = Panel("1 to 2")
resolution_2 = Integer(resolution)
rectangle = Rectangle(Plane=rotate.Geometry, XSize="-.5 to .5", YSize="-.5 to .5", Radius=0)  # -> Rectangle, Length
concat = Concatenate(FragmentA=folder_file_2, FragmentB=expression_2, FragmentC=".bmp")
evalsrf = EvaluateSurface(Surface=reparameterize(rectangle.Rectangle), Point=md_slider)  # -> Point, Normal, UDirection, VDirection, Frame
panel_2 = Panel(concat)
panel_3 = Panel(rectangle.Rectangle)

img = ImportImage(File=concat, Rectangle=rectangle.Rectangle, XSamples=resolution_2, YSamples=resolution_2)
crv = Curve(rectangle.Rectangle)

# ==== cluster PercentileStress
model = ClusterInput()
percentile = ClusterInput()
model_2 = ModelKaramba3D(model)
percentile_2 = Number(percentile)
shellvecresults = ResultVectorsOnShellsKaramba3D(AnalyzedModel=model_2, LayerPosition="1", mode="PrincStress")  # -> AnalyzedModel, Points, FirstPrincipalStressVector_kN_cm2, SecondPrincipalStressVector_kN_cm2, FirstPrincipalStressValue_kN_cm2, SecondPrincipalStressValue_kN_cm2
shellvecresults_2 = ResultVectorsOnShellsKaramba3D(AnalyzedModel=model_2, LayerPosition="-1", mode="PrincStress")  # -> AnalyzedModel, Points, FirstPrincipalStressVector_kN_cm2, SecondPrincipalStressVector_kN_cm2, FirstPrincipalStressValue_kN_cm2, SecondPrincipalStressValue_kN_cm2
merge = Merge(Data1=shellvecresults_2.FirstPrincipalStressValue_kN_cm2, Data2=shellvecresults.FirstPrincipalStressValue_kN_cm2)
sort = SortList(Keys=merge)  # -> Keys, ValuesA
division = Division(A=percentile_2, B=100)
lng = ListLength(List=sort.Keys)
subtraction = Subtraction(A="1", B=division)
subtraction_2 = Subtraction(A=lng, B=1)
graph = QuickGraph(sort.Keys, SortOrder=0)
remap = RemapNumbers(Value=division, Source=Domain(0, 1), Target=subtraction_2)  # -> Mapped, Clipped
remap_2 = RemapNumbers(Value=subtraction, Source=Domain(0, 1), Target=subtraction_2)  # -> Mapped, Clipped
int = Integer(remap_2.Mapped)
int_2 = Integer(remap.Mapped)
dom = ConstructDomain(DomainStart=int, DomainEnd=int_2)
subset = SubList(List=sort.Keys, Domain=dom, Wrap=True)  # -> List, Index
graph_2 = QuickGraph(subset.List, SortOrder=0)
item = ListItem(List=reverse(subset.List), Index=0, Wrap=True)
item_2 = ListItem(List=subset.List, Index=0, Wrap=True)
panel = Panel(item)
panel_2 = Panel(item_2)
max_comp_stress_kn_cm2 = Number(item_2)
max_tens_stress_kn_cm2 = Number(item)
max_tens_stress_kn_cm2_2 = ClusterOutput(max_tens_stress_kn_cm2)
max_comp_stress_kn_cm2_2 = ClusterOutput(max_comp_stress_kn_cm2)

# ==== cluster BoxDims
box = ClusterInput()
box_2 = Box(box)
debox = DeconstructBox(Box=box_2)  # -> Plane, X, Y, Z
dedomain = DeconstructDomain(Domain=debox.X)  # -> Start, End
dedomain_2 = DeconstructDomain(Domain=debox.Y)  # -> Start, End
dedomain_3 = DeconstructDomain(Domain=debox.Z)  # -> Start, End
subtraction = Subtraction(A=dedomain.End, B=dedomain.Start)
subtraction_2 = Subtraction(A=dedomain_2.End, B=dedomain_2.Start)
subtraction_3 = Subtraction(A=dedomain_3.End, B=dedomain_3.Start)
dx = Number(subtraction)
dy = Number(subtraction_2)
dz = Number(subtraction_3)
dx_2 = ClusterOutput(dx)
dy_2 = ClusterOutput(dy)
dz_2 = ClusterOutput(dz)

# ==== cluster PatternDomains

# ---- group: pattern 5
number_slider = Slider(0, range=0..10)
number_slider_2 = Slider(2, range=0..10)
addition = Addition(A=number_slider, B="2")
series = Series(Start=addition, Step="4", Count=number_slider_2)
series_2 = Series(Start=number_slider, Step="4", Count=number_slider_2)
multiplication = Multiplication(A=series_2, B=".25")
multiplication_2 = Multiplication(A=series, B=".25")
pi = Pi(Factor=multiplication_2)
pi_2 = Pi(Factor=multiplication)
panel = Panel(pi_2)
panel_2 = Panel(pi)
dom = ConstructDomain(DomainStart=panel, DomainEnd=panel_2)  # -> graft(Domain)

# ---- group: pattern 6
number_slider_3 = Slider(0, range=0..10)
number_slider_4 = Slider(4, range=0..10)
addition_2 = Addition(A=number_slider_3, B="1")
series_3 = Series(Start=addition_2, Step="2", Count=number_slider_4)
series_4 = Series(Start=number_slider_3, Step="2", Count=number_slider_4)
multiplication_3 = Multiplication(A=series_4, B=".25")
multiplication_4 = Multiplication(A=series_3, B=".25")
pi_3 = Pi(Factor=multiplication_4)
pi_4 = Pi(Factor=multiplication_3)
panel_3 = Panel(pi_4)
panel_4 = Panel(pi_3)
dom_2 = ConstructDomain(DomainStart=panel_3, DomainEnd=panel_4)  # -> graft(Domain)

# ---- group: pattern 4
number_slider_5 = Slider(1, range=0..10)
number_slider_6 = Slider(2, range=0..10)
addition_3 = Addition(A=number_slider_5, B="2")
series_5 = Series(Start=addition_3, Step="4", Count=number_slider_6)
series_6 = Series(Start=number_slider_5, Step="4", Count=number_slider_6)
multiplication_5 = Multiplication(A=series_6, B=".25")
multiplication_6 = Multiplication(A=series_5, B=".25")
pi_5 = Pi(Factor=multiplication_6)
pi_6 = Pi(Factor=multiplication_5)
panel_5 = Panel(pi_6)
panel_6 = Panel(pi_5)
dom_3 = ConstructDomain(DomainStart=panel_5, DomainEnd=panel_6)  # -> graft(Domain)

# ---- group: pattern 1
multiplication_7 = Multiplication(A=Slider(0, range=0..10), B=".25")
multiplication_8 = Multiplication(A=Slider(0, range=0..10), B=".25")
pi_7 = Pi(Factor=multiplication_7)
pi_8 = Pi(Factor=multiplication_8)
panel_7 = Panel(pi_7)
panel_8 = Panel(pi_8)
dom_4 = ConstructDomain(DomainStart=panel_7, DomainEnd=panel_8)

# ---- group: pattern 2
multiplication_9 = Multiplication(A=Slider(2, range=0..10), B=".25")
multiplication_10 = Multiplication(A=Slider(6, range=0..10), B=".25")
pi_9 = Pi(Factor=multiplication_9)
pi_10 = Pi(Factor=multiplication_10)
panel_9 = Panel(pi_9)
panel_10 = Panel(pi_10)
dom_5 = ConstructDomain(DomainStart=panel_9, DomainEnd=panel_10)

# ---- group: pattern 3
multiplication_11 = Multiplication(A=Slider(1, range=0..10), B=".25")
multiplication_12 = Multiplication(A=Slider(5, range=0..10), B=".25")
pi_11 = Pi(Factor=multiplication_11)
pi_12 = Pi(Factor=multiplication_12)
panel_11 = Panel(pi_11)
panel_12 = Panel(pi_12)
dom_6 = ConstructDomain(DomainStart=panel_11, DomainEnd=panel_12)

# ---- group: pattern 7
multiplication_13 = Multiplication(A=Slider(0, range=0..10), B=".25")
multiplication_14 = Multiplication(A=Slider(8, range=0..10), B=".25")
pi_13 = Pi(Factor=multiplication_13)
pi_14 = Pi(Factor=multiplication_14)
panel_13 = Panel(pi_13)
panel_14 = Panel(pi_14)
dom_7 = ConstructDomain(DomainStart=panel_13, DomainEnd=panel_14)

# ----
G = ClusterInput()
filter = StreamFilter(Gate=G, Stream1=dom_4, Stream2=dom_5, Stream3=dom_6, Stream4=dom, Stream5=dom_3, Stream6=dom_2, Stream7=dom_7)
s_2 = ClusterOutput(filter)

# ==== cluster MassAND
bool = ClusterInput()
bool_2 = Boolean(bool)
lng = ListLength(List=bool_2)
ma = MassAddition(Input=bool_2)  # -> Result, PartialResults
larger = LargerThan(FirstNumber=ma.Result, SecondNumber=lng)  # -> LargerThan, OrEqualTo
bool_3 = Boolean(larger.OrEqualTo)
bool_4 = ClusterOutput(bool_3)

# ==== cluster AdaptableDecimalPlaces
num = ClusterInput()
num_2 = Number(num)
reldif = RelativeDifferences(Values=num_2)
item = ListItem(List=reverse(reldif), Index=0, Wrap=True)
split = TextSplit(Text=item, Separators=".")
item_2 = ListItem(List=reverse(split), Index=0, Wrap=True)
chars = Characters(Text=item_2)  # -> Result, Unicode
lng = ListLength(List=chars.Result)  # -> simplify(Length)
panel = Panel(chars.Result)
repeat = RepeatData(Data="0", Length=lng)
join = TextJoin(Text=repeat)
concat = Concatenate(FragmentA="{0:0.", FragmentB=join, FragmentC="}")
format = Format(Format=concat, Culture=127, Data0=num_2)
txt = Text(format)
panel_2 = Panel(format)
txt_2 = ClusterOutput(txt)

# ==== cluster MassOR
A = ClusterInput()
not = GateNot(A=A)
ma = MassAddition(Input=not)  # -> Result, PartialResults
not_2 = GateNot(A=ma.Result)
R = ClusterOutput(not_2)
