# Grasshopper definition analyseWholeShell_2021.gh (Grasshopper 1.0.7)
# plug-ins: ACORNshells, karambaGH

image = ImageSampler(Filter="Colour", Interpolate=False, Umax=1, Umin=0, Vmax=1, Vmin=0, Wrap=1)
thickness_m = Slider(0.06, range=0.04..0.1)
load_pattern = Slider(2, range=1..7)
shell = Slider(1, range=1..2)
merge = Merge(Data1=shell, Data2=load_pattern, Data3=thickness_m)

# ---- group: ACORN sampler
# difference from DSE:
# DSE subdivides slider domain into N subdomain and samples mid point;
# ACORN includes end points of sliders, subdivides into N-1 subdomains and samples all start points plus last endpoint
c_script = CSharpScript()  # -> out, name, min, max; disabled
# ---------- c_script: C# ----------
    decimal _max, _min;
    System.Guid _name;


    IGH_Param tempPara = this.Component.Params.Input[0].Sources[0];
    //if (tempPara.GetType() == typeof(Grasshopper.Kernel.Special.GH_NumberSlider))
    //{
    Grasshopper.Kernel.Special.GH_NumberSlider NumSlider = tempPara as Grasshopper.Kernel.Special.GH_NumberSlider;
    _max = NumSlider.Slider.Maximum;
    _min = NumSlider.Slider.Minimum;
    _name = NumSlider.InstanceGuid;
    //}
    
    name = _name;
    min = _min;
    max = _max;
# ---------- end c_script ----------
readsliders = CSharpScript(S=merge)  # -> out, N, D; inputs S: list
# ---------- readsliders: C# ----------
    IGH_Param mergeOutputParam = this.Component.Params.Input[0].Sources[0];
    var mergeComp = mergeOutputParam.Attributes.GetTopLevel.DocObject as IGH_Component;
    var sliders = mergeComp.Params.Input;

    List<string> nicknames = new List<string>();
    List<Interval> domains = new List<Interval>();

    foreach (var slider in sliders)
    {
      var sliderSource = slider.Sources[0];
      nicknames.Add(sliderSource.NickName);

      Grasshopper.Kernel.Special.GH_NumberSlider NumSlider = sliderSource as Grasshopper.Kernel.Special.GH_NumberSlider;
      //var _max = NumSlider.Slider.Maximum;
      Interval sliderDomain = new Interval ((double) NumSlider.Slider.Minimum, (double) NumSlider.Slider.Maximum);
      //_min = NumSlider.Slider.Minimum;
      domains.Add(sliderDomain);
    }


    N = nicknames;
    D = domains;
# ---------- end readsliders ----------
item = ListItem(List=readsliders.D, Index=0, Wrap=True)  # -> Item, Item1, Item2
range = Range(Domain=item.Item, Steps=Slider(1, range=1..10))  # -> simplify(Range)
range_2 = Range(Domain=item.Item1, Steps=Slider(6, range=1..10))  # -> simplify(Range)
range_3 = Range(Domain=item.Item2, Steps=Slider(6, range=1..12))  # -> simplify(Range)
crossref = CrossReference(ListC=range, ListA=range_2, ListB=range_3, CrossMode=1)  # -> ListC, ListA, ListB
entwine = Entwine(Branch0X=crossref.ListC, Branch1X=crossref.ListA, Branch2X=crossref.ListB, FlattenInputs=False)  # -> simplify(Result)
flip = FlipMatrix(Data=entwine)
panel = Panel(flip)
design_map = Number(flip)
parameter_labels = Text(readsliders.N)

# ----
panel_2 = Panel(readsliders.out)

# ---- group: for generating catalog
number_slider = Slider(97, range=0..97)
branch = TreeBranch(Tree=design_map, Path=number_slider, MaintainPaths=True)

# ----
current_solution = Integer(number_slider)
item_2 = ListItem(List=merge, Index=0, Wrap=True)  # -> Item, Item1, Item2
thickness_m_2 = Number(item_2.Item2)
load_pattern_2 = Integer(item_2.Item1)
shell_2 = Integer(item_2.Item)
panel_3 = Panel(shell_2)
lor_7_8x7_2 = Surface(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)
_6x6 = Surface(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)
merge_2 = Merge(Data1=lor_7_8x7_2, Data2=_6x6)
subtraction = Subtraction(A=shell_2, B=1)
item_3 = ListItem(List=merge_2, Index=subtraction, Wrap=True)

# ---- group: structural model
srf = Surface(item_3)
thickness_m_3 = Number(thickness_m_2)
image_2 = ImageSampler(Filter="Colour", Interpolate=False, Umax=1, Umin=0, Vmax=1, Vmin=0, Wrap=1)
load_pattern_3 = Integer(load_pattern_2)
load_pattern_4 = Slider(2, range=1..7)
srf_2 = Surface(srf)
edges = BrepEdges(Brep=srf_2)  # -> Naked, Interior, NonManifold
mesh_breps = MeshBrepsKaramba3D(
    Brep=srf,
    MeshResolution=Slider(0.1, range=0..1),
    EdgeRefinementFactor=Slider(0.2, range=0..1),
    PointReduction=False,
    SmoothingStepSize=Slider(1, range=0..1),
    SmoothingIterations=Slider(3, range=0..10))  # -> Mesh, Info
dead_load_kn_m2 = Slider(1, range=0..10)
culln = CullNth(List=edges.Naked, CullFrequency=2)
safety_factor = Slider(1.35, range=0..10)
corner_curves = Curve(culln)
mesh = Mesh(mesh_breps.Mesh)
live_load_kn_m2 = Slider(1.5, range=0..10)
safety_factor_2 = Slider(1.5, range=0..10)
multiplication = Multiplication(A=safety_factor, B=dead_load_kn_m2)
Z = UnitZ(Factor=safety_factor)
Z_2 = UnitZ(Factor=multiplication)
rev = Reverse(Vector=Z)
load_pattern_5 = Integer(load_pattern_3)
multiplication_2 = Multiplication(A=safety_factor_2, B=live_load_kn_m2)
rev_2 = Reverse(Vector=Z_2)
mesh_2 = Mesh(mesh)
asymmetrical_load_patterns = AsymmetricalLoadPatterns(mesh=mesh_2, int=load_pattern_5, load_kn_m2=multiplication_2)
loads = LoadsKaramba3D(Vector=rev_2, Mesh=mesh, mode="MeshLoad -Const.", menu=[buttons(off, off, on), buttons(on, on)])
loads_2 = LoadsKaramba3D(Vector=rev, mode="Gravity")
merge_3 = Merge(Data1=loads_2, Data2=loads, Data3=asymmetrical_load_patterns)  # -> flatten(Result)
matselect = MaterialSelectionKaramba3D(menu=[dropdown(3), dropdown(9)])
thickness_m_4 = Number(thickness_m_3)
a_preliminaryshellanalysismodel = PreliminaryShellAnalysisModel(Mesh=mesh, Corners=corner_curves, Thickness=thickness_m_4, Material=matselect, Loads=merge_3)

# ---- group: results
# Compressive strength : 20 - 40 MPa
# Tensile strength - σ : 2 - 5 MPa
# Modulus of elasticity - E : 14 - 41 GPa
# 
# (https://www.engineeringtoolbox.com/concrete-properties-d_1223.html)
model = ModelKaramba3D(a_preliminaryshellanalysismodel)
disassemble = DisassembleModelKaramba3D(Model=model)  # -> Model, Point, Beam, Shell, Support, Load, Line, Mesh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
analyzethii = AnalyzeThIIKaramba3D(Model=model, RTolerance=1e-07, MaxIterations=50, NoTensionalNII=False)  # -> CalculatedModel, MaximumDisplacement_cm, ResultingForceOfGravity_kN, ElasticEnergy_kNm
analyze = AnalyzeKaramba3D(Model=model)  # -> CalculatedModel, MaximumDisplacement_cm, ResultingForceOfGravity_kN, ElasticEnergy_kNm
disassemble_2 = DisassembleElementKaramba3D(Element=disassemble.Shell)  # -> Element, ElementIdentifier, AxisOfElement, CrossSection, Joints, Material, LocalCoordinateSystem, ElementIsActive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
bmodes = BucklingModesKaramba3D(Model=analyzethii.CalculatedModel, FromIndex=1, NumberOfModes=1, MaximumNumberOfIterations=300, Epsilon=1e-07)  # -> ModelWithBucklingModesAsLoadCaseResults, BucklingLoadFactors
disassemble_3 = DisassembleMaterialKaramba3D(Material=disassemble_2.Material)  # -> Material, TypeOfMaterial, FamilyNameOfMaterial, NameOfMaterial, ElemIdentifiers, Color, YoungsModulusKNCm2Dir12, InPlaneShearModulus_kN_cm2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
percentile_stress = PercentileStress(model=analyze.CalculatedModel, include_2nd_ps=Toggle(False), percentile=Slider(99, range=90..100))  # -> max_comp_stress_mpa_3, max_comp_stress_mpa_4, max_tens_stress_mpa_4, max_tens_stress_mpa_3, extreme_stress_elements_2
multiplication_3 = Multiplication(A=disassemble_3.YieldStrengthKNCm2Dir12, B="10")
multiplication_4 = Multiplication(A=disassemble_3.YoungsModulusKNCm2Dir12, B="0.01")
modelview = ModelViewKaramba3D(Model=analyze.CalculatedModel, ResultFactors=1, ResultCase=-1)  # -> Model, DeformedMesh, DeformedAxes, DeformedModel
modelview_2 = ModelViewKaramba3D(Model=bmodes.ModelWithBucklingModesAsLoadCaseResults, ResultFactors=1, ResultCase=-1)  # -> Model, DeformedMesh, DeformedAxes, DeformedModel
elasticity_gpa = Number(multiplication_4)
compressive_strength_mpa = Number(multiplication_3)
max_displacement_cm = Number(analyzethii.MaximumDisplacement_cm)
buckling_safety_factors = Number(bmodes.BucklingLoadFactors)
panel_4 = Panel(elasticity_gpa)
shellview = ShellViewKaramba3D(Model=modelview_2.Model, IndexOfLayer=0)  # -> Model, MeshesOfRenderedShells, LegendColors, LegendTags
shellview_2 = ShellViewKaramba3D(Model=modelview.Model, IndexOfLayer=0)  # -> Model, MeshesOfRenderedShells, LegendColors, LegendTags
panel_5 = Panel(compressive_strength_mpa)
merge_4 = Merge(
    Data1=flatten(percentile_stress.max_comp_stress_mpa_3),
    Data2=flatten(percentile_stress.max_comp_stress_mpa_4),
    Data3=flatten(percentile_stress.max_tens_stress_mpa_4),
    Data4=flatten(percentile_stress.max_tens_stress_mpa_3),
    Data5=flatten(buckling_safety_factors),
    Data6=flatten(max_displacement_cm))  # -> simplify(Result)
medges = MeshEdges(Mesh=shellview_2.MeshesOfRenderedShells)  # -> NakedEdges, InteriorEdges, NonManifoldEdges
legend = Legend(Colour=shellview_2.LegendColors, Tags=shellview_2.LegendTags, LegendType=1)
medges_2 = MeshEdges(Mesh=shellview.MeshesOfRenderedShells)  # -> NakedEdges, InteriorEdges, NonManifoldEdges
legend_2 = Legend(Colour=shellview.LegendColors, Tags=shellview.LegendTags, LegendType=1)
pinned_supports = Data([-45.59435208, -7.050402053, 2.284037372, 21.05522527, 7.453131996, 0.6371884345])
crv = Curve(medges.NakedEdges)
crv_2 = Curve(medges_2.NakedEdges)
panel_6 = Panel(merge_4)
panel_7 = Panel(pinned_supports)

# ----
mesh_3 = Mesh(percentile_stress.extreme_stress_elements_2)

current_solution_2 = Integer(current_solution)
results = Number(merge_4)
flatten = FlattenTree(Tree=results, Path=current_solution_2)
rec = DataRecorder(flatten, DataLimit=-10, RecordData=True)

# ----
# 2021 Jan 26
# DL 2
# LL 1.5
data = Data(Tree({0}: [-1.06, -0.08616580399, 0.06288124031, 0.68, 4.089947379, 0.2493632788], {1}: [-0.547, -0.05612223444, 0.03831871864, 0.299, 10.44832567, 0.09415340161], {2}: [-2.4, -0.1390502391, 0.4516670872, 3.07, 3.159595325, 1.337569032], {3}: [-1.06, -0.1051933727, 0.2659790555, 1.24, 7.939231621, 0.3842129882], {4}: [-1.8, -0.1399940487, 0.09743764851, 1.47, 3.095861695, 0.5261917897], {5}: [-0.851, -0.08937575841, 0.05443078684, 0.494, 7.896964322, 0.1545590825]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))

# ----
# 2021 Jan 27
# DL 1
# LL 2.5
data_2 = Data(Tree({0}: [-0.712, -0.05740965605, 0.04156523063, 0.461, 6.125786307, 0.1634439236], {1}: [-0.371, -0.03741059832, 0.0250998994, 0.205, 15.62309875, 0.06205409255], {2}: [-3.15, -0.1519949237, 0.8813239711, 4.95, 3.413610182, 2.084202502], {3}: [-1.37, -0.1032764422, 0.5237747503, 2.11, 8.391506545, 0.6058989612], {4}: [-2.08, -0.1459586581, 0.1954112336, 2.11, 3.262677753, 0.7554949274], {5}: [-1, -0.09606691057, 0.1088376379, 0.774, 8.299974902, 0.1947510783]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))

# ----
# 2021 Jan 26
# DL 2
# LL 3.0
data_3 = Data(Tree({0}: [-1.06, -0.08616580399, 0.06288124031, 0.68, 4.089947379, 0.2493632788], {1}: [-0.547, -0.05612223444, 0.03831871864, 0.299, 10.44832567, 0.09415340161], {2}: [-3.95, -0.1992241808, 1.025565752, 5.95, 2.509602459, 2.803424958], {3}: [-1.71, -0.1351731826, 0.6127371316, 2.52, 6.210868248, 0.7557314152], {4}: [-2.7, -0.1922920796, 0.2197880437, 2.59, 2.410575653, 1.012118675], {5}: [-1.31, -0.1245065532, 0.121969887, 0.933, 6.15505123, 0.2481742511]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))

# ----
# 2021 Jan 26
# DL 1
# LL 1.5
data_4 = Data(Tree({0}: [-0.712, -0.05740965605, 0.04156523063, 0.461, 6.125786307, 0.1634439236], {1}: [-0.371, -0.03741059832, 0.0250998994, 0.205, 15.62309875, 0.06205409255], {2}: [-2.12, -0.1155539763, 0.4853574482, 3.01, 4.223264786, 1.218560048], {3}: [-0.912, -0.08464881185, 0.2930554782, 1.26, 10.4634501, 0.3660970918], {4}: [-1.52, -0.1107373433, 0.1007741425, 1.36, 4.085739827, 0.4609670322], {5}: [-0.74, -0.07118329186, 0.05559320694, 0.481, 10.38619177, 0.1306089132]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))

# ----
# 2021 Jan 26
# DL 2
# LL 2.5
data_5 = Data(Tree({0}: [-1.06, -0.08616580399, 0.06288124031, 0.68, 4.089947379, 0.2493632788], {1}: [-0.547, -0.05612223444, 0.03831871864, 0.299, 10.44832567, 0.09415340161], {2}: [-3.43, -0.1814780154, 0.8297052652, 4.98, 2.707314277, 2.289016667], {3}: [-1.48, -0.1285441314, 0.497546425, 2.09, 6.704326004, 0.6298135707], {4}: [-2.41, -0.1750256756, 0.1729980066, 2.21, 2.608435902, 0.8360248136], {5}: [-1.17, -0.1130040556, 0.09596122661, 0.787, 6.652153351, 0.2151280185]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))

# ----
# 2021 Feb 04
# DL 1
# LL 1.5
# 1st + 2nd PS
data_6 = Data(Tree({0}: [-2.012133174, -0.5627663812, 0.03824528255, 0.4707387891, 6.125786381, 0.1634439236], {1}: [-1.021924412, -0.3739094374, 0.02307734993, 0.2095996311, 15.62309875, 0.06205409255], {2}: [-6.13438097, -0.8735035212, 0.3660800936, 3.126497159, 4.223264791, 1.218560048], {3}: [-2.911566165, -0.5536055166, 0.2106970897, 1.325884296, 10.46344994, 0.3660970918], {4}: [-4.007909765, -0.8136769522, 0.08016394604, 1.385380548, 4.085739851, 0.4609670322], {5}: [-1.76562929, -0.5299434168, 0.04367628839, 0.4910101272, 10.38619179, 0.1306089132]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))

design_map_2 = Number(design_map)
results_2 = Data(data_4)
item_4 = ListItem(List=results_2, Index=0, Wrap=True)  # -> Item, Item1, Item2, Item3, Item4, Item5

item_5 = ListItem(List=design_map_2, Index=0, Wrap=True)  # -> Item, Item1, Item2
panel_8 = Panel("""convert thickness:
1 m = 1000 mm""")
multiplication_5 = Multiplication(A=item_5.Item2, B="1000")
merge_5 = Merge(Data1=item_5.Item, Data2=item_5.Item1, Data3=multiplication_5)

# ----
# Visualization shell results multiple layers
model_2 = ModelKaramba3D(modelview.Model)
shellview_3 = ShellViewKaramba3D(Model=model_2, IndexOfLayer=0)  # -> Model, MeshesOfRenderedShells, LegendColors, LegendTags
shellview_4 = ShellViewKaramba3D(Model=model_2, IndexOfLayer=0)  # -> Model, MeshesOfRenderedShells, LegendColors, LegendTags
range_4 = Range(Domain="-1 To 1", Steps=Slider(3, range=1..11))  # -> simplify(graft(Range))
layers = Number(range_4)
shellview_5 = ShellViewKaramba3D(Model=model_2, IndexOfLayer=0)  # -> Model, MeshesOfRenderedShells, LegendColors, LegendTags
shellvecresults = ResultVectorsOnShellsKaramba3D(AnalyzedModel=model_2, LayerPosition=layers, mode="PrincStress")  # -> simplify(AnalyzedModel), Points, FirstPrincipalStressVector_kN_cm2, SecondPrincipalStressVector_kN_cm2, FirstPrincipalStressValue_kN_cm2, SecondPrincipalStressValue_kN_cm2
multiplication_6 = Multiplication(A=Slider(5, range=0..10), B=range_4)
merge_6 = Merge(
    Data1=shellview_5.MeshesOfRenderedShells,
    Data2=shellview_4.MeshesOfRenderedShells,
    Data3=shellview_3.MeshesOfRenderedShells)  # -> simplify(graft(Result))
Z_3 = UnitZ(Factor=multiplication_6)
range_5 = Range(Domain=Domain(0, 1), Steps=Slider(6, range=0..10))
bbox = BoundingBox(Content=merge_6, Plane=PlaneXY(0, 0, 0))  # -> Box, Box_2
bnd = Bounds(Numbers=shellvecresults.SecondPrincipalStressValue_kN_cm2)
crossref_2 = CrossReference(ListA=range_5, ListB=range_5, CrossMode=1)  # -> ListA, ListB
range_6 = Range(Domain=bnd, Steps=Slider(50, range=0..100))
box = EvaluateBox(Box=simplify(bbox.Box), UParameter=crossref_2.ListA, VParameter=crossref_2.ListB, WParameter=0.5)  # -> Plane, simplify(Point), Include
shelllineresults = LineResultsOnShellsKaramba3D(
    AnalyzedModel=shellvecresults.AnalyzedModel,
    LayerPosition=layers,
    ListOfIsoValuesValsOrSourcesOfForceFlowLinesLinesPoints=range_6,
    SegmentLength_m=0,
    Smoothing=False,
    mode="IsoLines",
    menu=[buttons(off, on, off, off, off, off, off)])  # -> AnalyzedModel, simplify(Lines), Value; disabled
shelllineresults_2 = LineResultsOnShellsKaramba3D(
    AnalyzedModel=model_2,
    LayerPosition=range_4,
    ListOfSourcesOfPrincipalStressLinesLinesPoints=box.Point,
    SegmentLength_m=0.5,
    DA_deg=5,
    mode="PrincStress")  # -> AnalyzedModel, Lines1, Lines2
crv_3 = Curve(shelllineresults_2.Lines2)
data_7 = Data(Tree({0;0;0}: [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], {0;0;1}: [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], {0;1;0}: [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], {0;1;1}: [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], {0;1;2}: [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], {0;1;3}: [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]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))
medges_3 = MeshEdges(Mesh=merge_6)  # -> NakedEdges, InteriorEdges, NonManifoldEdges
trim = TrimTree(Tree=crv_3, Depth="2")
trim_2 = TrimTree(Tree=data_7, Depth="2")
crv_4 = Curve(simplify(medges_3.NakedEdges))
vec = Vector(Z_3)
move = Move(Geometry=trim_2, Motion=vec)  # -> simplify(Geometry), Transform
move_2 = Move(Geometry=trim, Motion=vec)  # -> simplify(Geometry), Transform
move_3 = Move(Geometry=merge_6, Motion=vec)  # -> simplify(Geometry), Transform
move_4 = Move(Geometry=crv_4, Motion=vec)  # -> simplify(Geometry), Transform
preview = CustomPreview(Geometry=move_2.Geometry, Material=ColourSwatch(SwatchColor=RGB(212, 212, 212)))
preview_2 = CustomPreview(Geometry=move_4.Geometry, Material=ColourSwatch(SwatchColor=RGB(0, 0, 0)))
preview_3 = CustomPreview(Geometry=move.Geometry, Material=ColourSwatch(SwatchColor=RGB(135, 135, 135)))

# ----
# convert stress:
# 1 kN/cm² = 10 Megapascal [MPa]
panel_9 = Panel("10")
multiplication_7 = Multiplication(A=item_4.Item, B=panel_9)
multiplication_8 = Multiplication(A=item_4.Item1, B=panel_9)
multiplication_9 = Multiplication(A=item_4.Item2, B=panel_9)
multiplication_10 = Multiplication(A=item_4.Item3, B=panel_9)
merge_7 = Merge(
    Data1=multiplication_7,
    Data2=multiplication_8,
    Data3=multiplication_9,
    Data4=multiplication_10,
    Data5=item_4.Item4,
    Data6=item_4.Item5)
only_1st_ps = Data(merge_7)
with_2nd_ps = Data(Tree({0}: [-20.12133174, -5.627663812, 0.3824528255, 4.707387891, 6.125786381, 0.1634439236], {1}: [-10.21924412, -3.739094374, 0.2307734993, 2.095996311, 15.62309875, 0.06205409255], {2}: [-61.3438097, -8.735035212, 3.660800936, 31.26497159, 4.223264791, 1.218560048], {3}: [-29.11566165, -5.536055166, 2.106970897, 13.25884296, 10.46344994, 0.3660970918], {4}: [-40.07909765, -8.136769522, 0.8016394604, 13.85380548, 4.085739851, 0.4609670322], {5}: [-17.6562929, -5.299434168, 0.4367628839, 4.910101272, 10.38619179, 0.1306089132]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))
results_3 = Data(merge_7)
abs = Absolute(Value=results_3)
panel_10 = Panel(only_1st_ps)
panel_11 = Panel(with_2nd_ps)
panel_12 = Panel("""maximum compression stress [MPa]
top 99% compression stress [MPa]
top 99% tension stress [MPa]
maximum tension stress [MPa]
buckling safety factors
maximum deflection 2nd order [cm] """)
thickness_mm = Slider(50, range=40..100)
load_pattern_6 = Slider(2, range=1..7)
dimensions = Panel("""shell #
loading pattern
thickness [mm]""")
shell_3 = Slider(1, range=1..2)
panel_13 = Panel("""20.000
20.000
20.000
20.000
10
10""")
merge_8 = Merge(Data1=shell_3, Data2=load_pattern_6, Data3=thickness_mm)
result = Slider(0, range=0..5)
parameter = Slider(2, range=0..2)
pt = ConstructPoint(XCoordinate="-10", YCoordinate="-40", ZCoordinate=0)
make_2d_graph = Make2DGraph(
    graph_origin=pt,
    selected_result_y_axis=result,
    selected_parameter_x_axis=parameter,
    result_labels=panel_12,
    reference_values=panel_13,
    parameter_labels=dimensions,
    design_space_vectors=merge_5,
    all_results=abs,
    current_solution=merge_8)

# ==== cluster AsymmetricalLoadPatterns
mesh = ClusterInput()
load_kn_m2 = ClusterInput()
int = ClusterInput()
mjoin = MeshJoin(Meshes=mesh)
mesh_2 = Mesh(simplify(graft(mesh)))
load_kn_m2_2 = Number(load_kn_m2)
int_2 = Integer(int)
bbox = BoundingBox(Content=flatten(mesh_2), Plane=PlaneXY(0, 0, 0), UnionBox=True)  # -> Box, Box_2
image = ImageSampler(Filter="Colour", Interpolate=False, Umax=1, Umin=0, Vmax=1, Vmin=0, Wrap=1)
faceb = FaceBoundaries(Mesh=mesh_2)  # -> simplify(Boundaries)
box = EvaluateBox(Box=bbox.Box, UParameter=0.5, VParameter=0.5, WParameter="1")  # -> Plane, simplify(Point), Include
pattern_domains = PatternDomains(G=int_2)
area = Area(Geometry=faceb)  # -> Area, Centroid
sph = Sphere(Base=box.Plane, Radius=Slider(2, range=0..10))
data = Data(flatten(pattern_domains))
dom² = ConstructDomain²(DomainU=data, DomainV="0 To Pi")
pt = Point(simplify(graft(area.Centroid)))
subsrf = Isotrim(Surface=sph, Domain=dom²)
polar = ToPolar(Point=pt, System=box.Plane)  # -> simplify(Phi), Theta, Radius
inc = Includes(Value=polar.Phi, Domain=data)  # -> Includes, Deviation
wh_value_for_live_load = Panel("3.5")
ma = MassAddition(Input=inc.Includes)  # -> Result, PartialResults
bool = Boolean(ma.Result)
multiplication = Multiplication(A=load_kn_m2_2, C=bool)
dispatch = Dispatch(List=pt, DispatchPattern=bool)  # -> ListA, ListB
live_load_kn_m2_per_face = Number(multiplication)
outside = Point(dispatch.ListB)
inside = Point(dispatch.ListA)
Z = UnitZ(Factor=live_load_kn_m2_per_face)
pt_2 = Point(simplify(area.Centroid))
mesh_3 = Mesh(mesh_2)
rev = Reverse(Vector=Z)  # -> flatten(Vector)
vdis = VectorDisplay(Anchor=pt_2, Vector=rev)
loads = LoadsKaramba3D(Vectors=rev, Mesh=mesh_3, mode="MeshLoad -Variable", menu=[buttons(off, off, on), buttons(on, on)])
load = LoadKaramba3D(flatten(loads))
load_2 = ClusterOutput(load)

# ==== cluster PercentileStress
model = ClusterInput()
percentile = ClusterInput()
include_2nd_ps = ClusterInput()
model_2 = ModelKaramba3D(model)
shellvecresults = ResultVectorsOnShellsKaramba3D(AnalyzedModel=model_2, LayerPosition="1", mode="PrincStress")  # -> AnalyzedModel, Points, FirstPrincipalStressVector_kN_cm2, SecondPrincipalStressVector_kN_cm2, FirstPrincipalStressValue_kN_cm2, SecondPrincipalStressValue_kN_cm2
shellvecresults_2 = ResultVectorsOnShellsKaramba3D(AnalyzedModel=model_2, LayerPosition="-1", mode="PrincStress")  # -> AnalyzedModel, Points, FirstPrincipalStressVector_kN_cm2, SecondPrincipalStressVector_kN_cm2, FirstPrincipalStressValue_kN_cm2, SecondPrincipalStressValue_kN_cm2
include_2nd_ps_2 = Boolean(include_2nd_ps)
panel = Panel("""Index
Stress [kN/cm2]""")
lng = ListLength(List=shellvecresults_2.FirstPrincipalStressValue_kN_cm2)
series = Series(Start=0, Step=1, Count=lng)  # -> simplify(Series)
entwine = Entwine(
    Branch00=shellvecresults_2.FirstPrincipalStressValue_kN_cm2,
    Branch01=shellvecresults_2.SecondPrincipalStressValue_kN_cm2,
    Branch02=shellvecresults.FirstPrincipalStressValue_kN_cm2,
    Branch03=shellvecresults.SecondPrincipalStressValue_kN_cm2,
    FlattenInputs=True)  # -> simplify(Result)
number_slider = Slider(0, range=0..3)
sort = SortList(Keys=entwine, ValuesA=series)  # -> Keys, ValuesA
entwine_2 = Entwine(Branch0X=sort.ValuesA, Branch1X=sort.Keys, FlattenInputs=False)
subset = SubList(List=entwine_2, Domain=Slider(5, range=0..10), Wrap=True)  # -> simplify(List), Index
item = ListItem(List=entwine_2, Index=0, Wrap=True)
panel_2 = Panel(subset.List)
merge = Merge(
    Data1=shellvecresults_2.FirstPrincipalStressValue_kN_cm2,
    Data2=shellvecresults.FirstPrincipalStressValue_kN_cm2,
    Data3=shellvecresults_2.SecondPrincipalStressValue_kN_cm2,
    Data4=shellvecresults.SecondPrincipalStressValue_kN_cm2)
merge_2 = Merge(Data1=shellvecresults_2.FirstPrincipalStressValue_kN_cm2, Data2=shellvecresults.FirstPrincipalStressValue_kN_cm2)
filter = StreamFilter(Gate=include_2nd_ps_2, Stream0=merge_2, Stream1=merge)
shellview = ShellViewKaramba3D(Model=shellvecresults_2.AnalyzedModel, IndexOfLayer=0)  # -> Model, MeshesOfRenderedShells, LegendColors, LegendTags
stress_values = Number(filter)
int = Integer("580")
lng_2 = ListLength(List=shellvecresults_2.FirstPrincipalStressValue_kN_cm2)
panel_3 = Panel("4")
item_2 = ListItem(List=reverse(sort.Keys), Index=0, Wrap=True)
item_3 = ListItem(List=reverse(sort.ValuesA), Index=0, Wrap=True)
item_4 = ListItem(List=sort.ValuesA, Index=0, Wrap=True)
item_5 = ListItem(List=sort.Keys, Index=0, Wrap=True)
series_2 = Series(Start=0, Step=1, Count=lng_2)  # -> simplify(Series)
lng_3 = ListLength(List=stress_values)
demesh = DeconstructMesh(Mesh=shellview.MeshesOfRenderedShells)  # -> Vertices, Faces, Colours, Normals
percentile_2 = Number(percentile)
flatten = FlattenTree(Tree=item_4, Path="{0}")
item_6 = ListItem(List=entwine, Index=int, Wrap=True)
item_7 = ListItem(List=demesh.Faces, Index=int, Wrap=True)
repeat = RepeatData(Data=series_2, Length=lng_3)
max_compression_stress = Panel(item_4)
max_tension_stress_element = Panel(item_3)
conmesh = ConstructMesh(Vertices=demesh.Vertices, Faces=item_7, Colours=ColourSwatch(SwatchColor=RGB(0, 0, 0)))
# Bottom Sig1
# Bottom Sig2
# Top Sig1
# Top Sig2
panel_4 = Panel(item_6)
area = Area(Geometry=conmesh)  # -> Area, Centroid
max_compression_stress_2 = Panel(item_5)
sort_2 = SortList(Keys=stress_values, ValuesA=repeat)  # -> Keys, ValuesA
cir = Circle(Plane=area.Centroid, Radius=1)
Z = UnitZ(Factor=1)
max_tension_stress_value = Panel(item_2)
move = Move(Geometry=cir, Motion=Z)  # -> Geometry, Transform
division = Division(A=percentile_2, B=100)
subtraction = Subtraction(A="1", B=division)
lng_4 = ListLength(List=sort_2.Keys)
graph = QuickGraph(sort_2.Keys, SortOrder=0)
remap = RemapNumbers(Value=subtraction, Source=Domain(0, 1), Target=lng_4)  # -> Mapped, Clipped
sorted_element_s = Integer(sort_2.ValuesA)
panel_5 = Panel(sort_2.Keys)
elements_top_1 = Integer(remap.Mapped)
subtraction_2 = Subtraction(A=lng_4, B=elements_top_1)
dom = ConstructDomain(DomainStart=elements_top_1, DomainEnd=subtraction_2)
dom_2 = ConstructDomain(DomainStart="0", DomainEnd=elements_top_1)
subset_2 = SubList(List=sort_2.Keys, Domain=dom, Wrap=True)  # -> List, Index
subset_3 = SubList(List=reverse(sorted_element_s), Domain=dom_2, Wrap=True)  # -> List, Index
subset_4 = SubList(List=sorted_element_s, Domain=dom_2, Wrap=True)  # -> List, Index
shellview_2 = ShellViewKaramba3D(Model=shellvecresults_2.AnalyzedModel, IndexOfLayer=0)  # -> Model, MeshesOfRenderedShells, LegendColors, LegendTags
element_s_for_top_tension = Integer(subset_3.List)
element_s_for_top_comp = Integer(subset_4.List)
graph_2 = QuickGraph(subset_2.List, SortOrder=0)
demesh_2 = DeconstructMesh(Mesh=shellview_2.MeshesOfRenderedShells)  # -> Vertices, Faces, Colours, Normals
item_8 = ListItem(List=reverse(sort_2.Keys), Index="0", Wrap=True)
item_9 = ListItem(List=sort_2.Keys, Index="0", Wrap=True)
item_10 = ListItem(List=reverse(subset_2.List), Index=0, Wrap=True)
item_11 = ListItem(List=subset_2.List, Index=0, Wrap=True)
panel_6 = Panel(element_s_for_top_comp)
item_12 = ListItem(List=demesh_2.Faces, Index=element_s_for_top_tension, Wrap=True)
item_13 = ListItem(List=demesh_2.Faces, Index=element_s_for_top_comp, Wrap=True)
panel_7 = Panel(item_9)
panel_8 = Panel(item_8)
panel_9 = Panel(item_10)
panel_10 = Panel(item_11)
max_comp_stress_kn_cm2 = Number(item_9)
max_comp_stress_kn_cm2_2 = Number(item_11)
max_tens_stress_kn_cm2 = Number(item_10)
max_tens_stress_kn_cm2_2 = Number(item_8)
conmesh_2 = ConstructMesh(Vertices=demesh_2.Vertices, Faces=item_13, Colours=ColourSwatch(SwatchColor=RGB(255, 0, 0)))
conmesh_3 = ConstructMesh(Vertices=demesh_2.Vertices, Faces=item_12, Colours=ColourSwatch(SwatchColor=RGB(0, 102, 255)))
multiplication = Multiplication(A=max_comp_stress_kn_cm2, B="10")
multiplication_2 = Multiplication(A=max_tens_stress_kn_cm2, B="10")
multiplication_3 = Multiplication(A=max_tens_stress_kn_cm2_2, B="10")
merge_3 = Merge(Data1=conmesh_2, Data2=conmesh_3)
multiplication_4 = Multiplication(A=max_comp_stress_kn_cm2_2, B="10")
max_comp_stress_mpa = Number(multiplication)
max_tens_stress_mpa = Number(multiplication_2)
max_tens_stress_mpa_2 = Number(multiplication_3)
extreme_stress_elements = Mesh(merge_3)
max_comp_stress_mpa_2 = Number(multiplication_4)
max_comp_stress_mpa_3 = ClusterOutput(max_comp_stress_mpa)
max_tens_stress_mpa_3 = ClusterOutput(max_tens_stress_mpa_2)
extreme_stress_elements_2 = ClusterOutput(extreme_stress_elements)
max_tens_stress_mpa_4 = ClusterOutput(max_tens_stress_mpa)
max_comp_stress_mpa_4 = ClusterOutput(max_comp_stress_mpa_2)

# ==== cluster Make2DGraph
current_solution = ClusterInput()
selected_parameter_x_axis = ClusterInput()
graph_origin = ClusterInput()
selected_result_y_axis = ClusterInput()
parameter_labels = ClusterInput()
design_space_vectors = ClusterInput()
all_results = ClusterInput()
result_labels = ClusterInput()
reference_values = ClusterInput()
selected_parameter_x_axis_2 = Integer(selected_parameter_x_axis)
current_solution_2 = Data(current_solution)
graph_origin_2 = Point(graph_origin)
selected_result_y_axis_2 = Integer(selected_result_y_axis)
parameter_labels_2 = Text(parameter_labels)
design_space_vectors_2 = Data(design_space_vectors)
all_results_2 = Number(all_results)
result_labels_2 = Text(result_labels)
reference_values_2 = Text(reference_values)
item = ListItem(List=reference_values_2, Index=selected_result_y_axis_2, Wrap=True)
item_2 = ListItem(List=result_labels_2, Index=selected_result_y_axis_2, Wrap=True)
item_3 = ListItem(List=parameter_labels_2, Index=selected_parameter_x_axis_2, Wrap=True)
params = Number(simplify(graft(current_solution_2)))
closest_solution = ClosestSolution(params_current_solution=params, ds_coords=design_space_vectors_2)  # -> index_curr_vector_2, design_vector_2
panel = Panel(current_solution_2)
section_ds = SectionDS(design_vector=closest_solution.design_vector_2, design_space=design_space_vectors_2, dims=selected_parameter_x_axis_2)
tstat = TreeStatistics(Tree=section_ds)  # -> Paths, Length, Count
branch = TreeBranch(Tree=all_results_2, Path=tstat.Paths, MaintainPaths=True)
panel_2 = Panel(section_ds)
transform_points_to_landscape = TransformPointsToLandscape(
    dim_labels=parameter_labels_2,
    dimensons_for_variation=selected_parameter_x_axis_2,
    sectioned_data=section_ds,
    results=all_results_2,
    result_label=item_2,
    result_int=selected_result_y_axis_2)  # -> fixed_2, labels_2, transformed_points_2
panel_3 = Panel(branch)
int_curr_solution = Integer(closest_solution.index_curr_vector_2)
number_slider = Slider(0.5, range=0..1)
number_slider_2 = Slider(6, range=0..20)
panel_4 = Panel("2.5")
selected_parameter = Text(item_3)
reference_value = Text(item)
selected_result = Text(item_2)
_2d_graph = _2DGraph(
    labels=transform_points_to_landscape.labels_2,
    fixed=transform_points_to_landscape.fixed_2,
    graph_origin=graph_origin_2,
    ref_value=item,
    original_points=transform_points_to_landscape.transformed_points_2,
    target_grid_line=Slider(10, range=0..30))  # -> mesh_2, transformed_points_2
pt = Point(transform_points_to_landscape.transformed_points_2)
concat = Concatenate(FragmentA="selected parameter (X axis): ", FragmentB=selected_parameter)
concat_2 = Concatenate(FragmentA="selected result (Y axis): ", FragmentB=selected_result)
concat_3 = Concatenate(FragmentA="result reference value: ", FragmentB=reference_value)
merge = Merge(Data1=concat, Data2=concat_2, Data3=concat_3)
pt_2 = Point(_2d_graph.transformed_points_2)
min_point = MinPoint(transformed_points=_2d_graph.transformed_points_2)  # -> min_point_2, min_id_2
curr_point = CurrPoint(transformed_points=_2d_graph.transformed_points_2, int_curr_solution=int_curr_solution)
panel_5 = Panel(merge)
out = Text(merge)
panel_6 = Panel("C:\Users\ec977\Documents\_Rhino Frames\20200602-SIMPLEcull20\Frame_00")
vector_value = VectorValue(curr_point=curr_point, original_points=pt, int_curr_solution=int_curr_solution, above=Toggle(False))
curr_thumbnail = CurrThumbnail(folder_file=panel_6, curr_point=curr_point, int_curr_solution=int_curr_solution)
min_value = MinValue(curr_point=min_point.min_point_2, original_points=pt, int_curr_solution=min_point.min_id_2)
out_2 = ClusterOutput(out)

# ==== cluster PatternDomains

# ---- group: pattern 5
number_slider = Slider(0, range=0..10)
number_slider_2 = Slider(2, range=0..10)
addition = Addition(A=number_slider, B="2")
series = Series(Start=addition, Step="4", Count=number_slider_2)
series_2 = Series(Start=number_slider, Step="4", Count=number_slider_2)
multiplication = Multiplication(A=series_2, B=".25")
multiplication_2 = Multiplication(A=series, B=".25")
pi = Pi(Factor=multiplication_2)
pi_2 = Pi(Factor=multiplication)
panel = Panel(pi_2)
panel_2 = Panel(pi)
dom = ConstructDomain(DomainStart=panel, DomainEnd=panel_2)  # -> graft(Domain)

# ---- group: pattern 6
number_slider_3 = Slider(0, range=0..10)
number_slider_4 = Slider(4, range=0..10)
addition_2 = Addition(A=number_slider_3, B="1")
series_3 = Series(Start=addition_2, Step="2", Count=number_slider_4)
series_4 = Series(Start=number_slider_3, Step="2", Count=number_slider_4)
multiplication_3 = Multiplication(A=series_4, B=".25")
multiplication_4 = Multiplication(A=series_3, B=".25")
pi_3 = Pi(Factor=multiplication_4)
pi_4 = Pi(Factor=multiplication_3)
panel_3 = Panel(pi_4)
panel_4 = Panel(pi_3)
dom_2 = ConstructDomain(DomainStart=panel_3, DomainEnd=panel_4)  # -> graft(Domain)

# ---- group: pattern 4
number_slider_5 = Slider(1, range=0..10)
number_slider_6 = Slider(2, range=0..10)
addition_3 = Addition(A=number_slider_5, B="2")
series_5 = Series(Start=addition_3, Step="4", Count=number_slider_6)
series_6 = Series(Start=number_slider_5, Step="4", Count=number_slider_6)
multiplication_5 = Multiplication(A=series_6, B=".25")
multiplication_6 = Multiplication(A=series_5, B=".25")
pi_5 = Pi(Factor=multiplication_6)
pi_6 = Pi(Factor=multiplication_5)
panel_5 = Panel(pi_6)
panel_6 = Panel(pi_5)
dom_3 = ConstructDomain(DomainStart=panel_5, DomainEnd=panel_6)  # -> graft(Domain)

# ---- group: pattern 1
multiplication_7 = Multiplication(A=Slider(0, range=0..10), B=".25")
multiplication_8 = Multiplication(A=Slider(0, range=0..10), B=".25")
pi_7 = Pi(Factor=multiplication_7)
pi_8 = Pi(Factor=multiplication_8)
panel_7 = Panel(pi_7)
panel_8 = Panel(pi_8)
dom_4 = ConstructDomain(DomainStart=panel_7, DomainEnd=panel_8)

# ---- group: pattern 2
multiplication_9 = Multiplication(A=Slider(2, range=0..10), B=".25")
multiplication_10 = Multiplication(A=Slider(6, range=0..10), B=".25")
pi_9 = Pi(Factor=multiplication_9)
pi_10 = Pi(Factor=multiplication_10)
panel_9 = Panel(pi_9)
panel_10 = Panel(pi_10)
dom_5 = ConstructDomain(DomainStart=panel_9, DomainEnd=panel_10)

# ---- group: pattern 3
multiplication_11 = Multiplication(A=Slider(1, range=0..10), B=".25")
multiplication_12 = Multiplication(A=Slider(5, range=0..10), B=".25")
pi_11 = Pi(Factor=multiplication_11)
pi_12 = Pi(Factor=multiplication_12)
panel_11 = Panel(pi_11)
panel_12 = Panel(pi_12)
dom_6 = ConstructDomain(DomainStart=panel_11, DomainEnd=panel_12)

# ---- group: pattern 7
multiplication_13 = Multiplication(A=Slider(0, range=0..10), B=".25")
multiplication_14 = Multiplication(A=Slider(8, range=0..10), B=".25")
pi_13 = Pi(Factor=multiplication_13)
pi_14 = Pi(Factor=multiplication_14)
panel_13 = Panel(pi_13)
panel_14 = Panel(pi_14)
dom_7 = ConstructDomain(DomainStart=panel_13, DomainEnd=panel_14)

# ----
G = ClusterInput()
filter = StreamFilter(Gate=G, Stream1=dom_4, Stream2=dom_5, Stream3=dom_6, Stream4=dom, Stream5=dom_3, Stream6=dom_2, Stream7=dom_7)
s_2 = ClusterOutput(filter)

# ==== cluster CurrPoint
transformed_points = ClusterInput()
int_curr_solution = ClusterInput()
transformed_points_2 = Point(transformed_points)
int_curr_solution_2 = Integer(int_curr_solution)
branch = TreeBranch(Tree=transformed_points_2, Path=int_curr_solution_2, MaintainPaths=True)
curr_point = Point(branch)
curr_point_2 = ClusterOutput(curr_point)

# ==== cluster VectorValue
int_curr_solution = ClusterInput()
original_points = ClusterInput()
curr_point = ClusterInput()
above = ClusterInput()
original_points_2 = Point(original_points)
curr_point_2 = Point(curr_point)
int_curr_solution_2 = Integer(int_curr_solution)
number_slider = Slider(0.222, range=0..1)
above_2 = Boolean(above)
branch = TreeBranch(Tree=original_points_2, Path=int_curr_solution_2, MaintainPaths=True)
pdecon = Deconstruct(Point=branch)  # -> XComponent, YComponent, ZComponent
neg = Negative(Value=number_slider)
expression = Expression(x=pdecon.ZComponent, Expression="Format(\"{0:0.00}\", x)")
filter = StreamFilter(Gate=above_2, Stream0=neg, Stream1=number_slider)
Z = UnitZ(Factor=filter)
concat = Concatenate(FragmentA="curr: ", FragmentB=expression)
move = Move(Geometry=curr_point_2, Motion=Z)  # -> Geometry, Transform
tag = TextTag(Location=move.Geometry, Text=concat)

# ==== cluster ClosestSolution
params_current_solution = ClusterInput()
ds_coords = ClusterInput()
params_current_solution_2 = Number(params_current_solution)
ds_coords_2 = Data(simplify(ds_coords))
flip = FlipMatrix(Data=ds_coords_2)
cset = CreateSet(List=flip)  # -> Set, Map
fsim = FindSimilarMember(Data=params_current_solution_2, Set=cset.Set)  # -> Hit, Index
equals = Equality(FirstNumber=flatten(fsim.Hit), SecondNumber=ds_coords_2)  # -> Equality, Inequality
panel = Panel(equals.Equality)
mass_and = MassAND(bool=equals.Equality)
dispatch = Dispatch(List=ds_coords_2, DispatchPattern=mass_and)  # -> ListA, ListB
clean = CleanTree(RemoveNulls=True, RemoveInvalid=True, RemoveEmpty=Toggle(True), Tree=dispatch.ListA)
item = ListItem(List=clean, Index=0, Wrap=True)  # -> Item, Item1, Item2, Item3
tstat = TreeStatistics(Tree=clean)  # -> Paths, Length, Count
pt = ConstructPoint(XCoordinate=item.Item1, YCoordinate=item.Item2, ZCoordinate=item.Item3)
dpath = DeconstructPath(Branch=tstat.Paths)
sph = Sphere(Base=pt, Radius=Slider(0.018, range=0..0.1))
index_curr_vector = Integer(dpath)
design_vector = Data(clean)
index_curr_vector_2 = ClusterOutput(index_curr_vector)
design_vector_2 = ClusterOutput(design_vector)

# ==== cluster _2DGraph
original_points = ClusterInput()
ref_value = ClusterInput()
original_points_2 = Point(original_points)
ref_value_2 = Number(ref_value)
bbox = BoundingBox(Content=flatten(original_points_2), Plane=PlaneXY(0, 0, 0), UnionBox=True)  # -> Box, Box_2
pdecon = Deconstruct(Point=flatten(original_points_2))  # -> XComponent, YComponent, ZComponent
cset = CreateSet(List=pdecon.XComponent)  # -> Set, Map
cset_2 = CreateSet(List=pdecon.YComponent)  # -> Set, Map
cset_3 = CreateSet(List=pdecon.ZComponent)  # -> Set, Map
bnd = Bounds(Numbers=cset_3.Set)
domain = Domain(bnd)
target_grid_line = ClusterInput()
graph_origin = ClusterInput()
target_grid_line_2 = Integer(target_grid_line)
graph_origin_2 = Point(graph_origin)
grid_spacing = GridSpacing(domain=domain, target_grid_line=target_grid_line_2)
scale = Slider(5, range=0..10)
yz = YZPlane(Origin=graph_origin_2)
pflip = FlipPlane(Plane=yz, ReverseX=Toggle(True), ReverseY=False, SwapAxes=True)
neg = Negative(Value=scale)
planesrf = PlaneSurface(Plane=pflip, XSize=scale, YSize=neg)
planesrf_2 = PlaneSurface(Plane=yz, XSize=scale, YSize=scale)
dedomain = DeconstructDomain(Domain=domain)  # -> Start, End
merge = Merge(Data1=planesrf_2, Data2=planesrf)
sporph = Sporph(G=original_points_2, S0=bbox.Box, P0="0,0", S1=planesrf_2, P1="0,0", R=False)
transformed_points = Point(sporph)
debox = DeconstructBox(Box=bbox.Box)  # -> Plane, X, Y, Z
entwine = Entwine(Branch00=debox.X, Branch01=debox.Z, FlattenInputs=True)  # -> simplify(Result)
panel = Panel(entwine)
transformed_points_2 = ClusterOutput(transformed_points)
labels = ClusterInput()
dom = ConstructDomain(DomainStart=0, DomainEnd=1)
fixed = ClusterInput()
graph_surface = Surface(simplify(graft(merge)))
labels_2 = Text(labels)
fixed_2 = Text(fixed)
join = TextJoin(Text=flatten(fixed_2), Join="  /  ")
graph_surface_2 = Surface(merge)
transformed_points_3 = Point(transformed_points)
panel_2 = Panel(join)
md_slider = MDSlider(
    SliderMode=0,
    slider_value=Point(0.4988090701, 0, 0.5),
    x_domain=Domain(0, 1),
    y_domain=Domain(0, 1),
    z_domain=Domain(0, 1))
md_slider_2 = MDSlider(
    SliderMode=0,
    slider_value=Point(0.5026438643, 1, 0.5),
    x_domain=Domain(0, 1),
    y_domain=Domain(0, 1),
    z_domain=Domain(0, 1))
md_slider_3 = MDSlider(
    SliderMode=0,
    slider_value=Point(0.4988090701, 1, 0.5),
    x_domain=Domain(0, 1),
    y_domain=Domain(0, 1),
    z_domain=Domain(0, 1))
flip = FlipMatrix(Data=transformed_points_3)
shift = ShiftList(List=graph_surface_2, Shift=Slider(0, range=0..10), Wrap=True)  # -> simplify(graft(List))
bang = ExplodeTree(Data=shift)  # -> Branch0, Branch1
rdpoints = RemoveDuplicatePointsKaramba3D(Point=flip, LimitDistance=0.005)  # -> OutPoint, Info, Indexes
evalsrf = EvaluateSurface(Surface=reparameterize(bang.Branch1), Point=md_slider_2)  # -> Point, Normal, UDirection, VDirection, Frame
evalsrf_2 = EvaluateSurface(Surface=reparameterize(bang.Branch0), Point=md_slider)  # -> Point, Normal, UDirection, VDirection, Frame
evalsrf_3 = EvaluateSurface(Surface=reparameterize(bang.Branch0), Point=md_slider_3)  # -> Point, Normal, UDirection, VDirection, Frame
ref_value_3 = Number(ref_value_2)
deplane = DeconstructPlane(Plane=evalsrf.Frame)  # -> Origin, XAxis, YAxis, ZAxis
pt = Point(rdpoints.OutPoint)
number_slider = Slider(0.187, range=0..1)
number_slider_2 = Slider(0.331, range=0..1)
deplane_2 = DeconstructPlane(Plane=evalsrf_2.Frame)  # -> Origin, XAxis, YAxis, ZAxis
expression = Expression(x=ref_value_3, Expression="Format(\"{0:0.00}\", x)")
deplane_3 = DeconstructPlane(Plane=evalsrf_3.Frame)  # -> Origin, XAxis, YAxis, ZAxis
project = Project(Geometry=pt, Plane=PlaneXY(0, 0, 0))  # -> Geometry, Transform
amp = Amplitude(Vector=deplane.YAxis, Amplitude=Slider(0.875, range=0..1))
swatch = ColourSwatch(SwatchColor=RGB(255, 0, 0))
amp_2 = Amplitude(Vector=deplane_2.YAxis, Amplitude=Slider(0.449, range=0..1))
rev = Reverse(Vector=amp)
amp_3 = Amplitude(Vector=deplane_3.YAxis, Amplitude=Slider(0.525, range=0..1))
rev_2 = Reverse(Vector=amp_2)
rev_3 = Reverse(Vector=amp_3)
merge_2 = Merge(Data1=pt, Data2=project.Geometry)
lng = ListLength(List=project.Geometry)
Z = UnitZ(Factor=Slider(0.154, range=0..1))
move = Move(Geometry=evalsrf_2.Frame, Motion=rev_2)  # -> flatten(Geometry), Transform
swatch_2 = ColourSwatch(SwatchColor=RGB(128, 128, 128))
move_2 = Move(Geometry=evalsrf.Frame, Motion=amp)  # -> flatten(Geometry), Transform
move_3 = Move(Geometry=evalsrf_3.Frame, Motion=amp_3)  # -> flatten(Geometry), Transform
number_slider_3 = Slider(0.178, range=0..1)
frompoints = MeshFromPoints(Points=merge_2, UDirection="2", VDirection=lng)
concat = Concatenate(FragmentA="ref. value = ", FragmentB=expression)
merge_3 = Merge(Data1=move.Geometry, Data2=move_2.Geometry)
unifynormals = MeshUnifyNormals(Mesh=frompoints)
item = ListItem(List=move.Geometry, Index=0, Wrap=True)
item_2 = ListItem(List=move_3.Geometry, Index=0, Wrap=True)
tag = TextTag3D(Location=item_2, Text=join, Size=number_slider_3, Justification=5)

# ----
# if ref value is out of bounds, don't add (or just add lower bound, which is indiferent)
ref_value_4 = Number(ref_value_2)
inc = Includes(Value=ref_value_4, Domain=domain)  # -> Includes, Deviation
sort = SortList(Keys=grid_spacing)  # -> Keys, ValuesA
item_3 = ListItem(List=reverse(sort.Keys), Index=0, Wrap=True)
item_4 = ListItem(List=sort.Keys, Index=0, Wrap=True)

c_script = CSharpScript(reference=ref_value_4, domain=domain)  # -> out, A; inputs reference: Double
# ---------- c_script: C# ----------
    A = 1;
    if (reference < domain.Min) A = 0;
    if (reference > domain.Max) A = 2;
# ---------- end c_script ----------

filter = StreamFilter(Gate=c_script.A, Stream0=item_4, Stream1=ref_value_4, Stream2=item_3)

merge_4 = Merge(Data1=filter, Data2=grid_spacing)
entwine_2 = Entwine(Branch00=cset.Set, Branch01=merge_4, FlattenInputs=True)  # -> simplify(Result)
remap = RemapNumbers(Value=entwine_2, Source=entwine, Target=dom)  # -> Mapped, Clipped
pt_2 = ConstructPoint(XCoordinate=remap.Mapped, YCoordinate=0, ZCoordinate=0)
evalsrf_4 = EvaluateSurface(Surface=reparameterize(graph_surface), Point=pt_2)  # -> Point, Normal, UDirection, VDirection, Frame
pl = ConstructPlane(Origin=evalsrf_4.Point, XAxis=evalsrf_4.VDirection, YAxis=evalsrf_4.Normal)
sec = BrepPlane(Brep=graph_surface, Plane=pl)  # -> Curves, Points
grid_lines = Curve(sec.Curves)
join_2 = JoinCurves(Curves=grid_lines, Preserve=False)
trim = TrimTree(Tree=simplify(join_2), Depth=1)
trim_2 = TrimTree(Tree=grid_lines, Depth=1)
explode = Explode(Curve=trim, Recursive=True)  # -> Segments, Vertices
item_5 = ListItem(List=trim, Index="1", Wrap=True)
lng_2 = ListLength(List=trim)
bang_2 = ExplodeTree(Data=trim_2)  # -> Branch0, Branch1
repeat = RepeatData(Data=item_5, Length=lng_2)  # -> simplify(graft(Data))
horizontal_grid_lines = Curve(bang_2.Branch1)
vertical_grid_lines = Curve(bang_2.Branch0)
alongcrv = SortAlongCurve(Points=explode.Vertices, Curve=repeat)  # -> Points, Indices
adaptable_decimal_places = AdaptableDecimalPlaces(num=entwine_2)
bang_3 = ExplodeTree(Data=entwine_2)  # -> Branch0, Branch1
pline = PolyLine(Vertices=alongcrv.Points, Closed=False)  # -> simplify(Polyline)
item_6 = ListItem(List=horizontal_grid_lines, Index="0", Wrap=True)
cull_i = CullIndex(List=horizontal_grid_lines, Indices="0", Wrap=True)
expression_2 = Expression(x=bang_3.Branch1, Expression="Format(\"{0:0.00}\", x)")
trim_3 = TrimTree(Tree=pline, Depth=1)
expression_3 = Expression(x=bang_3.Branch0, Expression="Format(\"{0:0}\", x)")
ref_grid_line = Curve(item_6)
merge_5 = Merge(Data1=vertical_grid_lines, Data2=cull_i)
bang_4 = ExplodeTree(Data=trim_3)  # -> Branch0, Branch1
midpt = CurveMiddle(Curve=ref_grid_line)
entwine_3 = Entwine(Branch00=expression_3, Branch01=expression_2, FlattenInputs=True)  # -> simplify(Result)
ext = ExtendCurve(Curve=bang_4.Branch0, Type=0, Start=number_slider, End=number_slider)
ext_2 = ExtendCurve(Curve=bang_4.Branch1, Type=0, Start=number_slider_2, End=number_slider_2)
dash = DashPattern(Curve=simplify(ref_grid_line), Pattern=Slider(0.1, range=0..1))  # -> Dashes, Gaps
move_4 = Move(Geometry=midpt, Motion=Z)  # -> Geometry, Transform
end = EndPoints(Curve=ext_2)  # -> Start, End
end_2 = EndPoints(Curve=ext)  # -> Start, End
merge_6 = Merge(Data1=end_2.End, Data2=end.Start)
labels_3 = Text(entwine_3)
preview = CustomPreview(Geometry=dash.Dashes, Material=swatch)
preview_2 = CustomPreview(Geometry=merge_5, Material=swatch_2)

mesh = Mesh(unifynormals)
tag_2 = TextTag(Location=move_4.Geometry, Text=concat, Colour=swatch)
tag_3 = TextTag3D(Location=merge_3, Text=labels_2, Size=number_slider_3, Justification=5)
tag_4 = TextTag(Location=merge_6, Text=labels_3, Colour=swatch_2)

mesh_2 = ClusterOutput(mesh)

# ==== cluster TransformPointsToLandscape
dimensons_for_variation = ClusterInput()
sectioned_data = ClusterInput()
result_label = ClusterInput()
results = ClusterInput()
result_int = ClusterInput()
dimensons_for_variation_2 = Integer(dimensons_for_variation)
sectioned_data_2 = Data(sectioned_data)
panel = Panel(sectioned_data_2)
dim_labels = ClusterInput()
result_label_2 = Text(result_label)
results_2 = Number(results)
result_int_2 = Integer(result_int)
tstat = TreeStatistics(Tree=sectioned_data_2)  # -> Paths, Length, Count
item = ListItem(List=sectioned_data_2, Index=dimensons_for_variation_2, Wrap=True)
lng = ListLength(List=dimensons_for_variation_2)
dim_labels_2 = Text(dim_labels)
gate = StreamGate(Stream=item, Gate=lng)  # -> Target0, Target1, Target2
item_2 = ListItem(List=dim_labels_2, Index=dimensons_for_variation_2, Wrap=True)
num2pt = NumbersToPoints(Numbers=gate.Target1, Mask=1)
num2pt_2 = NumbersToPoints(Numbers=gate.Target2, Mask=2)
branch = TreeBranch(Tree=results_2, Path=tstat.Paths, MaintainPaths=True)
merge = Merge(Data1=num2pt, Data2=num2pt_2)  # -> simplify(Result)
merge_2 = Merge(Data1=item_2, Data2=result_label_2)
panel_2 = Panel(merge_2)
pdecon = Deconstruct(Point=merge)  # -> XComponent, YComponent, ZComponent
item_3 = ListItem(List=branch, Index=result_int_2, Wrap=True)
pt = ConstructPoint(XCoordinate=pdecon.XComponent, YCoordinate=pdecon.YComponent, ZCoordinate=item_3)
transformed_points = Point(pt)
labels = Text(merge_2)
labels_2 = ClusterOutput(labels)
transformed_points_2 = ClusterOutput(transformed_points)

# ---- group: find fixed variable
panel_3 = Panel("""0
1
2""")
fsim = FindSimilarMember(Data=dimensons_for_variation_2, Set=panel_3)  # -> Hit, Index
cull_i = CullIndex(List=panel_3, Indices=fsim.Index, Wrap=True)
item_4 = ListItem(List=sectioned_data_2, Index=cull_i, Wrap=True)
item_5 = ListItem(List=dim_labels_2, Index=cull_i, Wrap=True)

# ----
branch_2 = TreeBranch(Tree=simplify(item_4), Path="0", MaintainPaths=True)

# ---- group: find fixed variable (continued)
item_6 = ListItem(List=branch_2, Index=0, Wrap=True)
expression = Expression(x=branch_2, Expression="Format(\"{0:0}\", x)")
concat = Concatenate(FragmentA=item_5, FragmentB=" = ", FragmentC=expression)
panel_4 = Panel(concat)

# ----
fixed = Text(concat)
fixed_2 = ClusterOutput(fixed)

# ==== cluster SectionDS
dims = ClusterInput()
design_space = ClusterInput()
design_vector = ClusterInput()
design_space_2 = Data(simplify(design_space))
dims_2 = Integer(dims)
design_vector_2 = Data(graft(design_vector))
item = ListItem(List=design_space_2, Index=0, Wrap=True)  # -> Item, Item1, Item2, Item3
flip = FlipMatrix(Data=design_space_2)
pt = ConstructPoint(XCoordinate=item.Item1, YCoordinate=item.Item2, ZCoordinate=item.Item3)
cset = CreateSet(List=flip)  # -> Set, Map
fsim = FindSimilarMember(Data=design_vector_2, Set=cset.Set)  # -> Hit, Index
trim = TrimTree(Tree=fsim.Hit, Depth=1)
equals = Equality(FirstNumber=trim, SecondNumber=design_space_2)  # -> Equality, Inequality
bool = Boolean(equals.Equality)
cull_i = CullIndex(List=bool, Indices=simplify(dims_2), Wrap=True)  # -> simplify(List)

# ---- group: check for what?
null = NullItem(Item=dims_2)  # -> NullFlags, InvalidFlags, Description
item_2 = ListItem(List=null.NullFlags, Index=0, Wrap=True)
filter = StreamFilter(Gate=item_2, Stream0=cull_i, Stream1=bool)

# ----
mass_or = MassOR(A=filter)
dispatch = Dispatch(List=design_space_2, DispatchPattern=mass_or)  # -> ListA, ListB
clean = CleanTree(RemoveNulls=True, RemoveInvalid=True, RemoveEmpty=Toggle(True), Tree=dispatch.ListA)
item_3 = ListItem(List=clean, Index=0, Wrap=True)  # -> Item, Item1, Item2, Item3
pt_2 = ConstructPoint(XCoordinate=item_3.Item1, YCoordinate=item_3.Item2, ZCoordinate=item_3.Item3)
T = ClusterOutput(clean)

# ==== cluster MinPoint
transformed_points = ClusterInput()
transformed_points_2 = Point(transformed_points)
pt = Point(transformed_points_2)
pdecon = Deconstruct(Point=pt)  # -> XComponent, YComponent, flatten(ZComponent)
tstat = TreeStatistics(Tree=pt)  # -> Paths, Length, Count
sort = SortList(Keys=pdecon.ZComponent, ValuesA=tstat.Paths)  # -> Keys, ValuesA
item = ListItem(List=sort.ValuesA, Index=0, Wrap=True)
path = DataPath(item)
branch = TreeBranch(Tree=pt, Path=path, MaintainPaths=True)
dpath = DeconstructPath(Branch=path)
min_point = Point(branch)
min_id = Integer(dpath)
min_id_2 = ClusterOutput(min_id)
min_point_2 = ClusterOutput(min_point)

# ==== cluster MinValue
int_curr_solution = ClusterInput()
original_points = ClusterInput()
curr_point = ClusterInput()
original_points_2 = Point(original_points)
curr_point_2 = Point(curr_point)
int_curr_solution_2 = Integer(int_curr_solution)
branch = TreeBranch(Tree=original_points_2, Path=int_curr_solution_2, MaintainPaths=True)
pdecon = Deconstruct(Point=branch)  # -> XComponent, YComponent, ZComponent
expression = Expression(x=pdecon.ZComponent, Expression="Format(\"{0:0.000000}\", x)")
Z = UnitZ(Factor=Slider(0.222, range=0..1))
concat = Concatenate(FragmentA="min: ", FragmentB=expression)
move = Move(Geometry=curr_point_2, Motion=Z)  # -> Geometry, Transform
tag = TextTag(Location=move.Geometry, Text=concat)

# ==== cluster CurrThumbnail
int_curr_solution = ClusterInput()
int_curr_solution_2 = Integer(int_curr_solution)
folder_file = ClusterInput()
expression = Expression(i=int_curr_solution_2, mid=Slider(90, range=0..100), Expression="If (i<mid,i,i+1)")
resolution = ClusterInput()
curr_point = ClusterInput()
folder_file_2 = Text(folder_file)
curr_point_2 = Point(curr_point)
pt = Point(curr_point_2)
yz = YZPlane(Origin=pt)
expression_2 = Expression(x=expression, Expression="Format(\"{0:000}\", x)")
xy = XYPlane(Origin=pt)
md_slider = MDSlider(SliderMode=0, slider_value=Point(0.5, 0, 0.5), x_domain=Domain(0, 1), y_domain=Domain(0, 1), z_domain=Domain(0, 1))
rotate = Rotate(Geometry=xy, Angle=1.570796327, Plane=pt)  # -> Geometry, Transform
panel = Panel("1 to 2")
resolution_2 = Integer(resolution)
rectangle = Rectangle(Plane=rotate.Geometry, XSize="-.5 to .5", YSize="-.5 to .5", Radius=0)  # -> Rectangle, Length
concat = Concatenate(FragmentA=folder_file_2, FragmentB=expression_2, FragmentC=".bmp")
evalsrf = EvaluateSurface(Surface=reparameterize(rectangle.Rectangle), Point=md_slider)  # -> Point, Normal, UDirection, VDirection, Frame
panel_2 = Panel(concat)
panel_3 = Panel(rectangle.Rectangle)

img = ImportImage(File=concat, Rectangle=rectangle.Rectangle, XSamples=resolution_2, YSamples=resolution_2)
crv = Curve(rectangle.Rectangle)

# ==== cluster MassAND
bool = ClusterInput()
bool_2 = Boolean(bool)
lng = ListLength(List=bool_2)
ma = MassAddition(Input=bool_2)  # -> Result, PartialResults
larger = LargerThan(FirstNumber=ma.Result, SecondNumber=lng)  # -> LargerThan, OrEqualTo
bool_3 = Boolean(larger.OrEqualTo)
bool_4 = ClusterOutput(bool_3)

# ==== cluster AdaptableDecimalPlaces
num = ClusterInput()
num_2 = Number(num)
reldif = RelativeDifferences(Values=num_2)
item = ListItem(List=reverse(reldif), Index=0, Wrap=True)
split = TextSplit(Text=item, Separators=".")
item_2 = ListItem(List=reverse(split), Index=0, Wrap=True)
chars = Characters(Text=item_2)  # -> Result, Unicode
lng = ListLength(List=chars.Result)  # -> simplify(Length)
panel = Panel(chars.Result)
repeat = RepeatData(Data="0", Length=lng)
join = TextJoin(Text=repeat)
concat = Concatenate(FragmentA="{0:0.", FragmentB=join, FragmentC="}")
format = Format(Format=concat, Culture=127, Data0=num_2)
txt = Text(format)
panel_2 = Panel(format)
txt_2 = ClusterOutput(txt)

# ==== cluster GridSpacing
target_grid_line = ClusterInput()
target_grid_line_2 = Integer(target_grid_line)
domain = ClusterInput()
domain_2 = Domain(domain)
dedomain = DeconstructDomain(Domain=domain_2)  # -> Start, End
subtraction = Subtraction(A=dedomain.End, B=dedomain.Start)
abs = Absolute(Value=subtraction)
domain_size = Number(abs)
logn = LogN(Number=domain_size, Base="10")
round = Round(Number=logn)  # -> Nearest, Floor, Ceiling
subtraction_2 = Subtraction(A=round.Ceiling, B=1)
division = Division(A=domain_size, B=target_grid_line_2)
_10º = PowerOf10(Value=subtraction_2)
constant_grid_spacing = Number("2.5")
panel = Panel(division)
domain_magnitude_10n = Number(_10º)
panel_2 = Panel(""".2
.25
.5
1
2
2.5
5""")
multiplication = Multiplication(A=domain_magnitude_10n, B=panel_2)
dedomain_2 = DeconstructDomain(Domain=domain_2)  # -> Start, End
spacing_candidates = Number(multiplication)
subtraction_3 = Subtraction(A=spacing_candidates, B=division)
abs_2 = Absolute(Value=subtraction_3)
panel_3 = Panel(spacing_candidates)
distances_to_target_spacing = Number(abs_2)
subtraction_4 = Subtraction(A=dedomain_2.End, B=dedomain_2.Start)
sort = SortList(Keys=distances_to_target_spacing, ValuesA=spacing_candidates)  # -> Keys, ValuesA
item = ListItem(List=sort.ValuesA, Index=0, Wrap=True)
closest_to_target_spacing = Number(item)
adaptable_grid_spacing = Number(closest_to_target_spacing)
grid_spacing = Number(simplify(graft(adaptable_grid_spacing)))
mod = Modulus(A=dedomain_2.Start, B=grid_spacing)  # -> simplify(Result)
subtraction_5 = Subtraction(A=dedomain_2.Start, B=mod)
addition = Addition(A=subtraction_5, B=grid_spacing)  # -> simplify(Result)
division_2 = Division(A=subtraction_4, B=grid_spacing)  # -> simplify(Result)
series = Series(Start=addition, Step=grid_spacing, Count=division_2)  # -> simplify(flatten(Series))
merge = Merge(Data1=dedomain_2.Start, Data2=series, Data3=dedomain_2.End)
grid_values = Number(merge)
grid_values_2 = ClusterOutput(grid_values)

# ==== cluster MassOR
A = ClusterInput()
not = GateNot(A=A)
ma = MassAddition(Input=not)  # -> Result, PartialResults
not_2 = GateNot(A=ma.Result)
R = ClusterOutput(not_2)
