# Grasshopper definition generateSegmentInterfaces.gh (Grasshopper 1.0.7)
# plug-ins: LunchBox, karambaGH

srf = Surface(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)
scale_nu = ScaleNU(Geometry=srf, Plane=PlaneXY(0, 0, 0), ScaleX=1, ScaleY=1, ScaleZ=Slider(1.042, range=0..5))  # -> Geometry, Transform
srf_2 = Surface(scale_nu.Geometry)
number_slider = Slider(3, range=0..10)
panel = Panel("1")
srf_3 = Surface(srf_2)
divide = DivideDomain²(Domain=srf_3, UCount=number_slider, VCount=number_slider)
subsrf = Isotrim(Surface=reparameterize(srf_3), Domain=divide)
input = DataInput(
    Destination="C:\Users\ec977\Documents\GitHub\ACORN-shells\GH\ACORN-shells.ghdata",
    RelativePath="C:\Users\ec977\Documents\GitHub\ACORN-shells\GH\ACORN-shells.ghdata|ACORN-shells.ghdata",
    UpdateDelay=5)
segments = Geometry(flatten(input))
segments_2 = Surface(Tree({0;0}: [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], {1;0}: [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], {2;0}: [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], {3;0}: [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], {4;0}: [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], {5;0}: [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]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))
number_slider_2 = Slider(0.005, range=0..0.1)

# ---- group: determine internal edges + topology
srf_4 = Surface(segments)
join = BrepJoin(Breps=srf_4)  # -> Breps, Closed
debrep = DeconstructBrep(Brep=join.Breps)  # -> Faces, Edges, Vertices
topology = BrepTopology(Brep=join.Breps, PerspectiveOnly=False)  # -> FaceFaceAdjacency, FaceEdgeAdjacency, simplify(EdgeFaceAdjacency)
lng = ListLength(List=topology.EdgeFaceAdjacency)
larger = LargerThan(FirstNumber=lng, SecondNumber="2")  # -> LargerThan, OrEqualTo
dispatch = Dispatch(List=topology.EdgeFaceAdjacency, DispatchPattern=larger.OrEqualTo)  # -> ListA, ListB
clean = CleanTree(RemoveNulls=True, RemoveInvalid=True, RemoveEmpty=Toggle(True), Tree=dispatch.ListA)
tstat = TreeStatistics(Tree=clean)  # -> Paths, Length, Count
dpath = DeconstructPath(Branch=tstat.Paths)
item = ListItem(List=debrep.Edges, Index=flatten(dpath), Wrap=True)
match = MatchTree(Tree=graft(item), Guide=clean)
adjacent_faces = Integer(clean)
internal_edges = Curve(match)

# ----
offset_surface_for_gap = OffsetSurfaceForGap(srf=segments, num=number_slider_2)
multiplication = Multiplication(A=number_slider_2, B=2)
# IPts not working on trimmed surface
number_slider_3 = Slider(0.05, range=0..0.1)
gap_size = Number(multiplication)
srf_5 = Surface(simplify(offset_surface_for_gap))
offset_segments = Surface(simplify(offset_surface_for_gap))
debrep_2 = DeconstructBrep(Brep=offset_segments)  # -> Faces, Edges, Vertices
mesh_breps = MeshBrepsKaramba3D(
    Brep=srf_5,
    MeshResolution=Slider(0.2, range=0..1),
    EdgeRefinementFactor=0.67,
    PointReduction=False,
    SmoothingStepSize=0,
    SmoothingIterations=5)  # -> Mesh, Info
divint = DivInt(crv=debrep_2.Edges, num=Slider(0.322, range=0..1))  # -> pts_2, midpts_2
medges = MeshEdges(Mesh=mesh_breps.Mesh)  # -> NakedEdges, InteriorEdges, NonManifoldEdges
crv = Curve(medges.NakedEdges)
int = Integer(simplify(graft(topology.FaceEdgeAdjacency)))
divint_2 = DivInt(crv=internal_edges, num=Slider(0.322, range=0..1))  # -> pts_2, midpts_2
debrep_3 = DeconstructBrep(Brep=offset_segments)  # -> Faces, Edges, Vertices
group = Group(Objects=divint_2.pts_2)
make_springs = MakeSprings(conn_dist=Slider(0.039, range=0..1), srf=segments, mesh=mesh_breps.Mesh, gap_size=gap_size)
join_2 = JoinCurves(Curves=debrep_3.Edges, Preserve=False)  # -> simplify(Curves)
item_2 = ListItem(List=group, Index=int, Wrap=True)
mesh = Mesh(mesh_breps.Mesh)
ungroup = Ungroup(Group=item_2)  # -> simplify(Objects)
panel_2 = Panel(group)
trim = TrimTree(Tree=ungroup, Depth=1)
crv_cp = CurveClosestPoint(Point=trim, Curve=join_2)  # -> Point, Parameter, Distance
srf_cp = SurfaceClosestPoint(Point=trim, Surface=offset_segments)  # -> Point, UVPoint, Distance
number_slider_4 = Slider(3, range=0..10)

panel_3 = Panel("main direction")
_10º = PowerOf10(Value=Slider(-4, range=-6..10))
multiplication_2 = Multiplication(A=Slider(1, range=1..10), B=_10º)

mesh_2 = Mesh(mesh)
mjoin = MeshJoin(Meshes=mesh_2)
_10º_2 = PowerOf10(Value=Slider(5, range=0..10))
_10º_3 = PowerOf10(Value=number_slider_4)
_10º_4 = PowerOf10(Value=Slider(5, range=0..10))
_10º_5 = PowerOf10(Value=Slider(2, range=0..10))
_10º_6 = PowerOf10(Value=Slider(5, range=0..10))
_10º_7 = PowerOf10(Value=Slider(1, range=0..10))
_10º_8 = PowerOf10(Value=Slider(5, range=0..10))
multiplication_3 = Multiplication(A=Slider(1, range=0..1), B=_10º_4)
multiplication_4 = Multiplication(A=Slider(1, range=0..1), B=_10º_2)
multiplication_5 = Multiplication(A=Slider(1, range=0..1), B=_10º_6)
multiplication_6 = Multiplication(A=Slider(1, range=0..1), B=_10º_7)
multiplication_7 = Multiplication(A=Slider(1, range=0..1), B=_10º_5)
multiplication_8 = Multiplication(A=Slider(1, range=1..10), B=_10º_3)
multiplication_9 = Multiplication(A=Slider(1, range=0..1), B=_10º_8)
vec = VectorXYZ(XComponent=multiplication_3, YComponent=multiplication_5, ZComponent=multiplication_4)  # -> Vector, Length
# spring setup
vec_2 = VectorXYZ(XComponent=multiplication_8, YComponent=multiplication_8, ZComponent=multiplication_8)  # -> Vector, Length
vec_3 = VectorXYZ(XComponent=multiplication_6, YComponent=multiplication_2, ZComponent=multiplication_7)  # -> Vector, Length
vec_4 = VectorXYZ(XComponent=multiplication_9, YComponent=multiplication_9, ZComponent=multiplication_9)  # -> Vector, Length
cross_section = CrossSectionKaramba3D(
    FamilyNameOfCrossSection="DefaultCroSec",
    ElementIdentifier="spring",
    CTranslation_kN_m=vec.Vector,
    CRotation_kNm_rad=vec_3.Vector,
    mode="Spring")
cross_section_2 = CrossSectionKaramba3D(
    FamilyNameOfCrossSection="DefaultCroSec",
    Material=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,
    Height_cm=Slider(5, range=0..10),
    mode="Shell - Const")
merge = Merge(Data1=cross_section_2, Data2=cross_section)
crosec = CrossSectionKaramba(merge)
number_slider_5 = Slider(9.862, range=0..10)  # "kN/m2"
number_slider_6 = Slider(6.44, range=0..100)
Z = UnitZ(Factor=Slider(10, range=0..10))
rev = Reverse(Vector=Z)
loads = LoadsKaramba3D(Vector=rev, Mesh=mesh, mode="MeshLoad -Const.", menu=[buttons(off, on, off), buttons(on, on)])
crv_2 = Curve(make_springs)
bottompoints = BottomPoints(mesh=mesh, ltol=Slider(2, range=0..10))  # -> flatten(pt_3)
end = EndPoints(Curve=crv_2)  # -> Start, End
xy = XYPlane(Origin=end.Start)
supp = SupportKaramba3D(PosInd=bottompoints, menu=[buttons(on, on, on, off, off, on)])
linetobeam = LineToBeamKaramba(Line=flatten(make_springs), Identifier="spring", New=True, Remove=True, LimitDistance_m=0.005)  # -> simplify(Element), Points, Info
loads_2 = LoadsKaramba3D(Vector=Vector(0, 0, -1), mode="Gravity")
matselect = MaterialSelectionKaramba3D(menu=[dropdown(3), dropdown(1)])
project = Project(Geometry=crv_2, Plane=xy)  # -> Geometry, Transform
meshtoshell = MeshToShellKaramba3D(Mesh=mesh, LimitDistance_m=0.005)  # -> Element, Points, Info
end_2 = EndPoints(Curve=project.Geometry)  # -> Start, End
panel_4 = Panel(loads)
vec2pt = Vector2Pt(PointA=end_2.Start, PointB=end_2.End, Unitize=False)  # -> Vector, Length
vec2pt_2 = Vector2Pt(PointA=end.Start, PointB=end.End, Unitize=False)  # -> Vector, Length
angle = Angle(VectorA=vec2pt_2.Vector, VectorB=vec2pt.Vector)  # -> Angle, Reflex
deg = Degrees(Radians=angle.Angle)
panel_5 = Panel(deg)
sort = SortList(Keys=flatten(deg))  # -> Keys, ValuesA
merge_2 = Merge(Data1=flatten(linetobeam.Element), Data2=flatten(meshtoshell.Element))
bnd = Bounds(Numbers=sort.Keys)
element = ElementKaramba(merge_2)
pt = Point(meshtoshell.Points)
panel_6 = Panel(bnd)
mag_ct = Integer(number_slider_4)
rec = DataRecorder(mag_ct, DataLimit=-10, RecordData=False)
max_stress_comp = Number([-0.162, -0.159, -0.151, -0.147, -0.147, -0.147, -0.147, -0.147, -0.147, -0.147, -0.147])
max_stress_tens = Number([0.251, 0.236, 0.201, 0.186, 0.184, 0.184, 0.184, 0.184, 0.184, 0.184, 0.184])
max_disp = Number([0.04782188014, 0.04421990763, 0.0359866655, 0.03298416381, 0.03260083027, 0.03256129178, 0.0325573249, 0.03255692808, 0.0325568884, 0.03255688443, 0.03255688403])
mag_ct_2 = Integer([0, 1, 2, 3, 4, 5, 6, 7, 8, 9, 10])

# ---- group: whole shell
max_stress_comp_2 = Number(-0.146)
max_stress_tens_2 = Number(0.186)
max_disp_2 = Number(0.03259199848)

# ----
max_stress_comp_3 = Number([-0.736, -0.51, -0.109, -0.151, -0.157, -0.148, -0.147, -0.147, -0.147, -0.147, -0.147])
max_stress_tens_3 = Number([4.69, 3.24, 0.333, 0.164, 0.224, 0.191, 0.184, 0.183, 0.183, 0.183, 0.183])
max_disp_3 = Number([1.583207922, 1.182962552, 0.3778877478, 0.1103904395, 0.05742179774, 0.03609030866, 0.03256129178, 0.03217144294, 0.03213120601, 0.03212716091, 0.03212675625])
mag_ct_3 = Integer([0, 1, 2, 3, 4, 5, 6, 7, 8, 9, 10])
merge_3 = Merge(Data1=graft(max_stress_comp_2), Data2=graft(max_stress_tens_2), Data3=graft(max_disp_2))  # -> simplify(Result)
max_stress_comp_4 = Number([-0.736, -0.51, -0.109, -0.151, -0.157, -0.148, -0.147, -0.147, -0.147, -0.147, -0.147])
max_stress_tens_4 = Number([4.69, 3.24, 0.333, 0.164, 0.224, 0.191, 0.184, 0.183, 0.183, 0.183, 0.183])
max_disp_4 = Number([1.58279036, 1.182691614, 0.3778172142, 0.1103610701, 0.05740937502, 0.03608507293, 0.032556884, 0.03216712047, 0.03212689201, 0.03212284776, 0.03212244312])
mag_ct_4 = Integer([0, 1, 2, 3, 4, 5, 6, 7, 8, 9, 10])
panel_7 = Panel(merge_3)
panel_8 = Panel("""max stress comp
max stress tens
max disp""")
merge_4 = Merge(Data1=graft(max_stress_comp_4), Data2=graft(max_stress_tens_4), Data3=graft(max_disp_4))  # -> simplify(Result)
panel_10 = Panel("""max stress comp
max stress tens
max disp""")
panel_12 = Panel("""max stress comp
max stress tens
max disp""")
merge_5 = Merge(Data1=graft(max_stress_comp_3), Data2=graft(max_stress_tens_3), Data3=graft(max_disp_3))  # -> simplify(Result)
merge_6 = Merge(Data1=graft(max_stress_comp), Data2=graft(max_stress_tens), Data3=graft(max_disp))  # -> simplify(Result)
flip = FlipMatrix(Data=merge_4)
flip_2 = FlipMatrix(Data=merge_5)
flip_3 = FlipMatrix(Data=merge_6)
panel_13 = Panel(flip)
panel_14 = Panel(flip_2)
panel_15 = Panel(flip_3)
chart = CreateChart(
    ChartName="My Chart",
    ChartSeries=panel_8,
    ChartXAxisLabels=mag_ct_4,
    ValueTree=flip,
    Chart_Theme="Bright Pastel",
    Chart_Type="Line")
chart_2 = CreateChart(
    ChartName="My Chart",
    ChartSeries=panel_10,
    ChartXAxisLabels=mag_ct_2,
    ValueTree=flip_2,
    Chart_Theme="Bright Pastel",
    Chart_Type="Line")
chart_3 = CreateChart(
    ChartName="My Chart",
    ChartSeries=panel_12,
    ChartXAxisLabels=mag_ct_2,
    ValueTree=flip_3,
    Chart_Theme="Bright Pastel",
    Chart_Type="Line")

# ---- group: live load patterns
mesh_3 = Mesh(simplify(graft(mesh_2)))
image = ImageSampler(Filter="Colour", Interpolate=False, Umax=1, Umin=0, Vmax=1, Vmin=0, Wrap=1)
load_pattern = Slider(7, range=1..7)
bbox = BoundingBox(Content=flatten(mesh_3), Plane=PlaneXY(0, 0, 0), UnionBox=True)  # -> Box, Box_2
faceb = FaceBoundaries(Mesh=mesh_3)  # -> simplify(Boundaries)
box = EvaluateBox(Box=bbox.Box, UParameter=0.5, VParameter=0.5, WParameter="1")  # -> Plane, simplify(Point), Include
pattern_domains = PatternDomains(G=load_pattern)
area = Area(Geometry=faceb)  # -> Area, Centroid
pt_2 = Point(simplify(graft(area.Centroid)))
polar = ToPolar(Point=pt_2, System=box.Plane)  # -> simplify(Phi), Theta, Radius
wh_value_for_live_load = Panel("3.5")
pt_3 = Point(simplify(area.Centroid))

# ----
sph = Sphere(Base=box.Plane, Radius=Slider(2, range=0..10))
data = Data(flatten(pattern_domains))
dom² = ConstructDomain²(DomainU=data, DomainV="0 To Pi")
subsrf_2 = Isotrim(Surface=sph, Domain=dom²)
face_area_m2 = Number(area.Area)
mesh_4 = Mesh(mesh_3)

# ---- group: live load patterns (continued)
inc = Includes(Value=polar.Phi, Domain=data)  # -> Includes, Deviation
ma = MassAddition(Input=inc.Includes)  # -> Result, PartialResults
bool = Boolean(ma.Result)
multiplication_10 = Multiplication(A=number_slider_5, C=bool)
dispatch_2 = Dispatch(List=pt_2, DispatchPattern=bool)  # -> ListA, ListB
live_load_kn_m2_per_face = Number(multiplication_10)
outside = Point(dispatch_2.ListB)
inside = Point(dispatch_2.ListA)
Z_2 = UnitZ(Factor=live_load_kn_m2_per_face)
rev_2 = Reverse(Vector=Z_2)

# ----
multiplication_11 = Multiplication(A=live_load_kn_m2_per_face, B=face_area_m2)  # disabled
trim_2 = TrimTree(Tree=rev_2, Depth=1)

# ---- group: live load patterns (continued)
vdis = VectorDisplay(Anchor=pt_3, Vector=trim_2)
loads_3 = LoadsKaramba3D(Vectors=trim_2, Mesh=mesh_4, LCase="0", mode="MeshLoad -Variable", menu=[buttons(off, on, off), buttons(on, on)])

# ----
load = LoadKaramba3D(flatten(loads_3))
panel_16 = Panel(load)

# ----
# Karamba analysis
# and results
assemble = AssembleModelKaramba3D(Point=pt, Elem=element, Support=supp, Load=load, CrossSection=crosec, Material=matselect, LimitDistance_m=0.005)  # -> Model, Info, Mass_kg, CenterOfGravity
analyze = AnalyzeKaramba3D(Model=assemble.Model)  # -> CalculatedModel, MaximumDisplacement_cm, ResultingForceOfGravity_kN, ElasticEnergy_kNm
modelview = ModelViewKaramba3D(Model=analyze.CalculatedModel, ResultFactors=1, ResultCase=-1)  # -> Model, DeformedMesh, DeformedAxes, DeformedModel
beamview = BeamViewKaramba3D(Model=modelview.Model)  # -> Model, MeshesOfRenderedBeams, DeformedBeamAxes, LegendColors, LegendTags
medges_2 = MeshEdges(Mesh=modelview.DeformedMesh)  # -> NakedEdges, InteriorEdges, NonManifoldEdges
crv_3 = Curve(medges_2.NakedEdges)

analyzethii = AnalyzeThIIKaramba3D(Model=assemble.Model, RTolerance=1e-07, MaxIterations=50, NoTensionalNII=False)  # -> CalculatedModel, MaximumDisplacement_cm, ResultingForceOfGravity_kN, ElasticEnergy_kNm; disabled
bmodes = BucklingModesKaramba3D(
    Model=analyzethii.CalculatedModel,
    FromIndex=1,
    NumberOfModes=Slider(3, range=0..10),
    MaximumNumberOfIterations=300,
    Epsilon=1e-07)  # -> ModelWithBucklingModesAsLoadCaseResults, BucklingLoadFactors
model = ModelKaramba3D(modelview.Model)
panel_17 = Panel(bmodes.BucklingLoadFactors)
crv_4 = Curve(modelview.DeformedAxes)
explode = Explode(Curve=simplify(crv_4), Recursive=True)  # -> Segments, Vertices
shellview = ShellViewKaramba3D(Model=modelview.Model, IndexOfLayer=0)  # -> Model, MeshesOfRenderedShells, LegendColors, LegendTags
mesh_5 = Mesh(modelview.DeformedMesh)
legend = Legend(Colour=shellview.LegendColors, Tags=shellview.LegendTags, LegendType=1)
item_3 = ListItem(List=explode.Segments, Index=Slider(0, range=0..1), Wrap=True)
item_4 = ListItem(List=reverse(shellview.LegendTags), Index=0, Wrap=True)  # -> Item, Item1
item_5 = ListItem(List=shellview.LegendTags, Index=0, Wrap=True)  # -> Item, Item1
panel_18 = Panel(item_5.Item1)
panel_19 = Panel(item_4.Item1)
max_stress_comp_5 = Number(item_5.Item1)
max_stress_tens_5 = Number(item_4.Item1)
max_disp_5 = Number(analyze.MaximumDisplacement_cm)
rec_2 = DataRecorder(max_stress_tens_5, DataLimit=-10, RecordData=False)
rec_3 = DataRecorder(max_stress_comp_5, DataLimit=-10, RecordData=False)
rec_4 = DataRecorder(max_disp_5, DataLimit=-10, RecordData=False)

# ==== cluster BottomPoints
ltol = ClusterInput()
mesh = ClusterInput()
mesh_2 = Mesh(mesh)
ltol_2 = Integer(ltol)
demesh = DeconstructMesh(Mesh=mesh_2)  # -> Vertices, Faces, Colours, Normals
pt = Point(flatten(demesh.Vertices))
bbox = BoundingBox(Content=pt, Plane=PlaneXY(0, 0, 0), UnionBox=True)  # -> Box, Box_2
box = EvaluateBox(Box=bbox.Box, UParameter="0", VParameter="0", WParameter="0")  # -> Plane, Point, Include
neg = Negative(Value=ltol_2)
_10º = PowerOf10(Value=neg)
cp = PlaneClosestPoint(Point=pt, Plane=box.Plane)  # -> Point, UVPoint, Distance
panel = Panel("1e-10")
smaller = SmallerThan(FirstNumber=cp.Distance, SecondNumber=_10º)  # -> SmallerThan, OrEqualTo
boxdims = BoxDims(box=bbox.Box)  # -> dx_2, dy_2, dz_2
dispatch = Dispatch(List=pt, DispatchPattern=smaller.SmallerThan)  # -> ListA, ListB
duppt = RemoveDuplicatePts(Points=dispatch.ListA, Tolerance=0.01)  # -> simplify(UniquePoints)
division = Division(A=boxdims.dx_2, B="2")
pgroups = PointGroups(Points=duppt, Distance=division)  # -> simplify(Groups), Indices
pt_2 = Point(pgroups.Groups)
pt_3 = ClusterOutput(pt_2)

# ==== cluster OffsetSurfaceForGap
srf = ClusterInput()
num = ClusterInput()
srf_2 = Surface(simplify(graft(srf)))
num_2 = Number(num)
edges = BrepEdges(Brep=srf_2)  # -> simplify(Naked), Interior, NonManifold
offsets = OffsetOnSrf(Curve=edges.Naked, Distance=num_2, Surface=srf_2)
trim = TrimTree(Tree=offsets, Depth=1)
srfsplit = SurfaceSplit(Surface=srf_2, Curves=trim)
area = Area(Geometry=srfsplit)  # -> Area, Centroid
sort = SortList(Keys=area.Area, ValuesA=srfsplit)  # -> Keys, ValuesA
item = ListItem(List=reverse(sort.ValuesA), Index=0, Wrap=True)
i = ClusterOutput(item)

# ==== cluster MakeSprings
mesh = ClusterInput()
gap_size = ClusterInput()
srf = ClusterInput()
mesh_2 = Mesh(mesh)
gap_size_2 = Number(gap_size)
srf_2 = Surface(srf)

# ---- group: determine internal edges + topology
join = BrepJoin(Breps=srf_2)  # -> Breps, Closed
debrep = DeconstructBrep(Brep=join.Breps)  # -> Faces, Edges, Vertices
topology = BrepTopology(Brep=join.Breps, PerspectiveOnly=False)  # -> FaceFaceAdjacency, FaceEdgeAdjacency, simplify(EdgeFaceAdjacency)
lng = ListLength(List=topology.EdgeFaceAdjacency)
larger = LargerThan(FirstNumber=lng, SecondNumber="2")  # -> LargerThan, OrEqualTo
dispatch = Dispatch(List=topology.EdgeFaceAdjacency, DispatchPattern=larger.OrEqualTo)  # -> ListA, ListB
clean = CleanTree(RemoveNulls=True, RemoveInvalid=True, RemoveEmpty=Toggle(True), Tree=dispatch.ListA)
tstat = TreeStatistics(Tree=clean)  # -> Paths, Length, Count
dpath = DeconstructPath(Branch=tstat.Paths)
item = ListItem(List=debrep.Edges, Index=flatten(dpath), Wrap=True)
match = MatchTree(Tree=graft(item), Guide=clean)
adjacent_faces = Integer(clean)
internal_edges = Curve(match)

# ----
gap_size_3 = Number(gap_size_2)

# ---- group: mesh vertices on curves
item_2 = ListItem(List=flatten(mesh_2), Index=adjacent_faces, Wrap=True)
crv = Curve(internal_edges)
demesh = DeconstructMesh(Mesh=item_2)  # -> Vertices, Faces, Colours, Normals
repeat = RepeatData(Data=crv, Length="2")  # -> simplify(graft(Data))
pull = PullPoint(Point=demesh.Vertices, Geometry=repeat, ClosestOnly=True)  # -> ClosestPoint, Distance
smaller = SmallerThan(FirstNumber=pull.Distance, SecondNumber=gap_size_3)  # -> SmallerThan, OrEqualTo
cull = CullPattern(List=demesh.Vertices, CullPattern=smaller.SmallerThan)  # -> simplify(List)
alongcrv = SortAlongCurve(Points=cull, Curve=repeat)  # -> simplify(Points), Indices

# ----
number_slider = Slider(0.221, range=0..3)
conn_dist = ClusterInput()
conn_dist_2 = Number(conn_dist)

# ---- group: select points according to connection distance (approx.)
shatter = Shatter(Curve=reparameterize(repeat), Parameters=".5")  # -> simplify(Segments)
item_3 = ListItem(List=shatter, Index=0, Wrap=True)  # -> Item, Item1
flip = FlipCurve(Curve=item_3.Item)  # -> Curve, Flag
merge = Merge(Data1=flip.Curve, Data2=item_3.Item1)
divlength = DivideLength(Curve=merge, Length=conn_dist_2)  # -> simplify(Points), Tangents, Parameters
trim = TrimTree(Tree=divlength.Points, Depth=1)
rdpoints = RemoveDuplicatePointsKaramba3D(Point=trim, LimitDistance=0.005)  # -> OutPoint, Info, Indexes

# ----
cp = ClosestPoint(Point=rdpoints.OutPoint, Cloud=alongcrv.Points)  # -> ClosestPoint, CPIndex, Distance
rdpoints_2 = RemoveDuplicatePointsKaramba3D(Point=cp.ClosestPoint, LimitDistance=0.005)  # -> OutPoint, Info, Indexes
pt = Point(simplify(graft(rdpoints_2.OutPoint)))
path_mapper = PathMapper(pt, source="{A;B;C}", target="{A;C;B}")
pt_2 = Point(path_mapper)
trim_2 = TrimTree(Tree=pt_2, Depth=1)
item_4 = ListItem(List=trim_2, Index=0, Wrap=True)  # -> Item, Item1
ln = Line(StartPoint=item_4.Item, EndPoint=item_4.Item1)
springs = Line(ln)
springs_2 = ClusterOutput(springs)

# ==== cluster PatternDomains

# ---- group: pattern 5
number_slider = Slider(0, range=0..10)
number_slider_2 = Slider(2, range=0..10)
addition = Addition(A=number_slider, B="2")
series = Series(Start=addition, Step="4", Count=number_slider_2)
series_2 = Series(Start=number_slider, Step="4", Count=number_slider_2)
multiplication = Multiplication(A=series_2, B=".25")
multiplication_2 = Multiplication(A=series, B=".25")
pi = Pi(Factor=multiplication_2)
pi_2 = Pi(Factor=multiplication)
panel = Panel(pi_2)
panel_2 = Panel(pi)
dom = ConstructDomain(DomainStart=panel, DomainEnd=panel_2)  # -> graft(Domain)

# ---- group: pattern 6
number_slider_3 = Slider(0, range=0..10)
number_slider_4 = Slider(4, range=0..10)
addition_2 = Addition(A=number_slider_3, B="1")
series_3 = Series(Start=addition_2, Step="2", Count=number_slider_4)
series_4 = Series(Start=number_slider_3, Step="2", Count=number_slider_4)
multiplication_3 = Multiplication(A=series_4, B=".25")
multiplication_4 = Multiplication(A=series_3, B=".25")
pi_3 = Pi(Factor=multiplication_4)
pi_4 = Pi(Factor=multiplication_3)
panel_3 = Panel(pi_4)
panel_4 = Panel(pi_3)
dom_2 = ConstructDomain(DomainStart=panel_3, DomainEnd=panel_4)  # -> graft(Domain)

# ---- group: pattern 4
number_slider_5 = Slider(1, range=0..10)
number_slider_6 = Slider(2, range=0..10)
addition_3 = Addition(A=number_slider_5, B="2")
series_5 = Series(Start=addition_3, Step="4", Count=number_slider_6)
series_6 = Series(Start=number_slider_5, Step="4", Count=number_slider_6)
multiplication_5 = Multiplication(A=series_6, B=".25")
multiplication_6 = Multiplication(A=series_5, B=".25")
pi_5 = Pi(Factor=multiplication_6)
pi_6 = Pi(Factor=multiplication_5)
panel_5 = Panel(pi_6)
panel_6 = Panel(pi_5)
dom_3 = ConstructDomain(DomainStart=panel_5, DomainEnd=panel_6)  # -> graft(Domain)

# ---- group: pattern 1
multiplication_7 = Multiplication(A=Slider(0, range=0..10), B=".25")
multiplication_8 = Multiplication(A=Slider(0, range=0..10), B=".25")
pi_7 = Pi(Factor=multiplication_7)
pi_8 = Pi(Factor=multiplication_8)
panel_7 = Panel(pi_7)
panel_8 = Panel(pi_8)
dom_4 = ConstructDomain(DomainStart=panel_7, DomainEnd=panel_8)

# ---- group: pattern 2
multiplication_9 = Multiplication(A=Slider(2, range=0..10), B=".25")
multiplication_10 = Multiplication(A=Slider(6, range=0..10), B=".25")
pi_9 = Pi(Factor=multiplication_9)
pi_10 = Pi(Factor=multiplication_10)
panel_9 = Panel(pi_9)
panel_10 = Panel(pi_10)
dom_5 = ConstructDomain(DomainStart=panel_9, DomainEnd=panel_10)

# ---- group: pattern 3
multiplication_11 = Multiplication(A=Slider(1, range=0..10), B=".25")
multiplication_12 = Multiplication(A=Slider(5, range=0..10), B=".25")
pi_11 = Pi(Factor=multiplication_11)
pi_12 = Pi(Factor=multiplication_12)
panel_11 = Panel(pi_11)
panel_12 = Panel(pi_12)
dom_6 = ConstructDomain(DomainStart=panel_11, DomainEnd=panel_12)

# ---- group: pattern 7
multiplication_13 = Multiplication(A=Slider(0, range=0..10), B=".25")
multiplication_14 = Multiplication(A=Slider(8, range=0..10), B=".25")
pi_13 = Pi(Factor=multiplication_13)
pi_14 = Pi(Factor=multiplication_14)
panel_13 = Panel(pi_13)
panel_14 = Panel(pi_14)
dom_7 = ConstructDomain(DomainStart=panel_13, DomainEnd=panel_14)

# ----
G = ClusterInput()
filter = StreamFilter(Gate=G, Stream1=dom_4, Stream2=dom_5, Stream3=dom_6, Stream4=dom, Stream5=dom_3, Stream6=dom_2, Stream7=dom_7)
s_7 = ClusterOutput(filter)

# ==== cluster DivInt
crv = ClusterInput()
num = ClusterInput()

# ---- group: divide curve integer
crv_2 = Curve(crv)
len = Length(Curve=crv_2)
num_2 = Number(num)
division = Division(A=len, B=num_2)
round = Round(Number=division)  # -> Nearest, Floor, Ceiling
divide = DivideCurve(Curve=crv_2, Count=round.Ceiling, Kinks=False)  # -> simplify(Points), Tangents, Parameters

# ----
pline = PolyLine(Vertices=divide.Points, Closed=False)
explode = Explode(Curve=pline, Recursive=True)  # -> Segments, Vertices
eval = EvaluateCurve(Curve=reparameterize(explode.Segments), Parameter=".5")  # -> Point, Tangent, Angle
midpts = Point(simplify(eval.Point))
pts = Point(divide.Points)
pts_2 = ClusterOutput(pts)
midpts_2 = ClusterOutput(midpts)

# ==== cluster BoxDims
box = ClusterInput()
box_2 = Box(box)
debox = DeconstructBox(Box=box_2)  # -> Plane, X, Y, Z
dedomain = DeconstructDomain(Domain=debox.X)  # -> Start, End
dedomain_2 = DeconstructDomain(Domain=debox.Y)  # -> Start, End
dedomain_3 = DeconstructDomain(Domain=debox.Z)  # -> Start, End
subtraction = Subtraction(A=dedomain.End, B=dedomain.Start)
subtraction_2 = Subtraction(A=dedomain_2.End, B=dedomain_2.Start)
subtraction_3 = Subtraction(A=dedomain_3.End, B=dedomain_3.Start)
dx = Number(subtraction)
dy = Number(subtraction_2)
dz = Number(subtraction_3)
dx_2 = ClusterOutput(dx)
dy_2 = ClusterOutput(dy)
dz_2 = ClusterOutput(dz)
