# Grasshopper definition simulatePinbed.gh (Grasshopper 1.0.7)

_6x6 = Surface(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)
lor_7_8x7_2 = Surface(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)
_6x6_segments = Surface([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])
lor_segments = Surface([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])
segments_proj = Surface(lor_segments)
shell = Surface(lor_7_8x7_2)

# ---- group: {manual} segmentation
shell_2 = Surface(shell)
project = Project(Curve=segments_proj, Brep=shell_2, Direction=Vector(0, 0, 1))  # -> simplify(Curve)
srfsplit = SurfaceSplit(Surface=shell_2, Curves=project)  # -> simplify(Fragments)
area = Area(Geometry=srfsplit)  # -> Area, Centroid
sort = SortList(Keys=area.Area, ValuesA=srfsplit)  # -> Keys, ValuesA
item = ListItem(List=sort.ValuesA, Index=0, Wrap=True)

# ----
segments = Surface(item)
project_2 = Project(Geometry=segments, Plane=PlaneXY(0, 0, 0))  # -> Geometry, Transform
rotating_caliper = RotatingCaliper(geo=project_2.Geometry)  # -> box_2, area_4
box = Box(simplify(rotating_caliper.box_2))
boxfit = BoxFit(box=box, dim_1="2", dim_2="2")  # -> fit_2, unfit_2
boxfit_2 = BoxFit(box=boxfit.unfit_2, dim_1="4", dim_2="1")  # -> fit_2, unfit_2
box_2 = Box(simplify(rotating_caliper.box_2))
branch = TreeBranch(Tree=box_2, Path=Slider(5, range=0..10), MaintainPaths=True)
branch_2 = TreeBranch(Tree=item, Path=Slider(0, range=0..10), MaintainPaths=True)
box_3 = Box(simplify(box_2))
shell_3 = Surface(shell)
srf = Surface(branch_2)

# ---- group: divide segments into modules / tolerance for input integer numbers
lot = Integer(Slider(10, range=0..10))
neg = Negative(Value=lot)
_10º = PowerOf10(Value=neg)

# ---- group: divide segments into modules
box_4 = Box(box_3)
boxsize = BoxSize(box=box_4)  # -> X_2, Y_2, Z_2, A_2, V_2
branch_3 = TreeBranch(Tree=box_4, Path=Slider(7, range=0..20), MaintainPaths=True)
subtraction = Subtraction(A=boxsize.Y_2, B=_10º)
subtraction_2 = Subtraction(A=boxsize.X_2, B=_10º)
boxdim = BoxDim(B=branch_3, S=Slider(0.1, range=0..0.1))
pln = Plane(box_4)
round = Round(Number=subtraction_2)  # -> Nearest, Floor, Ceiling
round_2 = Round(Number=subtraction)  # -> Nearest, Floor, Ceiling
sqgrid = Square(Plane=pln, Size="1", ExtentX=round.Ceiling, ExtentY=round_2.Ceiling)  # -> Cells, Points
trim = TrimTree(Tree=sqgrid.Cells, Depth=Slider(1, range=0..1))  # -> simplify(Tree)
bbox = BoundingBox(Content=trim, Plane=pln, UnionBox=True)  # -> Box, Box_2
area_2 = Area(Geometry=bbox.Box)  # -> Area, Centroid
area_3 = Area(Geometry=box_4)  # -> Area, Centroid
vec2pt = Vector2Pt(PointA=area_2.Centroid, PointB=area_3.Centroid, Unitize=False)  # -> Vector, Length
modulesiny = Integer(round_2.Ceiling)
modulesinx = Integer(round.Ceiling)
move = Move(Geometry=trim, Motion=vec2pt.Vector)  # -> Geometry, Transform
unflatten = UnflattenTree(Tree=move.Geometry, Guide=sqgrid.Cells)  # -> simplify(Tree)
modules = Rectangle(move.Geometry)

# ---- group: color segments
flatten = FlattenTree(Tree=srf, Path="{0}")
lng = ListLength(List=flatten)
dom = ConstructDomain(DomainStart=Slider(0.761, range=0..1), DomainEnd=Slider(0.481, range=0..1))
subtraction_3 = Subtraction(A=lng, B=1)
range = Range(Domain=dom, Steps=subtraction_3)
hsl = ColourHSL(Alpha=Slider(0.514, range=0..1), Hue=range, Saturation=Slider(1, range=0..1), Luminance=0.5)
jitter = Jitter(List=hsl, Jitter=1, Seed=Slider(95, range=0..100))  # -> Values, Indices
preview = CustomPreview(Geometry=flatten, Material=jitter.Values)

# ---- group: top branch select
int = Integer(Slider(5, range=0..10))
concat = Concatenate(FragmentA="{", FragmentB=int, FragmentC=";*}")
split = SplitTree(Masks=flatten(concat))  # -> Positive, Negative

# ----
number_slider = Slider(0.354, range=0..1)
box_2x2s = Box(boxfit.fit_2)
box_4x1s = Box(boxfit_2.fit_2)
unfeasible = Box(boxfit_2.unfit_2)
tstat = TreeStatistics(Tree=box_2x2s)  # -> Paths, Length, Count
ahsl = SplitAHSL(Colour=ColourSwatch(SwatchColor=RGB(65, 156, 0)))  # -> Alpha, Hue, Saturation, Luminance
tstat_2 = TreeStatistics(Tree=box_4x1s)  # -> Paths, Length, Count
ahsl_2 = SplitAHSL(Colour=ColourSwatch(SwatchColor=RGB(255, 183, 0)))  # -> Alpha, Hue, Saturation, Luminance
ahsl_3 = SplitAHSL(Colour=ColourSwatch(SwatchColor=RGB(255, 69, 69)))  # -> Alpha, Hue, Saturation, Luminance
tstat_3 = TreeStatistics(Tree=unfeasible)  # -> Paths, Length, Count
srf_2 = Surface(segments)
branch_4 = TreeBranch(Tree=simplify(srf_2), Path=tstat.Paths, MaintainPaths=True)
hsl_2 = ColourHSL(Alpha=number_slider, Hue=ahsl.Hue, Saturation=ahsl.Saturation, Luminance=ahsl.Luminance)
branch_5 = TreeBranch(Tree=simplify(srf_2), Path=tstat_2.Paths, MaintainPaths=True)
branch_6 = TreeBranch(Tree=simplify(srf_2), Path=tstat_3.Paths, MaintainPaths=True)
hsl_3 = ColourHSL(Alpha=number_slider, Hue=ahsl_2.Hue, Saturation=ahsl_2.Saturation, Luminance=ahsl_2.Luminance)
hsl_4 = ColourHSL(Alpha=number_slider, Hue=ahsl_3.Hue, Saturation=ahsl_3.Saturation, Luminance=ahsl_3.Luminance)
preview_2 = CustomPreview(Geometry=branch_4, Material=hsl_2)
preview_3 = CustomPreview(Geometry=branch_6, Material=hsl_4)
preview_4 = CustomPreview(Geometry=branch_5, Material=hsl_3)
boxdim_2 = BoxDim(B=unfeasible, S=1)
independent_module_height = BooleanToggle(False)

# ---- group: extended sub-segments for pin heights
# segments are extended for
# covering whole pinbed module,
# for shape continuity
modules_2 = Rectangle(unflatten)
srf_3 = Surface(shell_3)
project_3 = Project(Curve=modules_2, Brep=srf_3, Direction=Vector(0, 0, 1))
trim_2 = TrimTree(Tree=project_3, Depth=1)
crossref = CrossReference(ListA=srf_3, ListB=trim_2, CrossMode=1)  # -> ListA, ListB
bbox_2 = BoundingBox(Content=crossref.ListB, Plane=PlaneXY(0, 0, 0))  # -> simplify(graft(Box)), Box_2
srfsplit_2 = SurfaceSplit(Surface=crossref.ListA, Curves=crossref.ListB)  # -> simplify(Fragments)
area_4 = Area(Geometry=bbox_2.Box)  # -> Area, Centroid
area_5 = Area(Geometry=srfsplit_2)  # -> Area, Centroid
dist = Distance(PointA=area_5.Centroid, PointB=area_4.Centroid)
sort_2 = SortList(Keys=dist, ValuesA=srfsplit_2)  # -> Keys, ValuesA
item_2 = ListItem(List=sort_2.ValuesA, Index=0, Wrap=True)
extended_sub_segments = Surface(item_2)

# ----
srf_4 = Surface(shell_3)

# ---- group: "lift" modules
srf_5 = Surface(extended_sub_segments)
rec = Rectangle(unflatten)
pln_2 = Plane(rec)
independent = Boolean(independent_module_height)
trim_3 = TrimTree(Tree=srf_5, Depth="2")

# ----
trim_4 = TrimTree(Tree=pln_2, Depth=Slider(1, range=0..2))

# ---- group: "lift" modules (continued)
item_3 = ListItem(List=trim_4, Index=0, Wrap=True)
bbox_3 = BoundingBox(Content=trim_3, Plane=item_3)  # -> simplify(Box), Box_2
bbox_4 = BoundingBox(Content=trim_3, Plane=item_3, UnionBox=True)  # -> Box, Box_2
filter = StreamFilter(Gate=independent, Stream0=bbox_4.Box, Stream1=bbox_3.Box)  # -> simplify(Stream)
debox = DeconstructBox(Box=filter)  # -> Plane, X, Y, Z
dedomain = DeconstructDomain(Domain=debox.Z)  # -> Start, End
Z = UnitZ(Factor=dedomain.Start)  # -> simplify(UnitVector)

# ----
lng_2 = ListLength(List=bbox_3.Box_2)
repeat = RepeatData(Data=Z, Length=lng_2)
filter_2 = StreamFilter(Gate=independent, Stream0=repeat, Stream1=Z)
unflatten_2 = UnflattenTree(Tree=filter_2, Guide=rec)

# ---- group: "lift" modules (continued)
move_2 = Move(Geometry=rec, Motion=unflatten_2)  # -> Geometry, Transform
lifted_modules = Rectangle(move_2.Geometry)
boundary = BoundarySurfaces(Edges=move_2.Geometry)

# ----
panel = Panel(debox.Z)

# ---- group: make pinbed
number_slider_2 = Slider(3, range=0..10)
extended_sub_segments_2 = Surface(extended_sub_segments)
lifted_modules_2 = Rectangle(lifted_modules)
dividerect = DivideRect(rec=lifted_modules_2, divu=number_slider_2, divv=number_slider_2)  # -> simplify(rec_4)
area_6 = Area(Geometry=dividerect)  # -> Area, Centroid
Z_2 = UnitZ(Factor=1)
project_4 = ProjectPoint(Point=area_6.Centroid, Direction=Z_2, Geometry=extended_sub_segments_2)  # -> Point, Index
merge = Merge(Data1=graft(area_6.Centroid), Data2=graft(project_4.Point))
crv = Curve(lifted_modules_2)
pline = PolyLine(Vertices=merge, Closed=False)
trim_5 = TrimTree(Tree=crv, Depth=Slider(0, range=0..10))
boundary_2 = BoundarySurfaces(Edges=crv)
trim_6 = TrimTree(Tree=pline, Depth=Slider(2, range=0..10))
merge_2 = Merge(Data2=trim_6, Data3=trim_5)

# ---- group: merge + structure pins per segment
unflattened_modules = Rectangle(simplify(unflatten))
pin_axis = Curve(pline)
trim_7 = TrimTree(Tree=unflattened_modules, Depth=1)
pln_3 = Plane(trim_7)
item_4 = ListItem(List=pln_3, Index=0, Wrap=True)
item_5 = ListItem(List=unflattened_modules, Index=0, Wrap=True)
split_2 = SplitTree(Data=unflattened_modules, Masks=flatten("{*;0}"))  # -> simplify(Positive), Negative
pln_4 = Plane(item_4)
trim_8 = TrimTree(Tree=item_5, Depth=1)
end = EndPoints(Curve=pin_axis)  # -> Start, End
lng_3 = ListLength(List=split_2.Positive)
lng_4 = ListLength(List=trim_8)
panel_2 = Panel("2")
modulesinx_2 = Integer(lng_4)
modulesiny_2 = Integer(lng_3)
trim_9 = TrimTree(Tree=end.End, Depth=Slider(3, range=0..10))
pt = Point(trim_9)
multiplication = Multiplication(A=modulesinx_2, B="3")
multiplication_2 = Multiplication(A=modulesiny_2, B="3")
panel_3 = Panel(modulesiny_2)
plcoord = PlaneCoordinates(Point=pt, System=pln_4)  # -> XCoordinate, YCoordinate, ZCoordinate
sort_3 = SortList(Keys=plcoord.YCoordinate, ValuesA=pt)  # -> Keys, ValuesA
lng_5 = ListLength(List=sort_3.ValuesA)
sqrt = SquareRoot(Value=lng_5)
repeat_2 = RepeatData(Data=pln_4, Length=multiplication_2)  # -> simplify(graft(Data))
partition = PartitionList(List=sort_3.ValuesA, Size=multiplication)
plcoord_2 = PlaneCoordinates(Point=partition, System=repeat_2)  # -> XCoordinate, YCoordinate, ZCoordinate
sort_4 = SortList(Keys=plcoord_2.XCoordinate, ValuesA=partition)  # -> Keys, ValuesA
pt_2 = Point(sort_4.ValuesA)

# ---- group: viz pin
crv_2 = Curve(pline)
clean = CleanTree(RemoveNulls=True, RemoveInvalid=True, RemoveEmpty=False, Tree=crv_2)
flatten_2 = FlattenTree(Tree=clean, Path="{0}")
max_pin_height = Number(".40")
len = Length(Curve=flatten_2)
sort_5 = SortList(Keys=len, ValuesA=flatten_2)  # -> Keys, ValuesA
larger = LargerThan(FirstNumber=len, SecondNumber=max_pin_height)  # -> LargerThan, OrEqualTo
item_6 = ListItem(List=reverse(sort_5.Keys), Index=0, Wrap=True)
item_7 = ListItem(List=reverse(sort_5.ValuesA), Index=0, Wrap=True)
dispatch = Dispatch(List=flatten(flatten_2), DispatchPattern=larger.LargerThan)  # -> ListA, ListB
longest_travel_m = Number(item_6)
longest_traveller = Geometry(item_7)
geo = Geometry(dispatch.ListA)
geo_2 = Geometry(dispatch.ListB)
entwine = Entwine(Branch00=geo, Branch01=geo_2, FlattenInputs=True)  # -> simplify(Result)
panel_4 = Panel(longest_travel_m)
number_slider_3 = Slider(0.02, range=0..0.1)
neg_2 = Negative(Value=number_slider_3)
Z_3 = UnitZ(Factor=neg_2)
move_3 = Move(Geometry=entwine, Motion=Z_3)  # -> Geometry, Transform
bang = ExplodeTree(Data=move_3.Geometry)  # -> Branch0, Branch1
pipe = Pipe(Curve=bang.Branch0, Radius=number_slider_3, Caps=2)
pipe_2 = Pipe(Curve=bang.Branch1, Radius=number_slider_3, Caps=2)  # -> flatten(Pipe); disabled
len_2 = Length(Curve=bang.Branch1)
gradient = Gradient(
    LowerLimit="0",
    UpperLimit=max_pin_height,
    Parameter=len_2,
    stops=[0: RGB(0, 98, 0), 0.25: RGB(81, 175, 17), 0.5: RGB(159, 198, 146), 0.75: RGB(170, 235, 41), 1: RGB(221, 255, 53)])  # disabled
preview_5 = CustomPreview(Geometry=pipe, Material=ColourSwatch(SwatchColor=RGB(255, 0, 0)))
preview_6 = CustomPreview(Geometry=pipe_2, Material=gradient)  # disabled

# ----
pt_3 = Point(pt_2)
relitem = RelativeItem(Tree=pt_3, Offset="{0;1}(0)", WrapPaths=False, WrapItems=False)  # -> ItemA, ItemB
relitem_2 = RelativeItem(Tree=pt_3, Offset="{0;0}(1)", WrapPaths=False, WrapItems=False)  # -> ItemA, ItemB
ln = Line(StartPoint=relitem.ItemA, EndPoint=relitem.ItemB)
ln_2 = Line(StartPoint=relitem_2.ItemA, EndPoint=relitem_2.ItemB)
entwine_2 = Entwine(Branch0X=ln, Branch1X=ln_2, FlattenInputs=False)

pt_4 = Point(pt_2)
relitem_3 = RelativeItem(Tree=pt_4, Offset="{0;1}(1)", WrapPaths=False, WrapItems=False)  # -> ItemA, ItemB
relitem_4 = RelativeItem(Tree=pt_4, Offset="{0;1}(-1)", WrapPaths=False, WrapItems=False)  # -> ItemA, ItemB
ln_3 = Line(StartPoint=relitem_3.ItemA, EndPoint=relitem_3.ItemB)
ln_4 = Line(StartPoint=relitem_4.ItemA, EndPoint=relitem_4.ItemB)
entwine_3 = Entwine(Branch0X=ln_3, Branch1X=ln_4, FlattenInputs=False)

trim_10 = TrimTree(Tree=entwine_2, Depth=1)
join = JoinCurves(Curves=trim_10, Preserve=False)
explode = Explode(Curve=join, Recursive=True)  # -> Segments, Vertices
num = Number(Slider(0.1, range=0..1))
intcrv = Interpolate(Vertices=explode.Vertices, Degree=3, Periodic=False, KnotStyle=1)  # -> Curve, Length, Domain
ext = ExtendCurve(Curve=intcrv.Curve, Type=0, Start=num, End=num)

# ---- group: number elements
data = Data(graft(trim_10))
tstat_4 = TreeStatistics(Tree=data)  # -> Paths, Length, Count
bbox_5 = BoundingBox(Content=data, Plane=PlaneXY(0, 0, 0))  # -> Box, Box_2
unflatten_3 = UnflattenTree(Tree=tstat_4.Paths, Guide=data)
volume = Volume(Geometry=bbox_5.Box)  # -> Volume, Centroid
pt_5 = Point(volume.Centroid)
tag = TextTag(Location=pt_5, Text=unflatten_3)

# ---- group: quantify deviation between rods and original surface
# had to move shell 1m up to prevent errors from Project component; then subtract 1 from distance
number_slider_4 = Slider(0.1, range=0..0.1)
srf_6 = Surface(srf_4)
crv_3 = Curve(intcrv.Curve)
divdist = DivideDistance(Curve=reparameterize(crv_3), Distance=number_slider_4)  # -> Points, Tangents, Parameters
trim_11 = TrimTree(Tree=simplify(divdist.Points), Depth=1)
Z_4 = UnitZ(Factor="1")
move_4 = Move(Geometry=srf_6, Motion=Z_4)  # -> Geometry, Transform
project_5 = ProjectPoint(Point=trim_11, Direction=Z_4, Geometry=move_4.Geometry)  # -> Point, Index
dist_2 = Distance(PointA=project_5.Point, PointB=trim_11)
ln_5 = Line(StartPoint=project_5.Point, EndPoint=trim_11)
subtraction_4 = Subtraction(A=dist_2, B="1")
avr = Average(Input=flatten(subtraction_4))
sort_6 = SortList(Keys=flatten(subtraction_4))  # -> Keys, ValuesA
item_8 = ListItem(List=reverse(sort_6.Keys), Index=0, Wrap=True)
largest_deviation = Number(item_8)
average_deviation = Number(avr)
panel_5 = Panel(average_deviation)
panel_6 = Panel(largest_deviation)

# ==== cluster BoxFit
lot = Integer(Slider(2, range=0..10))
dim_1 = ClusterInput()
dim_2 = ClusterInput()
neg = Negative(Value=lot)
box = ClusterInput()
_10º = PowerOf10(Value=neg)
box_2 = Box(box)
tolerance = Number(_10º)
dim_1_2 = Number(dim_1)
dim_2_2 = Number(dim_2)
addition = Addition(A=dim_1_2, B=tolerance)
addition_2 = Addition(A=dim_2_2, B=tolerance)
boxsize = BoxSize(box=box_2)  # -> X_2, Y_2, Z_2, A_2, V_2
panel = Panel(boxsize.X_2)
smaller = SmallerThan(FirstNumber=boxsize.X_2, SecondNumber=addition)  # -> SmallerThan, OrEqualTo
smaller_2 = SmallerThan(FirstNumber=boxsize.Y_2, SecondNumber=addition_2)  # -> SmallerThan, OrEqualTo
smaller_3 = SmallerThan(FirstNumber=boxsize.X_2, SecondNumber=addition_2)  # -> SmallerThan, OrEqualTo
smaller_4 = SmallerThan(FirstNumber=boxsize.Y_2, SecondNumber=addition)  # -> SmallerThan, OrEqualTo
panel_2 = Panel(boxsize.Y_2)
and = GateAnd(A=smaller.OrEqualTo, B=smaller_2.OrEqualTo)
and_2 = GateAnd(A=smaller_3.OrEqualTo, B=smaller_4.OrEqualTo)
or = GateOr(A=and, B=and_2)
toggle = BooleanToggle(True)
dispatch = Dispatch(List=box_2, DispatchPattern=or)  # -> ListA, ListB
clean = CleanTree(RemoveNulls=True, RemoveInvalid=True, RemoveEmpty=toggle, Tree=dispatch.ListB)
clean_2 = CleanTree(RemoveNulls=True, RemoveInvalid=True, RemoveEmpty=toggle, Tree=dispatch.ListA)
fit = Box(clean_2)
unfit = Box(clean)
branch = TreeBranch(Tree=fit, Path=Slider(1, range=0..10), MaintainPaths=True)
unfit_2 = ClusterOutput(unfit)
fit_2 = ClusterOutput(fit)

# ==== cluster BoxDim
B = ClusterInput()
edges = BrepEdges(Brep=B)  # -> Naked, Interior, NonManifold
split = SplitList(List=edges.Naked, Index=Slider(2, range=0..10))  # -> ListA, ListB
S = ClusterInput()
end = EndPoints(Curve=split.ListA)  # -> Start, End
neg = Negative(Value=Slider(0.593, range=0..1))
aligndim = AlignedDimension(Plane=PlaneXY(0, 0, 0), PointA=end.Start, PointB=end.End, Offset=neg, Text="{0:0.00}", Size=S)

# ==== cluster DivideRect
rec = ClusterInput()
divv = ClusterInput()
divu = ClusterInput()
rec_2 = Rectangle(rec)
divv_2 = Integer(divv)
divu_2 = Integer(divu)
drec = DeconstuctRectangle(Rectangle=rec_2)  # -> BasePlane, XInterval, YInterval
dom² = ConstructDomain²(DomainU=drec.XInterval, DomainV=drec.YInterval)
divide = DivideDomain²(Domain=dom², UCount=divu_2, VCount=divv_2)
dedom2 = DeconstructDomain²(Domain=divide)  # -> UComponent, VComponent
graft = GraftTree(Tree=drec.BasePlane, IncludeEmptyLists=True, IncludeNullItems=True)
rectangle = Rectangle(Plane=graft, XSize=dedom2.UComponent, YSize=dedom2.VComponent, Radius=0)  # -> Rectangle, Length
rec_3 = Rectangle(rectangle.Rectangle)
rec_4 = ClusterOutput(rec_3)

# ==== cluster RotatingCaliper
pi = Pi(Factor=1)
geo = ClusterInput()
range = Range(Domain=pi, Steps=Slider(100, range=0..100))
xy = XYPlane(Origin=Point(0, 0, 0))
geo_2 = Geometry(geo)
prot = RotatePlane(Plane=xy, Angle=range)
bbox = BoundingBox(Content=graft(geo_2), Plane=prot)  # -> Box, Box_2
trim = TrimTree(Tree=simplify(bbox.Box), Depth=1)
geo_3 = Geometry(simplify(trim))
area = Area(Geometry=geo_3)  # -> Area, Centroid
sort = SortList(Keys=area.Area, ValuesA=geo_3)  # -> Keys, ValuesA
item = ListItem(List=sort.ValuesA, Index=0, Wrap=True)
area_2 = Area(Geometry=item)  # -> Area, Centroid
box = Box(item)
area_3 = Number(area_2.Area)
box_2 = ClusterOutput(box)
area_4 = ClusterOutput(area_3)

# ==== cluster BoxSize
box = ClusterInput()
box_2 = Box(box)
debox = DeconstructBox(Box=box_2)  # -> Plane, X, Y, Z
dedomain = DeconstructDomain(Domain=debox.X)  # -> Start, End
dedomain_2 = DeconstructDomain(Domain=debox.Y)  # -> Start, End
dedomain_3 = DeconstructDomain(Domain=debox.Z)  # -> Start, End
subtraction = Subtraction(A=dedomain_2.End, B=dedomain_2.Start)
subtraction_2 = Subtraction(A=dedomain.End, B=dedomain.Start)
subtraction_3 = Subtraction(A=dedomain_3.End, B=dedomain_3.Start)
Y = Number(subtraction)
X = Number(subtraction_2)
Z = Number(subtraction_3)
multiplication = Multiplication(A=X, B=Y)
multiplication_2 = Multiplication(A=multiplication, B=Z)
V = Number(multiplication_2)
A = Number(multiplication)
Y_2 = ClusterOutput(Y)
X_2 = ClusterOutput(X)
Z_2 = ClusterOutput(Z)
V_2 = ClusterOutput(V)
A_2 = ClusterOutput(A)
