# Grasshopper definition ANALYSIS K220.gh (Grasshopper 1.0.7)
# plug-ins: Karamba3D, ACORNshells

structure_k220 = ModelKaramba3D(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)
disassemble = DisassembleModelKaramba3D(Model=structure_k220)  # -> Model, Point, Beam, Shell, Support, Load, Line, Mesh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
load_pattern = Slider(3, range=1..7)
mesh = Mesh(disassemble.Mesh)
image = ImageSampler(Filter="Colour", Interpolate=False, Umax=1, Umin=0, Vmax=1, Vmin=0, Wrap=1)
dead_load_kn_m2 = Slider(1, range=0..10)
number_slider = Slider(1, range=0..1)
live_load_kn_m2 = Slider(1.5, range=0..6)
load_pattern_2 = Integer(load_pattern)
loadpattern = LoadPattern(ShellMesh=mesh, Arc=number_slider, Offset=number_slider, Predefined=load_pattern_2)  # -> LoadPatternTuple, CheckPoints
shellloads = ShellLoads(
    ShellMesh=mesh,
    DeadLoadValue=dead_load_kn_m2,
    LiveLoadValue=live_load_kn_m2,
    LiveLoadPattern=loadpattern.LoadPatternTuple)  # -> Loads, CheckPoints
merge = Merge(Data1=disassemble.Beam, Data2=disassemble.Shell)
load = LoadKaramba3D(shellloads.Loads)
assemble = AssembleModelKaramba3D(Elem=merge, Support=disassemble.Support, Load=load, LimitDistance_m="0.001")  # -> Model, Info, Mass_kg, CenterOfGravity, LoadCaseNames
results = AnalysisResults(KarambaModel=assemble.Model, Fast=Toggle(False))  # -> Output, AnalysedModel, BucklingModel, MaximumDisplacement, BucklingLoadFactors
stressresults = StressResults(AnalysedModel=results.AnalysedModel, Percentile=Slider(96, range=95..99))  # -> MaxComp, MaxComp_2, MaxCompMeshEs, MaxTens, MaxTens_2, MaxTensMesh
modelview = ModelViewKaramba3D(Model=results.BucklingModel, ResultFactors=1, ResultCase=-1)  # -> Model, DeformedMesh, DeformedAxes, DeformedModel
modelview_2 = ModelViewKaramba3D(Model=results.AnalysedModel, ResultFactors=1, ResultCase=-1)  # -> Model, DeformedMesh, DeformedAxes, DeformedModel
# analysis results: maximum compression stress [MPa]
# 95% compression stress [MPa]
# maximum tension stress [MPa]
# 95% tension stress [MPa]
# buckling load factors
# maximum deflection [cm]
merge_2 = Merge(
    Data1=flatten(stressresults.MaxComp),
    Data2=flatten(stressresults.MaxComp_2),
    Data3=flatten(stressresults.MaxTens),
    Data4=flatten(stressresults.MaxTens_2),
    Data5=flatten(results.BucklingLoadFactors),
    Data6=flatten(results.MaximumDisplacement))
geo = Geometry(stressresults.MaxTensMesh)
geo_2 = Geometry(stressresults.MaxCompMeshEs)
shellview = ShellViewKaramba3D(Model=modelview_2.Model, IndexOfLayer=0)  # -> Model, MeshesOfRenderedShells, LegendColors, LegendTags
shellview_2 = ShellViewKaramba3D(Model=modelview.Model, IndexOfLayer=0)  # -> Model, MeshesOfRenderedShells, LegendColors, LegendTags
panel = Panel(merge_2)
legend = Legend(Colour=shellview.LegendColors, Tags=shellview.LegendTags, LegendType=1)
legend_2 = Legend(Colour=shellview_2.LegendColors, Tags=shellview_2.LegendTags, LegendType=1)
medges = MeshEdges(Mesh=shellview.MeshesOfRenderedShells)  # -> NakedEdges, InteriorEdges, NonManifoldEdges
medges_2 = MeshEdges(Mesh=shellview_2.MeshesOfRenderedShells)  # -> NakedEdges, InteriorEdges, NonManifoldEdges
geo_3 = Geometry(medges.InteriorEdges)
geo_4 = Geometry(medges_2.InteriorEdges)
