# Grasshopper definition FABRICATION.gh (Grasshopper 1.0.7)
# plug-ins: ACORNshells

geometry = Geometry(Tree({0}: [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], {1}: [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], {2}: [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]))
bang = ExplodeTree(Data=geometry)  # -> Branch0, Branch1, Branch2
extrados = Geometry(bang.Branch0)
intrados = Geometry(bang.Branch2)
medial = Geometry(bang.Branch1)
number_slider = Slider(1, range=0..1)
segments = Surface(simplify(graft(medial)))
minbox = MinimumVolumeBox(Segment=segments, AngularResolution=Slider(2, range=0..10), Rotate3D=Toggle(False))
pinmods = PinbedModules(Boxes=flatten(minbox), Width=number_slider, Depth=number_slider, ToleranceLevel=Slider(3, range=0..10))
pinbedsim = PinbedSimulation(
    ShellSegments=segments,
    Modules=pinmods,
    VH=Toggle(True),
    MaximumPinLength=Slider(0.4, range=0..1),
    SelectedSegments=Slider(7, range=0..100))  # -> ShellSegments, ExtendedSegments, Modules, Boxes, PinAxes, PinHeights, PinColors
areaeff = AreaEfficiency(Segment=segments, Modules=pinmods)
avr = Average(Input=flatten(areaeff))
extended_segments = Geometry(pinbedsim.ExtendedSegments)
original_segments = Geometry(pinbedsim.ShellSegments)
adjusted_modules = Geometry(pinbedsim.Modules)
preview = CustomPreview(Geometry=pinbedsim.PinAxes, Material=pinbedsim.PinColors)
panel = Panel(avr)
pins = Geometry(pinbedsim.PinAxes)
end = EndPoints(Curve=pins)  # -> Start, End
lng = ListLength(List=end.Start)
series = Series(Start=0, Step=1, Count=lng)
tag = TextTag(Location=end.Start, Text=series)
