# Grasshopper definition GEOMETRY.gh (Grasshopper 1.0.7)
# plug-ins: ACORNshells, karambaGH

# ----
# Inputs:
bay_width = Slider(4.5, range=0..10)
rectangle = Rectangle(Plane=PlaneXY(0, 0, 0), XSize=bay_width, YSize=bay_width, Radius=0)  # -> Rectangle, Length
number_slider = Slider(0.3, range=0..1)
shell_height = Slider(0.5625, range=0..1)

corner_radius = Number(number_slider)
corner_radius_2 = Number(number_slider)
bay_outline = Curve(rectangle.Rectangle)
bay_outline_2 = Curve(rectangle.Rectangle)
shellplan = ShellPlan(Outline=bay_outline, CornerRadius=corner_radius_2, CurvedCorner=Toggle(False))
membrane_prestress = Slider(0.335, range=0..1)
cable_prestress = Slider(0.915, range=0..1)

# ----
# ▲
# Press Button
# to start
# Formfinding
button = Button()

shell_height_2 = Number(shell_height)
srf = Surface(shellplan)
formfind = FormfindShell(PlanShell=srf, Height=shell_height_2, MembranePrestress=membrane_prestress, CablePrestress=cable_prestress, Run=button)  # -> KiwiErrors, FormFoundShell
demo = Geometry(formfind.FormFoundShell)
mesh_breps = MeshBrepsKaramba3D(
    Brep=demo,
    MeshResolution=Slider(0.1, range=0..1),
    EdgeRefinementFactor=Slider(0.333, range=0..1),
    PointReduction=Toggle(False),
    SmoothingStepSize=Slider(1, range=0..1),
    SmoothingIterations=Slider(1, range=0..10))  # -> Mesh, Info
premodel = PreliminaryModel(ShellSurface=demo, Mesh=mesh_breps.Mesh)
analyze = AnalyzeKaramba3D(Model=premodel)  # -> CalculatedModel, MaximumDisplacement_cm, ResultingForceOfGravity_kN, ElasticEnergy_kNm
stresslines = StressLines(
    Model=analyze.CalculatedModel,
    Shell=demo,
    KeystoneWidth=Slider(1.5, range=0..2),
    CornerstoneWidth=Slider(1.5, range=0..2),
    LengthParam1=Slider(0.5, range=0..2),
    LengthParam2=Slider(1, range=0..2))  # -> Shell, StressLines1, StressLines2, Geodesics, SourcePoints
thickness_at_apex = Number(Slider(0.03, range=0..0.1))
thickness_at_supports = Number(Slider(0.06, range=0..0.1))
varthickshell = VariableThicknessShell(ShellSurface=stresslines.Shell, ThicknessAtApex=thickness_at_apex, ThicknessAtSupports=thickness_at_supports)  # -> TopSurface, MedialSurface, BottomSurface
merge = Merge(Data1=varthickshell.TopSurface, Data2=varthickshell.MedialSurface, Data3=varthickshell.BottomSurface)
segment = SegmentationLayout(Shell=merge, StressLines1=stresslines.StressLines1, StressLines2=stresslines.StressLines2)  # -> simplify(Segments)
bang = ExplodeTree(Data=segment)  # -> Branch0, Branch1, Branch2
column_height = Number(Slider(3, range=0..10))
bay_geometry = Geometry(bay_outline_2)
tie_rod_radius = Number("0.008")
thickness_m = Number(Slider(0.0325, range=0..0.1))
corner_radius_3 = Number(corner_radius)
extrados = Geometry(bang.Branch0)
intrados = Geometry(bang.Branch2)

# ----
# :Outputs
geometry = Geometry(segment)

vizbldg = VisualiseBuilding(
    BayGeometry=bay_geometry,
    TopSegments=extrados,
    BottomSegments=intrados,
    CornerRadius=corner_radius_3,
    TieRodRadius=tie_rod_radius,
    ColumnHeight=column_height,
    NrSpacers=Slider(7, range=0..10),
    FilletEdges=Toggle(False))  # -> ThickSegments, Floor, Spacers, Columns, ColumnHeads, TieRods
