# Grasshopper definition STRUCTURE.gh (Grasshopper 1.0.7)
# plug-ins: ACORNshells, karambaGH

# ----
# Inputs:
# ▲
# From
# GEOMETRY.gh
# output
geometry = Geometry(Tree({0}: [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], {1}: [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], {2}: [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]))
matselect = MaterialSelectionKaramba3D(menu=[dropdown(3), dropdown(9)])

bang = ExplodeTree(Data=geometry)  # -> Branch0, Branch1, Branch2
extrados = Geometry(bang.Branch0)
intrados = Geometry(bang.Branch2)
medial = Geometry(bang.Branch1)
mesh_res = Number(Slider(0.05, range=0..0.1))
edge_ref = Number(Slider(0.666, range=0..1))
springcs = SpringCrossSection(RotationalStiffness="0.01")
medial_2 = Geometry(medial)
springs = InterfaceSprings(ShellSegments=medial_2, MeshResolution=mesh_res, EdgeRefinementFactor=edge_ref, SpringsCrossSection=springcs)  # -> KarambaSprings, OffsetSegments, SegmentSpringLocations, EdgeSpringLocations, SpringLines
segmentspringlocations = Geometry(springs.SegmentSpringLocations)
offsetsegments = Geometry(springs.OffsetSegments)
mesh_breps = MeshBrepsKaramba3D(
    Brep=offsetsegments,
    InclusionPoints=segmentspringlocations,
    MeshResolution=mesh_res,
    EdgeRefinementFactor=edge_ref,
    PointReduction=False,
    SmoothingStepSize=Slider(1, range=0..1),
    SmoothingIterations=Slider(3, range=0..10))  # -> simplify(Mesh), Info
mesh = Mesh(mesh_breps.Mesh)
a_varthickmesh = VariableThicknessMesh(TopSurface=extrados, MedialSurface=medial, BottomSurface=intrados, ShellMeshes=flatten(mesh), Quick=Toggle(True))
karamba_springs = Data(springs.KarambaSprings)
medial_3 = Geometry(medial_2)
thicknesses = Number(a_varthickmesh)
join = BrepJoin(Breps=medial_3)  # -> Breps, Closed
material = MaterialKaramba3D(matselect)
a_makeshell = MakeKarambaShellElement(ShellSurface=join.Breps, Meshes=mesh, Thickness=thicknesses, Material=material)  # -> simplify(ShellElements), simplify(ShellSupports)
merge = Merge(Data1=karamba_springs, Data2=a_makeshell.ShellElements)
assemble = AssembleModelKaramba3D(Elem=flatten(merge), Support=flatten(a_makeshell.ShellSupports), LimitDistance_m="0.001")  # -> Model, Info, Mass_kg, CenterOfGravity
modelview = ModelViewKaramba3D(Model=assemble.Model, ResultFactors=1, ResultCase=-1)  # -> Model, DeformedMesh, DeformedAxes, DeformedModel
shellview = ShellViewKaramba3D(Model=modelview.Model, IndexOfLayer=0)  # -> Model, MeshesOfRenderedShells, LegendColors, LegendTags

# ----
# :Outputs
structure = ModelKaramba3D(assemble.Model)

medges = MeshEdges(Mesh=shellview.MeshesOfRenderedShells)  # -> NakedEdges, InteriorEdges, NonManifoldEdges
mesh_2 = Mesh(shellview.MeshesOfRenderedShells)
