# Grasshopper definition example_GEOMETRY.gh (Grasshopper 1.0.7)
# plug-ins: ACORNshells, karambaGH

sin = Sine(Value="pi/4")
multiplication = Multiplication(A=Slider(0.3, range=0..1), B=sin)
bay_geometry = Geometry(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)
corner_radius = Number(multiplication)
shellplan = ShellPlan(Outline=bay_geometry, CornerRadius=corner_radius, CurvedCorner=Toggle(False))
membrane_prestress = Slider(0.335, range=0..1)
cable_prestress = Slider(0.915, range=0..1)
shell_height = Slider(0.5625, range=0..1)
srf = Surface(shellplan)
formfind = FormfindShell(
    PlanShell=srf,
    Height=shell_height,
    SubDiv=Slider(15, range=0..100),
    MembranePrestress=membrane_prestress,
    CablePrestress=cable_prestress,
    Run=Button())  # -> KiwiErrors, FormFoundShell

# ---- group: Segmentation
demo = Geometry(formfind.FormFoundShell)
mesh_breps = MeshBrepsKaramba3D(
    Brep=demo,
    MeshResolution=Slider(0.1, range=0..1),
    EdgeRefinementFactor=Slider(0.333, range=0..1),
    PointReduction=Toggle(False),
    SmoothingStepSize=Slider(1, range=0..1),
    SmoothingIterations=Slider(1, range=0..10))  # -> Mesh, Info
premodel = PreliminaryModel(ShellSurface=demo, Mesh=mesh_breps.Mesh)
number_slider = Slider(1.5, range=0..10)
analyze = AnalyzeKaramba3D(Model=premodel)  # -> CalculatedModel, MaximumDisplacement_cm, ResultingForceOfGravity_kN, ElasticEnergy_kNm
stresslines = StressLines(
    Model=analyze.CalculatedModel,
    Shell=demo,
    KeystoneWidth=number_slider,
    CornerstoneWidth=number_slider,
    LengthParam1=number_slider,
    LengthParam2=number_slider)  # -> StressLines1, StressLines2, CableProfiles1, CableProfiles2
segment = SegmentationLayout(Shell=demo, StressLines1=stresslines.StressLines1, StressLines2=stresslines.StressLines2)
geo = Geometry([stresslines.StressLines1, stresslines.StressLines2])
geo_2 = Geometry([stresslines.CableProfiles1, stresslines.CableProfiles2])

# ----
thickness_at_apex = Number(Slider(0.03, range=0..0.1))
thickness_at_supports = Number(Slider(0.06, range=0..1))
a_varthickshell = MakesVariableThicknessShellSurface(
    ShellSurface=formfind.FormFoundShell,
    ThicknessAtApex=thickness_at_apex,
    ThicknessAtSupports=thickness_at_supports,
    Linear=Toggle(False))  # -> TopSurface, MedialSurface, BottomSurface
varthickshell = VariableThicknessShell()  # -> TopSurface, MedialSurface, BottomSurface
image = ImageSampler(Filter="Colour", Interpolate=False, Umax=1, Umin=0, Vmax=1, Vmin=0, Wrap=1)
