# Grasshopper definition example_KARAMBA.gh (Grasshopper 1.0.7)
# plug-ins: ACORNshells, karambaGH

# ---- group: spring specification
# spring setup
number_slider = Slider(1, range=1..10)
panel = Panel("main direction")
_10º = PowerOf10(Value=Slider(-2, range=-2..4))
multiplication = Multiplication(A=number_slider, B=_10º)
panel_2 = Panel("0")
_10º_2 = PowerOf10(Value=Slider(7, range=0..10))
_10º_3 = PowerOf10(Value=Slider(3, range=0..10))
_10º_4 = PowerOf10(Value=Slider(3, range=0..10))
multiplication_2 = Multiplication(A=Slider(1, range=0..1), B=_10º_2)
multiplication_3 = Multiplication(A=Slider(1, range=0..1), B=_10º_3)
multiplication_4 = Multiplication(A=Slider(1, range=0..1), B=_10º_4)
vec = VectorXYZ(XComponent=multiplication, YComponent=multiplication, ZComponent=multiplication)  # -> Vector, Length
vec_2 = VectorXYZ(XComponent=multiplication_3, YComponent=multiplication, ZComponent=multiplication_4)  # -> Vector, Length
vec_3 = VectorXYZ(XComponent=multiplication_2, YComponent=multiplication_2, ZComponent=multiplication_2)  # -> Vector, Length
cross_section = CrossSectionKaramba3D(
    FamilyNameOfCrossSection="DefaultCroSec",
    ElementIdentifier="spring",
    CTranslation_kN_m=vec_3.Vector,
    CRotation_kNm_rad=vec_2.Vector,
    mode="Spring")
crosec = CrossSectionKaramba(cross_section)

# ----
_9_piece_segments = Brep([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])
_9_piece_shell = Geometry(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)
segments = Surface(_9_piece_segments)
mesh_res = Number(Slider(0.05, range=0..0.1))
shell = Geometry(_9_piece_shell)
number_slider_2 = Slider(0.666, range=0..1)
mesh_res_2 = Number(mesh_res)

multiplication_5 = Multiplication(A=mesh_res_2, B=number_slider_2, C="1.1")
spring_spacing = Number(multiplication_5)
gap_size = Number(Slider(0.002, range=0..0.02))
crosec_2 = CrossSectionKaramba(crosec)
a_springs = MakeSprings(ShellSegments=segments, SpringDistance=spring_spacing, GapSize=gap_size, SpringsCrossSection=crosec_2)  # -> OffsetSegments, SegmentSpringLocations, EdgeSpringLocations, SpringLines, KarambaSprings, GapSize
segmentspringlocations = Geometry(a_springs.SegmentSpringLocations)
offsetsegments = Geometry(a_springs.OffsetSegments)
karamba_springs = Data(a_springs.KarambaSprings)

mesh_breps = MeshBrepsKaramba3D(
    Brep=offsetsegments,
    InclusionPoints=segmentspringlocations,
    MeshResolution=mesh_res_2,
    EdgeRefinementFactor=number_slider_2,
    PointReduction=False,
    SmoothingStepSize=Slider(1, range=0..1),
    SmoothingIterations=Slider(3, range=0..10))  # -> simplify(Mesh), Info
mesh_post_processing = MeshPostProcessing(x=mesh_breps.Mesh)  # -> simplify(unresolved_proxy)
pt = ConstructPoint(XCoordinate=Slider(2.1, range=0..2.1), YCoordinate=Slider(2.1, range=0..2.1), ZCoordinate=0)
pt_2 = Point(pt)
mesh = Mesh(mesh_breps.Mesh)
md_slider = MDSlider(
    SliderMode=0,
    slider_value=Point(0.9283447266, 0.9391021729, 0.5),
    x_domain=Domain(0, 1),
    y_domain=Domain(0, 1),
    z_domain=Domain(0, 1))
md_slider_2 = MDSlider(
    SliderMode=0,
    slider_value=Point(0.9413757324, 0.5280151367, 0.5),
    x_domain=Domain(0, 1),
    y_domain=Domain(0, 1),
    z_domain=Domain(0, 1))
md_slider_3 = MDSlider(
    SliderMode=0,
    slider_value=Point(0.7764152758, 0.744934082, 0.5),
    x_domain=Domain(0, 1),
    y_domain=Domain(0, 1),
    z_domain=Domain(0, 1))
pt_3 = Point(Point(1.545249042, 1.535708762, 0))
pt_4 = Point(<point referenced from the Rhino model>)  # disabled

xy = XYPlane(Origin=Point(0, 0, 0))
pflip = FlipPlane(Plane=xy, ReverseX="true", ReverseY="false", SwapAxes="false")
pflip_2 = FlipPlane(Plane=xy, ReverseX="false", ReverseY="false", SwapAxes="false")
pflip_3 = FlipPlane(Plane=xy, ReverseX="false", ReverseY="true", SwapAxes="false")
pflip_4 = FlipPlane(Plane=xy, ReverseX="true", ReverseY="true", SwapAxes="false")
number_slider_3 = Slider(7, range=0..10)
merge = Merge(Data1=pflip_2, Data2=pflip, Data3=pflip_3, Data4=pflip_4)
sqgrid = Square(Plane=merge, Size="0.3", ExtentX=number_slider_3, ExtentY=number_slider_3)  # -> Cells, Points
cullpt = CullDuplicates(Points=flatten(sqgrid.Points), Tolerance=0.1, CullMode=3)  # -> Points, Indices, Valence
md_slider_4 = MDSlider(
    SliderMode=0,
    slider_value=Point(0.4804382324, 0.4870910645, 0.5),
    x_domain=Domain(0, 1),
    y_domain=Domain(0, 1),
    z_domain=Domain(0, 1))
pdecon = Deconstruct(Point=md_slider)  # -> XComponent, YComponent, ZComponent
cp = ClosestPoint(Point=pt_2, Cloud=cullpt.Points)  # -> ClosestPoint, CPIndex, Distance
sph = Sphere(Base=pt_4, Radius=".05")
mesh_2 = Mesh(mesh)
bbox = BoundingBox(Content=flatten(mesh_2), Plane=PlaneXY(0, 0, 0), UnionBox=True)  # -> Box, Box_2
box = EvaluateBox(Box=bbox.Box, UParameter=pdecon.XComponent, VParameter=pdecon.YComponent, WParameter=pdecon.ZComponent)  # -> Plane, Point, Include
pt_5 = Point(cp.ClosestPoint)
number_slider_4 = Slider(0.25, range=0..1)
make_patch_load = MakePatchLoad(
    mesh=mesh_2,
    load_kn=Slider(30, range=0..1000),
    pt=pt_5,
    patch_width=number_slider_4,
    patch_length=number_slider_4,
    square=Toggle(True))  # -> load, pt_4
loads = LoadsKaramba3D(Vector=Vector(0, 0, -1), LCase=0, mode="Gravity")
merge_2 = Merge(Data1=loads, Data2=make_patch_load.load)  # -> flatten(Result)
load = LoadKaramba3D(merge_2)

pt_6 = Point(Point(0.3690949114, 0.2694813363, -0.004162224615))
edge = Point(Point(1.506936654, 0.271160161, 0))
crv_cp = CurveClosestPoint()  # -> Point, Parameter, Distance

segments_2 = Surface(segments)
mesh_3 = Mesh(mesh)
join = BrepJoin(Breps=segments_2)  # -> Breps, Closed
topology = BrepTopology(Brep=join.Breps, PerspectiveOnly=False)  # -> FaceFaceAdjacency, FaceEdgeAdjacency, EdgeFaceAdjacency
edges = BrepEdges(Brep=join.Breps)  # -> Naked, Interior, NonManifold
demesh = DeconstructMesh(Mesh=mesh_3)  # -> simplify(Vertices), Faces, Colours, Normals
geo = Geometry(edges.Interior)
pull = PullPoint(Point=demesh.Vertices, Geometry=geo, ClosestOnly=True)  # -> ClosestPoint, Distance
panel_3 = Panel("0.01")
smaller = SmallerThan(FirstNumber=pull.Distance, SecondNumber=Slider(0.01, range=0..0.01))  # -> SmallerThan, OrEqualTo
dispatch = Dispatch(List=pull.ClosestPoint, DispatchPattern=smaller.SmallerThan)  # -> ListA, ListB
geo_2 = Geometry(simplify(dispatch.ListA))
supp = SupportKaramba3D(PosInd=geo_2, menu=[buttons(off, off, on, off, off, off)])  # disabled

load_pattern = Slider(7, range=1..7)
image = ImageSampler(Filter="Colour", Interpolate=False, Umax=1, Umin=0, Vmax=1, Vmin=0, Wrap=1)
dead_load_kn_m2 = Slider(1, range=0..10)
live_load_kn_m2 = Slider(1.5, range=0..6)
number_slider_5 = Slider(1, range=0..1)
load_pattern_2 = Integer(load_pattern)
mesh_4 = Mesh(mesh)
a_loadpattern = LoadPattern(ShellMesh=mesh_4, Arc=number_slider_5, Offset=number_slider_5, Predefined=load_pattern_2)  # -> flatten(FaceIndexes), simplify(CheckPoints)
item = ListItem(List=a_loadpattern.FaceIndexes, Index=0, Wrap=True)
a_shellloads = ShellLoads(Mesh=flatten(mesh_4), DeadLoadValue=dead_load_kn_m2, LiveLoadValue=live_load_kn_m2, LiveLoadPattern=item)  # -> Loads, CheckPoints

analysis_algorithm = ValueList({"First order theory  (fast)": 0, "Second order theory (4x slower)": 1, "Non linear WIP (slowest)": 2}, selected="Second order theory (4x slower)")
load_2 = LoadKaramba3D(load)

# ---- group: custom material
compression_strength_mpa = Panel("43.63")
tensile_strength_mpa = Panel("7.141")
compression_stiffness_mpa = Panel("1986.3")
bending_stiffness_mpa = Panel("2948")
compression_stiffness_mpa_2 = Panel("20000")
bending_stiffness_mpa_2 = Panel("30000")
panel_4 = Panel("Mish's values")
mpa_kn_cm2 = Panel("0.1")
merge_3 = Merge(
    Data1=compression_strength_mpa,
    Data2=tensile_strength_mpa,
    Data3=compression_stiffness_mpa_2,
    Data4=bending_stiffness_mpa_2)
multiplication_6 = Multiplication(A=merge_3, B=mpa_kn_cm2)
matselect = MaterialSelectionKaramba3D(menu=[dropdown(3), dropdown(9)])
item_2 = ListItem(List=multiplication_6, Index=0, Wrap=True)  # -> Item, Item1, Item2, Item3
disassemble = DisassembleMaterialKaramba3D(Material=matselect)  # -> Material, TypeOfMaterial, FamilyNameOfMaterial, NameOfMaterial, ElemIdentifiers, Color, YoungsModulusKNCm2Dir12, InPlaneShearModulus_kN_cm2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
density_mortar = Panel("20")
f = Number(item_2.Item1)
panel_5 = Panel(disassemble.YoungsModulusKNCm2Dir12)

# same ratio as default material
E = Number(item_2.Item3)
division = Division(A=E, B="2.4")
G = Number(division)

matprops = MaterialPropertiesKaramba3D(
    FamilyOfMaterial=disassemble.FamilyNameOfMaterial,
    Name="Spray",
    ElementIdentifier=disassemble.ElemIdentifiers,
    Color=disassemble.Color,
    YoungsModulus_kN_cm2=E,
    InPlaneShearModulus_kN_cm2=G,
    TransverseShearModulus_kN_cm2=G,
    SpecificWeight_kN_m3=density_mortar,
    CoefficientOfThermalExpansion_1_C=disassemble.CoefficientOfThermalExpansion1CDir12,
    YieldStrength_kN_cm2=f,
    mode="Isotrop")
material = MaterialKaramba3D(matprops)

# ----
material_2 = MaterialKaramba3D(material)
a_makeshell = MakeKarambaShellElement(ShellSurface=shell, Meshes=mesh, Thickness=Slider(0.05, range=0..0.1), Material=material_2, FixedSupport=Toggle(False))  # -> simplify(ShellElements), simplify(ShellSupports)
merge_4 = Merge(Data1=simplify(a_makeshell.ShellSupports), Data2=supp)
merge_5 = Merge(Data1=a_makeshell.ShellElements, Data2=karamba_springs)
element = ElementKaramba(flatten(merge_5))
support = SupportKaramba3D(flatten(merge_4))

panel_6 = Panel("segmented shell")
assemble = AssembleModelKaramba3D(Elem=element, Support=support, Load=load_2, LimitDistance_m="0.001")  # -> Model, Info, Mass_kg, CenterOfGravity
cluster_resultsfinal = ClusterResultsFinal(model=assemble.Model, int=analysis_algorithm)  # -> analysed_model_2, maximum_displacement_cm_2, buckling_model_2, buckling_load_factors_2
a_stressresults = StressResults(AnalysedModel=cluster_resultsfinal.analysed_model_2, Percentile="99")  # -> MaxComp, MaxComp_2, MaxCompMeshEs, MaxTens, MaxTens_2, MaxTensMesh
merge_6 = Merge(
    Data1=flatten(a_stressresults.MaxComp),
    Data2=flatten(a_stressresults.MaxComp_2),
    Data3=flatten(a_stressresults.MaxTens),
    Data4=flatten(a_stressresults.MaxTens_2),
    Data5=flatten(cluster_resultsfinal.buckling_load_factors_2),
    Data6=flatten(cluster_resultsfinal.maximum_displacement_cm_2))

geo_3 = Geometry(a_stressresults.MaxTensMesh)
modelview = ModelViewKaramba3D(Model=cluster_resultsfinal.analysed_model_2, ResultFactors=1, ResultCase=-1)  # -> Model, DeformedMesh, DeformedAxes, DeformedModel
shellview = ShellViewKaramba3D(Model=modelview.Model, IndexOfLayer=0)  # -> Model, MeshesOfRenderedShells, LegendColors, LegendTags
# analysis results: maximum compression stress [MPa]
# 95% compression stress [MPa]
# maximum tension stress [MPa]
# 95% tension stress [MPa]
# buckling load factors
# maximum deflection [cm]
# mass / floor area [kg/sqm]
segmented_shell = Panel(merge_6)
apex_edge = Number(merge_6)

# ==== cluster ClusterResultsFinal
model = ClusterInput()
int = ClusterInput()
int_2 = Integer(int)
model_2 = ModelKaramba3D(model)
gate = StreamGate(Stream=model_2, Gate=int_2)  # -> Target0, Target1, Target2
model_3 = ModelKaramba3D()
analyzenonlin_wip = AnalyzeNonlinearWIPKaramba3D(
    Model=gate.Target2,
    NumberOfLoadSteps=1,
    NumberOfLoadIncrements=5,
    MaxNumberOfEquilibriumIterations=50,
    EquilibriumTolerance=1e-07,
    MaxNumberOfLimitLoadIterations=50,
    LimitLoadTolerance=0.01,
    mode="NewtonRaphson")  # -> CalculatedModel, MaximumDisplacement_cm, ElasticEnergy_kNm, Info, Lambdas
analyzenonlin_wip_2 = AnalyzeNonlinearWIPKaramba3D(
    Model=model_3,
    NumberOfLoadSteps=1,
    NumberOfLoadIncrements=5,
    MaxNumberOfEquilibriumIterations=50,
    EquilibriumTolerance=1e-07,
    MaxNumberOfLimitLoadIterations=50,
    LimitLoadTolerance=0.01,
    mode="NewtonRaphson")  # -> CalculatedModel, MaximumDisplacement_cm, ElasticEnergy_kNm, Info, Lambdas
analyzenonlin_wip_3 = AnalyzeNonlinearWIPKaramba3D(
    Model=model_3,
    NumberOfLoadSteps=1,
    NumberOfLoadIncrements=5,
    MaxNumberOfEquilibriumIterations=200,
    EquilibriumTolerance=1e-07,
    MaxNumberOfLimitLoadIterations=200,
    LimitLoadTolerance=0.01,
    StepSizeFactor=0.2,
    mode="Dynamic Relaxation")  # -> CalculatedModel, MaximumDisplacement_cm, ElasticEnergy_kNm, Info, Lambdas
analyzenonlin_wip_4 = AnalyzeNonlinearWIPKaramba3D(
    Model=model_3,
    NumberOfLoadSteps=1,
    InitialLoadFactor=0.2,
    MaxNumberOfEquilibriumIterations=50,
    TargetNumberOfEquilibriumIterations=10,
    EquilibriumTolerance=1e-07,
    MaxNumberOfLoadIncrements=30,
    mode="ArcLength")  # -> CalculatedModel, MaximumDisplacement_cm, ElasticEnergy_kNm, Info, Lambdas
analyzethii = AnalyzeThIIKaramba3D(Model=gate.Target1, LoadCase=-1, RTolerance=1e-07, MaxIterations=50, NoTensionalNII=False)  # -> CalculatedModel, MaximumDisplacement_cm, ResultingForceOfGravity_kN, ElasticEnergy_kNm
analyzethii_2 = AnalyzeThIIKaramba3D(Model=model_3, LoadCase=-1, RTolerance=1e-07, MaxIterations=50, NoTensionalNII=False)  # -> CalculatedModel, MaximumDisplacement_cm, ResultingForceOfGravity_kN, ElasticEnergy_kNm
analyze = AnalyzeKaramba3D(Model=model_3)  # -> CalculatedModel, MaximumDisplacement_cm, ResultingForceOfGravity_kN, ElasticEnergy_kNm
analyze_2 = AnalyzeKaramba3D(Model=gate.Target0)  # -> CalculatedModel, MaximumDisplacement_cm, ResultingForceOfGravity_kN, ElasticEnergy_kNm
ladeform = LargeDeformationAnalysisKaramba3D(Model=model_3, Increments=5, MaximumDisplacement_m=-1)  # -> CalculatedModel, MaximumDisplacement_cm
merge = Merge(
    Data1=analyze.CalculatedModel,
    Data2=analyzethii_2.CalculatedModel,
    Data3=analyzenonlin_wip_3.CalculatedModel,
    Data4=analyzenonlin_wip_2.CalculatedModel,
    Data5=analyzenonlin_wip_4.CalculatedModel,
    Data6=ladeform.CalculatedModel)  # -> simplify(graft(Result))
merge_2 = Merge(
    Data1=flatten(analyze.MaximumDisplacement_cm),
    Data2=flatten(analyzethii_2.MaximumDisplacement_cm),
    Data3=flatten(analyzenonlin_wip_3.MaximumDisplacement_cm),
    Data4=flatten(analyzenonlin_wip_2.MaximumDisplacement_cm),
    Data5=flatten(analyzenonlin_wip_4.MaximumDisplacement_cm),
    Data6=flatten(ladeform.MaximumDisplacement_cm))
merge_3 = Merge(
    Data1=flatten(analyze_2.MaximumDisplacement_cm),
    Data2=flatten(analyzethii.MaximumDisplacement_cm),
    Data3=flatten(analyzenonlin_wip.MaximumDisplacement_cm))  # -> flatten(Result)
merge_4 = Merge(
    Data1=flatten(analyze_2.CalculatedModel),
    Data2=flatten(analyzethii.CalculatedModel),
    Data3=flatten(analyzenonlin_wip.CalculatedModel))  # -> flatten(Result)
max_displacement = Panel(merge_2)
shellvecresults = ResultVectorsOnShellsKaramba3D(AnalyzedModel=merge, LayerPosition=0, mode="PrincStress")  # -> AnalyzedModel, Points, FirstPrincipalStressVector_kN_cm2, SecondPrincipalStressVector_kN_cm2, FirstPrincipalStressValue_kN_cm2, SecondPrincipalStressValue_kN_cm2
bmodes = BucklingModesKaramba3D(Model=merge, FromIndex=1, NumberOfModes=1, MaximumNumberOfIterations=300, Epsilon=1e-07)  # -> ModelWithBucklingModesAsLoadCaseResults, simplify(BucklingLoadFactors)
bmodes_2 = BucklingModesKaramba3D(Model=merge_4, FromIndex=1, NumberOfModes=1, MaximumNumberOfIterations=300, Epsilon=1e-07)  # -> ModelWithBucklingModesAsLoadCaseResults, BucklingLoadFactors
maximum_displacement_cm = Number(merge_3)
buckling_factor = Panel(bmodes.BucklingLoadFactors)
sort = SortList(Keys=shellvecresults.SecondPrincipalStressValue_kN_cm2)  # -> Keys, ValuesA
sort_2 = SortList(Keys=shellvecresults.FirstPrincipalStressValue_kN_cm2)  # -> Keys, ValuesA
buckling_load_factors = Number(flatten(bmodes_2.BucklingLoadFactors))
item = ListItem(List=reverse(sort.Keys), Index=0, Wrap=True)
item_2 = ListItem(List=reverse(sort_2.Keys), Index=0, Wrap=True)
item_3 = ListItem(List=sort.Keys, Index=0, Wrap=True)
item_4 = ListItem(List=sort_2.Keys, Index=0, Wrap=True)
max_1st_princ_stress_comp = Panel(item_4)
max_1st_princ_stress_tens = Panel(item_2)
max_2nd_princ_stress_comp = Panel(item_3)
max_2nd_princ_stress_tens = Panel(item)
analysed_model = ModelKaramba3D(merge_4)
buckling_model = ModelKaramba3D(bmodes_2.ModelWithBucklingModesAsLoadCaseResults)
analysed_model_2 = ClusterOutput(analysed_model)
maximum_displacement_cm_2 = ClusterOutput(maximum_displacement_cm)
buckling_load_factors_2 = ClusterOutput(buckling_load_factors)
buckling_model_2 = ClusterOutput(buckling_model)

# ==== cluster MeshPostProcessing
x = ClusterInput()
c_fix_mesh = CSharpScript(x=x)  # -> out, A, B; inputs x: Mesh
# ---------- c_fix_mesh: C# ----------
    Mesh fixedMesh = x.Duplicate() as Mesh;
    double maxAspectRatio = 10;
    double tol = Rhino.RhinoDoc.ActiveDoc.ModelAbsoluteTolerance;

    List<int> iBadFaces = new List<int>();

    List<double> aspectRatios = new List<double>();
    for (int i = 0; i < fixedMesh.Faces.Count; i++){
      MeshFace f = fixedMesh.Faces[i];
      //foreach (MeshFace f in fixedMesh.Faces){
      Point3d pA = fixedMesh.Vertices[f.A];
      Point3d pB = fixedMesh.Vertices[f.B];
      Point3d pC = fixedMesh.Vertices[f.C];

      //https://stackoverflow.com/questions/10289752/aspect-ratio-of-a-triangle-of-a-meshed-surface
      //AR = abc/((b+c-a)(c+a-b)(a+b-c))

      double lA = pA.DistanceTo(pB);
      double lB = pB.DistanceTo(pC);
      double lC = pC.DistanceTo(pA);

      double aspectRatio = (lA * lB * lC) / ((lB + lC - lA) * (lC + lA - lB) * (lA + lB - lC));
      aspectRatios.Add(aspectRatio);

      if (aspectRatio > maxAspectRatio)
        iBadFaces.Add(i);
    }

    fixedMesh.Faces.DeleteFaces(iBadFaces);
    //fixedMesh.HealNakedEdges(tol);
    //fixedMesh.Vertices.CullUnused();

    A = fixedMesh;
    B = aspectRatios;
# ---------- end c_fix_mesh ----------
mesh = Mesh(c_fix_mesh.A)
medges = MeshEdges(Mesh=mesh)  # -> NakedEdges, InteriorEdges, NonManifoldEdges
demesh = DeconstructMesh(Mesh=mesh)  # -> Vertices, Faces, Colours, Normals
len = Length(Curve=medges.InteriorEdges)
avr = Average(Input=len)
unresolved_proxy = ClusterOutput(<missing>)
multiplication = Multiplication(A=avr, B=Slider(0.25, range=0..1))
cir = Circle(Plane=demesh.Vertices, Radius=multiplication)

# ==== cluster MakePatchLoad
toggle = BooleanToggle(False)
patch_length = ClusterInput()
patch_width = ClusterInput()
square = ClusterInput()
load_kn = ClusterInput()
pt = ClusterInput()
mesh = ClusterInput()
patch_length_2 = Number(patch_length)
patch_width_2 = Number(patch_width)
square_2 = Boolean(square)
load_kn_2 = Number(load_kn)
mesh_2 = Mesh(mesh)
pt_2 = Point(pt)
division = Division(A=patch_width_2, B="2")
division_2 = Division(A=patch_length_2, B="2")
Z = UnitZ(Factor=load_kn_2)
Z_2 = UnitZ(Factor=1)
demesh = DeconstructMesh(Mesh=mesh_2)  # -> flatten(Vertices), Faces, Colours, Normals
rev = Reverse(Vector=Z)
project = ProjectPoint(Point=pt_2, Direction=Z_2, Geometry=mesh_2)  # -> Point, Index
mesh_points = Point(demesh.Vertices)
sph = Sphere(Base=project.Point, Radius=division)
box = CenterBox(Base=project.Point, X=division, Y=division_2, Z=division_2)
panel = Panel(project.Point)
filter = StreamFilter(Gate=square_2, Stream0=sph, Stream1=box)
brep = Brep(filter)
brepinc = PointInBrep(Brep=brep, Point=mesh_points, Strict=True)
dispatch = Dispatch(List=mesh_points, DispatchPattern=brepinc)  # -> ListA, ListB
pt_3 = Point(dispatch.ListA)
lng = ListLength(List=flatten(pt_3))
division_3 = Division(A=rev, B=lng)
loads = LoadsKaramba3D(ForceVector=division_3, Local=False, PosInd=pt_3, LCase=0, mode="Point")
load = ClusterOutput(loads)
pt_4 = ClusterOutput(pt_3)
