# Grasshopper definition example_makeShellPlan_formfinding.gh (Grasshopper 1.0.7)
# plug-ins: ACORNshells

polygon = Polygon(Plane=PlaneXY(0, 0, 0), Radius=3, Segments=Slider(5, range=3..6), FilletRadius=0)  # -> Polygon, Length

# ---- group: just because of squares
pi = Pi(Factor=".25")
rotate = Rotate(Geometry=polygon.Polygon, Angle=pi, Plane=PlaneXY(0, 0, 0))  # -> Geometry, Transform

# ----
pt = Point([Point(-2.65739868, 2.586695785, 0), Point(2.522828173, 2.363083722, 0), Point(4.069487342, -3.772482641, 0), Point(-1.375177545, -2.361354304, 0)])
pt_2 = Point([Point(0, 0, 0), Point(8, 0, 0), Point(6, 6, 0), Point(0, 6, 0)])
square_edge_length = Number(Slider(2, range=0..10))
pline = PolyLine(Vertices=pt_2, Closed=True)
rectangle = Rectangle(Plane=PlaneXY(0, 0, 0), XSize=square_edge_length, YSize=square_edge_length, Radius=0)  # -> Rectangle, Length
rectangle_2 = Rectangle(Plane=PlaneXY(0, 0, 0), XSize=Slider(7.8, range=0..10), YSize=Slider(7.2, range=0..10), Radius=0)  # -> Rectangle, Length
rectangle_3 = Curve(rectangle_2.Rectangle)
square = Curve(rectangle.Rectangle)
regular_polygon = Curve(rotate.Geometry)
irregular_quad = Curve(pline)
height_m = Number(Slider(0.8, range=0..1))
filter = StreamFilter(Gate=Slider(3, range=0..10), Stream0=rectangle_3, Stream1=square, Stream2=regular_polygon, Stream3=irregular_quad)

# ---- group: center at 0,0,0
crv = Curve(filter)
area = Area(Geometry=crv)  # -> Area, Centroid
rev = Reverse(Vector=area.Centroid)
move = Move(Geometry=crv, Motion=rev)  # -> Geometry, Transform

# ----
bay_geometry = Geometry(move.Geometry)

# ---- group: Generate plan
number_slider = Slider(36, range=0..100)
a_makeshellplan = MakeShellPlan(Outline=bay_geometry, CornerRadius=Slider(0.2, range=0..1), CurvedCorner=Toggle(True))

# ----
srf = Surface(a_makeshellplan)
multipatch_gh = MultiPatchGH(bay_geometry=bay_geometry, shell_plan=srf)
height_m_2 = Number(height_m)
geo = Geometry(srf)
membrane_prestress_u = Slider(0.15, range=0..0.5)
membrane_prestress_v = Slider(0.15, range=0..0.5)
cable_prestress = Slider(0.1, range=0..0.5)
load = Slider(0.084, range=0.005..0.095)
scaledeform = BooleanToggle(True)

# ---- group: Form finding - deflection
supportcurve = BooleanToggle(True)
height_m_3 = Number(height_m_2)
a_formfindkiwi = FormFindKiwi(
    PlanShell=geo,
    Height=height_m_3,
    SubDiv=Slider(10, range=0..100),
    Run=Button(),
    CurveSupports=supportcurve,
    ScaleDeform=scaledeform,
    ThicknessFactor=Slider(0.125, range=0..0.2))  # -> KiwiErrors, FormFoundShell

# ----
prestress_v = Number(membrane_prestress_v)
prestress_u = Number(membrane_prestress_u)
prestress_cable = Number(cable_prestress)
load_2 = Number(load)

# ---- group: Formfinding - membrane
supportcurve_2 = BooleanToggle(True)
scaledeform_2 = BooleanToggle(True)
height_m_4 = Number(height_m_2)
a_formfindmembrane = FormFindMembrane(
    PlanShell=geo,
    MultiplePatches=multipatch_gh,
    Height=height_m_4,
    SubDiv=Slider(10, range=0..100),
    Run=Button(),
    CurveSupports=supportcurve_2,
    ScaleDeform=scaledeform_2,
    ThicknessFactor=Slider(0.13, range=0..1),
    MembranePrestressU=prestress_u,
    MembranePrestressV=prestress_v,
    CablePrestressV=prestress_cable,
    Load=load_2,
    PlanarEdges=Toggle(True),
    UpdateOnChange=Toggle(False))  # -> KiwiErrors, FormFoundShell

# ----
geo_2 = Geometry(a_formfindmembrane.FormFoundShell)

# ==== cluster MultiPatchGH
shell_plan = ClusterInput()
bay_geometry = ClusterInput()
shell_plan_2 = Curve(shell_plan)
bay_geometry_2 = Geometry(bay_geometry)
explode = Explode(Curve=bay_geometry_2, Recursive=True)  # -> graft(Segments), Vertices
intcrv = Interpolate(Vertices=explode.Vertices, Degree=3, Periodic=Toggle(True), KnotStyle=1)  # -> Curve, Length, Domain
boundary = BoundarySurfaces(Edges=intcrv.Curve)
area = Area(Geometry=intcrv.Curve)  # -> Area, Centroid
extr = ExtrudePoint(Base=flatten(intcrv.Curve), Point=area.Centroid)
srf_cp = SurfaceClosestPoint(Point=explode.Vertices, Surface=reparameterize(extr))  # -> Point, UVPoint, Distance
pdecon = Deconstruct(Point=srf_cp.UVPoint)  # -> XComponent, YComponent, ZComponent
cull_i = CullIndex(List=pdecon.YComponent, Indices="0", Wrap=True)
cull_i_2 = CullIndex(List=cull_i, Indices="-1", Wrap=True)
merge = Merge(Data1=flatten("0"), Data2=flatten(cull_i_2), Data3=flatten("1"))
consec = ConsecutiveDomains(Numbers=merge, Additive=False)
dom = ConstructDomain(DomainStart=0, DomainEnd=1)
panel = Panel(consec)
dom² = ConstructDomain²(DomainU=dom, DomainV=consec)
divide = DivideDomain²(Domain=extr, UCount=Slider(1, range=0..10), VCount=Slider(10, range=0..10))
subsrf = Isotrim(Surface=reparameterize(extr), Domain=dom²)  # -> simplify(graft(Surface))
srfsplit = SurfaceSplit(Surface=subsrf, Curves=shell_plan_2)  # -> simplify(Fragments)
area_2 = Area(Geometry=srfsplit)  # -> Area, Centroid
sort = SortList(Keys=area_2.Area, ValuesA=srfsplit)  # -> Keys, ValuesA
item = ListItem(List=reverse(sort.ValuesA), Index=0, Wrap=True)  # -> flatten(Item)

# ---- group: isolines
number_slider = Slider(8, range=0..10)
number_slider_2 = Slider(9, range=0..10)
number_slider_3 = Slider(7, range=0..10)
one_over_x = OneOverX(Value=number_slider)
one_over_x_2 = OneOverX(Value=number_slider_2)
one_over_x_3 = OneOverX(Value=number_slider_3)
recgrid = Rectangular(Plane=PlaneXY(0, 0, 0), SizeX=one_over_x_3, SizeY=one_over_x_2, ExtentX=number_slider_3, ExtentY=number_slider_2)  # -> Cells, Points
sqgrid = Square(Plane=PlaneXY(0, 0, 0), Size=one_over_x, ExtentX=number_slider, ExtentY=number_slider)  # -> Cells, graft(Points)
iso = IsoCurve(Surface=reparameterize(item), UVPoint=sqgrid.Points)  # -> UIsocurve, VIsocurve

# ----
md_slider = MDSlider(
    SliderMode=0,
    slider_value=Point(0.8889428115, 0.7862578601, 0.5),
    x_domain=Domain(0, 1),
    y_domain=Domain(0, 1),
    z_domain=Domain(0, 1))
evalsrf = EvaluateSurface(Surface=reparameterize(item), Point=md_slider)  # -> Point, Normal, UDirection, VDirection, Frame
join = BrepJoin(Breps=item)  # -> Breps, Closed
_4_piece = Surface(item)

int = Integer(Slider(18, range=0..100))
one_over_x_4 = OneOverX(Value=int)
sqgrid_2 = Square(Plane=PlaneXY(0, 0, 0), Size=one_over_x_4, ExtentX=int, ExtentY=int)  # -> Cells, Points
iso_2 = IsoCurve(Surface=reparameterize(_4_piece), UVPoint=simplify(graft(sqgrid_2.Points)))  # -> UIsocurve, VIsocurve

_4_piece_2 = ClusterOutput(_4_piece)
