# Grasshopper definition example_pinbedSimulation.gh (Grasshopper 1.0.7)
# plug-ins: ACORNshells

# ----
# internalized
# data for shell segments
segments = Surface([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])

segments_2 = Surface(simplify(graft(segments)))
# MISH:
# 
# CHANGED BBOX INPUT TO GRAFT TO EACH SEGMENT
number_slider = Slider(3, range=0..10)
number_slider_2 = Slider(1, range=0..1)
a_fitbbox = FitBoundingBox(Segment=segments_2, AngularResolution=Slider(2, range=0..10), Rotate3D=Toggle(False))
a_fitmods = FitPinbedModules(Box=flatten(a_fitbbox), Width=number_slider_2, Depth=number_slider_2, ToleranceLevel=number_slider)  # -> simplify(ModuleRectangles)
item = ListItem(List=flatten(segments_2), Index=0, Wrap=True)
panel = Panel("""5
6
7""")
a_areaeff = GetAreaEfficiency(Segment=segments_2, Modules=a_fitmods)
number_slider_3 = Slider(5, range=0..10)
untrim = Untrim(Surface=item)
avr = Average(Input=flatten(a_areaeff))
branch = TreeBranch(Tree=segments_2, Path=panel, MaintainPaths=True)
a_simpinbed = SimulatePinbed(Shell=untrim, Modules=a_fitmods, VH=Toggle(True), SelectedSegments=panel, MaximumPinLength=Slider(0.4, range=0..1))  # -> ExtendedSegments, AdjustedModules, AdjustedBoxes, PinAxes, PinHeights, PinColors
shell_segments = Geometry(branch)
adjusted_modules = Geometry(a_simpinbed.AdjustedModules)
extended_segments = Geometry(a_simpinbed.ExtendedSegments)
pins = Geometry(a_simpinbed.PinAxes)
preview = CustomPreview(Geometry=a_simpinbed.PinAxes, Material=a_simpinbed.PinColors)
end = EndPoints(Curve=pins)  # -> Start, End
lng = ListLength(List=end.Start)
series = Series(Start=0, Step=1, Count=lng)
tag = TextTag(Location=end.Start, Text=series)
