# Grasshopper definition example_segmentation.gh (Grasshopper 1.0.7)
# plug-ins: ACORNshells, karambaGH

shell = Brep(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)
thickness_m = Number(0.06)

# ---- group: Preliminary analysis
mesh_breps = MeshBrepsKaramba3D(
    Brep=shell,
    MeshResolution=Slider(0.095, range=0..1),
    EdgeRefinementFactor=0.67,
    PointReduction=Toggle(False),
    SmoothingStepSize=Slider(1, range=0..1),
    SmoothingIterations=Slider(1, range=0..10))  # -> Mesh, Info
a_preliminaryshellanalysismodel = PreliminaryShellAnalysisModel(ShellSurface=shell, Mesh=mesh_breps.Mesh, Thickness=thickness_m)
analyze = AnalyzeKaramba3D(Model=a_preliminaryshellanalysismodel)  # -> CalculatedModel, MaximumDisplacement_cm, ResultingForceOfGravity_kN, ElasticEnergy_kNm

# ---- group: Segment shell
a_stresslines = StressLines(
    Model=analyze.CalculatedModel,
    Shell=shell,
    KeystoneWidth=Slider(2, range=0..2),
    CornerstoneWidth=Slider(2, range=0..2),
    LengthParam1=Slider(2.7, range=0..3),
    LengthParam2=Slider(1.5, range=0..3))  # -> StressLines1, StressLines2, CableProfiles1, CableProfiles2
a_segment = Segment(Shell=shell, StressLines1=a_stresslines.StressLines1, StressLines2=a_stresslines.StressLines2)

# ----
entwine = Entwine(Branch00=a_stresslines.CableProfiles2, Branch01=a_stresslines.CableProfiles1, FlattenInputs=True)  # -> simplify(Result)
shell_segments = Geometry(a_segment)
shell_segments_2 = Geometry(entwine)
